# Grasshopper definition 240801_MapNameToOtherGeometry_v1.gh (Grasshopper 1.0.8)
# plug-ins: Human

update_attributes = Button()

# ---- group: Panels to name
geometry = Geometry(simplify([<surface referenced from the Rhino model> x1106]))

# ---- group: Already names panels (As built)
geometry_2 = Geometry(simplify([<surface referenced from the Rhino model> x1106]))

# ----
discontinuity = Discontinuity(Curve=geometry, Level=1)  # -> Points, Parameters
discontinuity_2 = Discontinuity(Curve=geometry_2, Level=1)  # -> Points, Parameters
average = Average(Input=discontinuity.Points)  # -> flatten(ArithmeticMean)
average_2 = Average(Input=discontinuity_2.Points)  # -> flatten(ArithmeticMean)
geometry_3 = Geometry(geometry)
point = Point(average)
point_2 = Point(average_2)
closest_point = ClosestPoint(Point=point_2, Cloud=point)  # -> ClosestPoint, CPIndex, Distance
list_item = ListItem(List=geometry_3, Index=closest_point.CPIndex, Wrap=True)
object_attributes = ObjectAttributes(ObjectOrAttributes=geometry_2)  # -> Name, LayerName, LayerFullPath, Color, MaterialName, LinetypeName, GroupIndices, PlotWeight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

# ---- group: sorted design intent panels relative to as built
geometry_4 = Geometry(list_item)

# ----
object_attributes_2 = ObjectAttributes(ObjectOrAttributes=geometry_4)  # -> Name, LayerName, LayerFullPath, Color, MaterialName, LinetypeName, GroupIndices, PlotWeight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
createattributes = CreateAttributes(
    Name=object_attributes.Name,
    LayerName=object_attributes_2.LayerFullPath,
    Color=object_attributes_2.Color,
    enableFullPath=True)
stream_filter = StreamFilter(Gate=update_attributes, Stream1=createattributes)
modify_object_attributes = ModifyObjectAttributes(Objects=geometry_4, Attributes=stream_filter)
