# Grasshopper definition 241003_OneClickToggle_v1_ERSK.gh (Grasshopper 1.0.8)
# plug-ins: RhinoCodePluginGH

one_click_toggle = Button()
python_3_script = Python3Script(x=one_click_toggle)  # -> out, a; inputs x: Boolean
# ---------- python_3_script: Python ----------
if "toggle_state" not in globals():
    toggle_state = False  # Initial state is set to False

button_click = x  # 'x' is the input for the boolean toggle

if "prev_button_state" not in globals():
    prev_button_state = False  # To track previous state

if button_click and not prev_button_state:
    toggle_state = not toggle_state  # Toggle the state

prev_button_state = button_click

a = toggle_state
# ---------- end python_3_script ----------
