# Grasshopper definition 241008_ShadowGapAngleCalculator_v1_ERSK.gh (Grasshopper 1.0.8)
# plug-ins: RhinoCodePluginGH

desired_shadowgap = Panel("5")
angle_between_panels = Panel("90")
python_3_script = Python3Script(angle=angle_between_panels, shadow_gap=desired_shadowgap)  # -> out, offset_distance; inputs angle: Double, shadow_gap: Double
# ---------- python_3_script: Python ----------
import math

# Function to calculate offset distance
def calculate_offset_distance(theta_deg, g):
    """
    Calculate the offset distance for each panel based on the angle and desired shadow gap.

    Parameters:
    - theta_deg (float): Angle in degrees between the two panels.
    - g (float): Desired shadow gap.

    Returns:
    - x (float): Offset distance for each panel.
    """
    # Handle edge cases
    if theta_deg <= 0 or theta_deg >= 360:
        raise ValueError("Angle must be between 0 and 360 degrees (exclusive).")
    if g <= 0:
        raise ValueError("Shadow gap must be a positive value.")
    
    # Convert angle from degrees to radians
    theta_rad = math.radians(theta_deg)
    
    # Calculate sin(theta / 2)
    sin_theta_over_2 = math.sin(theta_rad / 2)
    
    # Prevent division by zero
    if sin_theta_over_2 == 0:
        raise ValueError("sin(theta/2) resulted in zero, cannot divide by zero.")
    
    # Calculate offset distance
    x = g / (2 * sin_theta_over_2)
    
    return x

# Main execution
try:
    # Ensure inputs are provided
    if angle is None or shadow_gap is None:
        raise ValueError("Both angle and shadow_gap inputs must be provided.")
    
    # Calculate offset distance
    offset_distance = calculate_offset_distance(angle, shadow_gap)
    
except Exception as e:
    # Handle exceptions and provide feedback in Grasshopper
    offset_distance = "Error: " + str(e)
# ---------- end python_3_script ----------
