# Grasshopper definition 241009_AlignCurves(Flip)_v1_ERSK.gh (Grasshopper 1.0.8)
# plug-ins: RhinoCodePluginGH

# This script:
# 
# 
# 
# 1. Uses the function ensure_same_direction() to compare the tangents of two curves and ensure they're aligned in the same direction.
# 
# 
# 2. Loops through each pair of curves from guideCrvs and testCrvs.
# 
# 3.
# Stores each pair (with their directions aligned) into a DataTree, with each branch containing two curves.
example_curve_list_1 = Curve(flatten(Tree({0}: [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], {1}: [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], {2}: [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])))
example_curve_list_2 = Curve(flatten(Tree({0}: [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], {1}: [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], {2}: [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])))
python_3_script = Python3Script(guideCrvs=example_curve_list_1, testCrvs=example_curve_list_2)  # -> out, outputTree; inputs guideCrvs: list of Curve, testCrvs: list of Curve
# ---------- python_3_script: Python ----------
from Grasshopper import DataTree
from Grasshopper.Kernel.Data import GH_Path
import rhinoscriptsyntax as rs
import Rhino

def ensure_same_direction(crv1, crv2):
    vector1 = rs.CurveTangent(crv1, rs.CurveDomain(crv1)[0])
    vector2 = rs.CurveTangent(crv2, rs.CurveDomain(crv2)[0])
    if rs.VectorAngle(vector1, vector2) > 90:
        crv2.Reverse()

guideCrvs = [x for x in guideCrvs if isinstance(x, Rhino.Geometry.Curve)]
testCrvs = [x for x in testCrvs if isinstance(x, Rhino.Geometry.Curve)]

# Create an empty DataTree to store the output
outputTree = DataTree[object]()

# Iterate through the curves and align directions
for i in range(min(len(guideCrvs), len(testCrvs))):
    guideCrv = guideCrvs[i]
    testCrv = testCrvs[i]

    # Ensure the testCrv is in the same direction as guideCrv
    ensure_same_direction(guideCrv, testCrv)

    # Create a new path for each pair
    path = GH_Path(i)

    # Add the guideCrv and testCrv to the data tree at the current path
    outputTree.Add(guideCrv, path)
    outputTree.Add(testCrv, path)

# Output the tree
a = outputTree
# ---------- end python_3_script ----------
loft = Loft(
    Curves=python_3_script.outputTree,
    Options={Adjust=False, Closed=False, LoftEnds=0, LoftSimp=0, LoftType=0, Rebuild=10, Refit=0.01})
