# Grasshopper definition 241010_GetViewportPlanes_v1_ERSK.gh (Grasshopper 1.0.8)
# plug-ins: RhinoCodePluginGH, eleFront

surface = Surface([<surface referenced from the Rhino model> x11])

# ---- group: CAMERA
construct_point = ConstructPoint(XCoordinate=-13616.5, YCoordinate=74458.561, ZCoordinate=24247.579)

# ---- group: TARGET
construct_point_2 = ConstructPoint(XCoordinate=-23900.942, YCoordinate=58621.909, ZCoordinate=22661.926)

# ----
discontinuity = Discontinuity(Curve=surface, Level=1)  # -> Points, Parameters
get_rhino_attributes = GetRhinoAttributes(Geometry=surface, fullpath=False)  # -> Name, Layer, Color, MaterialName, SourceFile
average = Average(Input=discontinuity.Points)  # -> flatten(ArithmeticMean)
vector_2pt = Vector2Pt(PointA=construct_point, PointB=construct_point_2, Unitize=False)  # -> Vector, Length
value_list = ValueList({"A_linear_5_0mm", "A_linear_5_0mm_1", "Arial", "Arial Narrow", "Ark-1_050", "Default", "KA Annotation", "KA Annotation 01", "KA Annotation Alternate Units", "KA Annotation Bold", "KA Annotation Bold Alternate Units", "KA Annotation Small", "KA Annotation Small Alternate Units", "KA Annotation Small Bold", "KA Annotation Small Bold Bottom Right", "KA Annotation Small Bold Top Left", "KA Annotation Small Bottom Left", "KA Review", "KA Review 01", "KA Title Block", "KA Title Block 01", "KA Title Block Bold"}, selected="KA Annotation")
python_3_script = Python3Script(x=average, y=vector_2pt.Vector)  # -> out, planes; inputs x: list of Point3d, y: Vector3d
# ---------- python_3_script: Python ----------
import Rhino.Geometry as rg

planes = []

for pt in x:

    p = rg.Plane(pt, y)
    planes.append(p)
# ---------- end python_3_script ----------
flip_plane = FlipPlane(Plane=python_3_script.planes, ReverseX=False, ReverseY=False, SwapAxes=Toggle(False))
define_text_object = DefineTextObject(Text=simplify(graft(get_rhino_attributes.Name)), Plane=simplify(graft(flip_plane)), DimensionStyle=value_list)
