# Grasshopper definition 241015_ExtrapolateData_v1_ERSK.gh (Grasshopper 1.0.8)
# plug-ins: RhinoCodePluginGH

# Fills empty branches in a DataTree with extrapolated data derived from existing data in other branches.
# 
#     :param data: DataTree containing strings that represent either points in the format '{x, y, z}' or numeric values. Some branches may be empty or contain invalid data.
#     :param method_input: Integer or string specifying the extrapolation method:
#                          - 0 or 'linear' for linear extrapolation,
#                          - 1 or 'cubic' for cubic spline extrapolation,
#                          - 2 or 'catmull-rom' for Catmull-Rom spline extrapolation.
#     :return: DataTree with the same structure as the input, but with empty branches filled with extrapolated data.
input_type = ValueList({"points": 0, "float": 1}, selected="float")
point = Point(Tree({0}: [], {1}: [], {2}: [Point(47708.56858, 83658.74646, 24623.08655)], {3}: [Point(47707.6601, 83654.00866, 24622.65316)], {4}: [Point(47706.83327, 83649.72151, 24622.25974)], {5}: [Point(47706.08065, 83645.84394, 24621.90266)], {6}: [Point(47705.39479, 83642.3349, 24621.57828)], {7}: [Point(47704.76827, 83639.15331, 24621.28293)], {8}: [Point(47704.19363, 83636.25814, 24621.013)], {9}: [Point(47703.66347, 83633.60834, 24620.76483)]))
number = Number(Tree({0}: [0], {1}: [1], {2}: [2], {3}: [], {4}: [4], {5}: [], {6}: [6], {7}: [], {8}: [8], {9}: [9]))
stream_filter = StreamFilter(Gate=input_type, Stream0=point, Stream1=number)
method_of_extrapolation = ValueList({"Linear": 0, "Cubic": 1, "Catmull-rom": 2}, selected="Linear")

# ---- group: input data needs to be converted to text
text = Text(stream_filter)

# ----
python_3_script = Python3Script(data=text, method_input=method_of_extrapolation)  # -> out, extended_data; inputs data: tree of String, method_input: Int32
# ---------- python_3_script: Python ----------
import re  # For regular expressions
import numpy as np
from scipy.interpolate import interp1d
import Rhino.Geometry as rg  # For Rhino Point3d
from Grasshopper import DataTree
from Grasshopper.Kernel.Data import GH_Path

def parse_string_item(item_str):
    """
    Parses a string and converts it into a Point3d or a float.
    """
    item_str = item_str.strip()
    
    # Check if it's a point in the format '{x, y, z}'
    point_match = re.match(r'^\{([\d\.\-eE]+),\s*([\d\.\-eE]+),\s*([\d\.\-eE]+)\}$', item_str)
    if point_match:
        x, y, z = map(float, point_match.groups())
        return rg.Point3d(x, y, z)
    
    # Check if it's a number
    try:
        return float(item_str)
    except ValueError:
        return None  # Invalid item

def extrapolate(data, method):
    """
    Extrapolates data for empty branches based on known data from other branches.
    """
    output_data = DataTree[object]()  # Initialize the output DataTree

    indices_known = []  # Branch indices with known data
    indices_empty = []  # Branch indices that are empty

    # Variables to hold known data
    x_known = []
    y_known = []
    z_known = []
    data_known = []

    is_point3d = None  # Will determine data type based on first valid item

    print("Starting extrapolation...")
    print(f"Input DataTree has {data.BranchCount} branches.")

    # First pass: Collect known data and indices
    for i in range(data.BranchCount):
        branch_path = data.Paths[i]
        branch_data = data.Branch(branch_path)

        # Parse items in the branch
        parsed_items = [parse_string_item(str(item)) for item in branch_data]
        valid_items = [item for item in parsed_items if item is not None]

        print(f"Branch {i} has {len(valid_items)} valid items.")

        if len(valid_items) > 0:
            # Determine data type
            if is_point3d is None:
                is_point3d = isinstance(valid_items[0], rg.Point3d)

            indices_known.append(i)

            if is_point3d:
                # Collect Point3d data
                if len(valid_items) != 1:
                    raise ValueError("Each branch should contain only one Point3d item.")
                pt = valid_items[0]
                x_known.append(pt.X)
                y_known.append(pt.Y)
                z_known.append(pt.Z)
            else:
                # Collect numeric data
                if len(valid_items) != 1:
                    raise ValueError("Each branch should contain only one numeric item.")
                val = valid_items[0]
                data_known.append(val)
        else:
            # Branch is empty
            indices_empty.append(i)

    if len(indices_known) < 2:
        print("Not enough data points for interpolation/extrapolation. Filling empty branches with default values.")
        fill_empty_branches_with_defaults(output_data, data, is_point3d)
        return output_data

    # Perform interpolation/extrapolation
    if is_point3d:
        # Convert lists to numpy arrays
        indices_known = np.array(indices_known)
        x_known = np.array(x_known)
        y_known = np.array(y_known)
        z_known = np.array(z_known)
        indices_empty = np.array(indices_empty)

        if method == 'linear':
            kind = 'linear'
        elif method == 'cubic' or method == 'catmull-rom':
            kind = 'cubic'
        else:
            raise ValueError("Unsupported method.")

        # Create interpolation functions with extrapolation
        x_interp = interp1d(indices_known, x_known, kind=kind, fill_value="extrapolate")
        y_interp = interp1d(indices_known, y_known, kind=kind, fill_value="extrapolate")
        z_interp = interp1d(indices_known, z_known, kind=kind, fill_value="extrapolate")

        # Compute extrapolated values at empty indices
        x_extrapolated = x_interp(indices_empty)
        y_extrapolated = y_interp(indices_empty)
        z_extrapolated = z_interp(indices_empty)

        # Fill the output DataTree
        for i in range(data.BranchCount):
            branch_path = data.Paths[i]
            if i in indices_known:
                idx = indices_known.tolist().index(i)
                pt = rg.Point3d(x_known[idx], y_known[idx], z_known[idx])
                output_data.Add(pt, branch_path)
            else:
                idx = np.where(indices_empty == i)[0][0]
                pt = rg.Point3d(x_extrapolated[idx], y_extrapolated[idx], z_extrapolated[idx])
                output_data.Add(pt, branch_path)
    else:
        # Numeric data
        indices_known = np.array(indices_known)
        data_known = np.array(data_known)
        indices_empty = np.array(indices_empty)

        if method == 'linear':
            kind = 'linear'
        elif method == 'cubic' or method == 'catmull-rom':
            kind = 'cubic'
        else:
            raise ValueError("Unsupported method.")

        # Create interpolation function with extrapolation
        y_interp = interp1d(indices_known, data_known, kind=kind, fill_value="extrapolate")

        # Compute extrapolated values at empty indices
        y_extrapolated = y_interp(indices_empty)

        # Fill the output DataTree
        for i in range(data.BranchCount):
            branch_path = data.Paths[i]
            if i in indices_known:
                idx = indices_known.tolist().index(i)
                val = data_known[idx]
                output_data.Add(val, branch_path)
            else:
                idx = np.where(indices_empty == i)[0][0]
                val = y_extrapolated[idx]
                output_data.Add(val, branch_path)

    print("\nExtrapolation complete.")
    return output_data

def fill_empty_branches_with_defaults(output_data, data, is_point3d):
    """
    Fills empty branches with default values when not enough data is available for extrapolation.
    """
    for i in range(data.BranchCount):
        branch_path = data.Paths[i]
        branch_data = data.Branch(branch_path)

        # Parse items in the branch
        parsed_items = [parse_string_item(str(item)) for item in branch_data]
        valid_items = [item for item in parsed_items if item is not None]

        if len(valid_items) > 0:
            # Add the existing item to the output
            output_data.Add(valid_items[0], branch_path)
        else:
            # Fill with default value
            if is_point3d:
                default_value = rg.Point3d(0, 0, 0)
            else:
                default_value = 0.0
            output_data.Add(default_value, branch_path)

# Choose method (this should be defined based on your input; set to 'linear' by default for this example)
if method_input == 0:
    method = 'linear'
elif method_input == 1:
    method = 'cubic'
else:
    method = 'catmull-rom'

# Perform extrapolation
extended_data = extrapolate(data, method)

# Output the extended data to Grasshopper
a = extended_data  # Assuming 'a' is the output parameter in Grasshopper

# Additionally, print the extended data for debugging
print("\nExtended DataTree:")
for i in range(extended_data.BranchCount):
    branch_path = extended_data.Paths[i]
    branch = extended_data.Branch(branch_path)
    print(f"Branch {i} at path {branch_path}:")
    for item in branch:
        print(f"  {item}")
# ---------- end python_3_script ----------
panel = Panel(python_3_script.extended_data)
