# Grasshopper definition 241017_ShadowGapPanelEdgeTrimSIMPLE_rev0_ERSK.gh (Grasshopper 1.0.8)
# plug-ins: RhinoCodePluginGH, Human, eleFront

surface = Surface(<surface referenced from the Rhino model>)
python_3_script = Python3Script(surface=surface, distance="2.5")  # -> out, offsetBorder, originalBorder; inputs surface: list of Brep, distance: Double
# ---------- python_3_script: Python ----------
import Rhino

offsetBorder = []
originalBorder = []

both = Rhino.Geometry.CurveEnd.Both
continuity = Rhino.Geometry.Continuity.G1_continuous
rnd = 2 # Decimal places (precision)
tol = 1/10**rnd

def discontinuity(crv):
    # Get curve domain min/max
    tStart = crv.Domain.Min
    tMin = tStart
    tMax = crv.Domain.Max
    
    # Perform search
    dctParams = []
    getNext = True
    while getNext:
        getNext, t = crv.GetNextDiscontinuity(continuity, tMin, tMax)
        if not Rhino.RhinoMath.IsValidDouble(t):
            t = tStart
        dctParams.append(t)
        if getNext:
            tMin = t
    
    return dctParams

sCount = len(surface)
for s in range(sCount):
    srf = surface[s].Faces[0]
    border = Rhino.Geometry.Curve.JoinCurves(surface[s].DuplicateEdgeCurves(True), tol)[0]
    unSrf = srf.UnderlyingSurface() # Untrims input
    
    # Test curve orientation
    plane = Rhino.Geometry.Plane.WorldXY
    size = Rhino.Geometry.Interval(0, 1000)
    testCrv = border.Duplicate()
    testSrf = Rhino.Geometry.PlaneSurface(plane, size, size)
    morph = Rhino.Geometry.Morphs.SporphSpaceMorph(unSrf, testSrf)
    morph.Morph(testCrv)
    testResult = int(testCrv.ClosedCurveOrientation(plane))
    if testResult == 1:
        border.Reverse()
    
    if not round(distance, rnd) == 0:
        success = False
        attempt = 0
        while not success and attempt < 2:
            attempt += 1
            border.Reverse()
            pTrim = discontinuity(border)
            eCount = len(pTrim)
            
            offsetEdges = []
            for e in range(eCount):
                offsetResult = border.Trim(pTrim[e-1], pTrim[e]).OffsetOnSurface(unSrf, distance, tol)
                if offsetResult is not None:
                    offsetEdges.append(offsetResult[0].ExtendOnSurface(both, unSrf)) # Extend for trim intersections
            
            if len(offsetEdges) == eCount:
                
                intersectionsEnd = []
                intersectionsStart = []
                for e, edge in enumerate(offsetEdges):
                    prevEdge = offsetEdges[e-1]
                    intersection = Rhino.Geometry.Intersect.Intersection.CurveCurve(edge, prevEdge, tol, tol)
                    if len(intersection) > 0:
                        intersectionsStart.append(intersection[0].ParameterA)
                        intersectionsEnd.append(intersection[0].ParameterB)
                    else:
                        intersectionsStart.append(edge.Domain.Min)
                        intersectionsEnd.append(prevEdge.Domain.Max)
                
                trimmedEdges = []
                for e, edge in enumerate(offsetEdges):
                    if e < eCount-1:
                        trimmedEdges.append(edge.Trim(intersectionsStart[e], intersectionsEnd[e+1]))
                    else:
                        trimmedEdges.append(edge.Trim(intersectionsStart[e], intersectionsEnd[0]))
                joinedEdges = Rhino.Geometry.Curve.JoinCurves(trimmedEdges, tol)
                
                if len(joinedEdges) == 1 and joinedEdges[0].IsClosed and joinedEdges[0].GetLength() < border.GetLength():
                    success = True
                    pSeam = joinedEdges[0].ClosestPoint(trimmedEdges[0].PointAtStart)[1]
                    joinedEdges[0].ChangeClosedCurveSeam(pSeam)
                    offsetBorder.append(joinedEdges[0])
        
        if not success:
            result = "Border offset on surface failed."
        else:
            if attempt > 1:
                result = "Border offset on surface successful ("+str(attempt)+" attempts)."
            else:
                result = "Border offset on surface successful (1 attempt)."
        
    else:
        offsetBorder.append(border)
        result = "Border not offset (distance = 0)."
    
    originalBorder.append(border)
# ---------- end python_3_script ----------
discontinuity = Discontinuity(Curve=python_3_script.offsetBorder, Level=1)  # -> Points, Parameters
shatter = Shatter(Curve=python_3_script.offsetBorder, Parameters=discontinuity.Parameters)
list_item = ListItem(List=shatter, Index=Slider(0, range=0..3), Wrap=True)
multiplication = Multiplication(A="2.5", B=3)
extend_curve = ExtendCurve(Curve=list_item, Type=2, Start=multiplication, End=multiplication)
get_rhino_attributes = GetRhinoAttributes(Geometry=surface, fullpath=False)  # -> Name, Layer, Color, MaterialName, SourceFile
custom_preview_lineweights = CustomPreviewLineweights(Geometry=extend_curve, Shader=ColourSwatch(SwatchColor=RGB(0, 153, 255)), Thickness="5", Absolute=False)
surface_split = SurfaceSplit(Surface=surface, Curves=extend_curve)
elefront_attributes = EleFrontAttributes(Name=get_rhino_attributes.Name, Layer=get_rhino_attributes.Layer)  # -> Attributes, Keys, Values, Name, Layer, ColourSource, DisplayColour, MaterialSource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
length = Length(Curve=surface_split)
sort_list = SortList(Keys=length, ValuesA=surface_split)  # -> Keys, reverse(ValuesA)
list_item_2 = ListItem(List=sort_list.ValuesA, Index=0, Wrap=True)
bake_objects = BakeObjects(Geometry=list_item_2, Attributes=elefront_attributes.Attributes, Bake=Button(), createGroups=False)  # -> Message, Ghosts
