# Grasshopper definition 241021_ShadowGapPanelEdgeTrim_rev3_ERSK.gh (Grasshopper 1.0.8)
# plug-ins: RhinoCodePluginGH, treesloth01, Pufferfish, Human, eleFront

# ---- group: Input two adjecent surfaces (they need to be butt-joint)
surface = Surface(<surface referenced from the Rhino model>)

# ----
bake_boolean_pipe = Button()
desired_shadowgap = Panel("5")
precision_number_of_sample_pts_along_edg = Panel("1000")  # "Precision: number of sample pts along edge"

# ----
# Test shadowgap between panels
number_slider = Slider(0.275, range=0..1)
curve = Curve(<curve referenced from the Rhino model>)
evaluate_curve = EvaluateCurve(Curve=reparameterize(curve), Parameter=number_slider)  # -> Point, Tangent, Angle
surface_2 = Surface(<surface referenced from the Rhino model>)
surface_closest_point = SurfaceClosestPoint(Point=evaluate_curve.Point, Surface=surface_2)  # -> Point, UVPoint, Distance
point = Point([surface_closest_point.Point, evaluate_curve.Point])
panel = Panel(surface_closest_point.Distance)

list_length = ListLength(List=surface)
equality = Equality(FirstNumber=list_length, SecondNumber=2)  # -> Equality, Inequality
stream_gate = StreamGate(Stream=surface, Gate=equality.Equality)  # -> Target0, Target1
cluster = Cluster(srfs_for_closest_edge_extraction=stream_gate.Target1)  # -> panel_0_2, panel_1_2, panel_0_edge_2, panel1_edge_2
surface_3 = Surface(stream_gate.Target0)
curve_2 = Curve(flatten([cluster.panel_0_edge_2, cluster.panel1_edge_2]))
length = Length(Curve=curve_2)
custom_preview_lineweights = CustomPreviewLineweights(Shader=ColourSwatch(SwatchColor=RGB(0, 153, 255)), Thickness="5", Absolute=False)
sort_list = SortList(Keys=length, ValuesValuesA=curve_2)  # -> Keys, reverse(ValuesValuesA)
first_last = FirstLast(List=sort_list.ValuesValuesA)  # -> FirstValue, LastValue
number = Number(precision_number_of_sample_pts_along_edg)
curve_3 = Curve(first_last.FirstValue)
division = Division(A="1", B=number)
addition = Addition(A=number, B="1")
extend_curve = ExtendCurve(Curve=curve_3, Type=2, Start=10, End=10)  # -> reparameterize(Curve)
series = Series(Start=0, Step=division, Count=addition)
evaluate_curve_2 = EvaluateCurve(Curve=extend_curve, Parameter=series)  # -> Point, Tangent, Angle
curve_closest_point = CurveClosestPoint(Point=evaluate_curve_2.Point, Curve=extend_curve)  # -> Point, Parameter, Distance
division_2 = Division(A=desired_shadowgap, B=2)
perp_frame = PerpFrame(Curve=extend_curve, Parameter=curve_closest_point.Parameter)
circle = Circle(Plane=perp_frame, Radius=division_2)
vector_display_ex = VectorDisplayEx(Point=curve_closest_point.Point, Vector=evaluate_curve_2.Tangent, Colour=RGB(0, 0, 0), Width=2)
surface_curve = SurfaceCurve(Surface=cluster.panel_0_2, Curve=circle)  # -> Curves, simplify(Points), UVPoints, Normals, Parameters, Tangents
surface_curve_2 = SurfaceCurve(Surface=cluster.panel_1_2, Curve=circle)  # -> Curves, simplify(Points), UVPoints, Normals, Parameters, Tangents
area = Area(Geometry=circle)  # -> Area, simplify(graft(Centroid))
clean_tree = CleanTree(RemoveNulls=True, RemoveInvalid=True, RemoveEmpty=False, Tree=surface_curve.Points)
clean_tree_2 = CleanTree(RemoveNulls=True, RemoveInvalid=True, RemoveEmpty=False, Tree=surface_curve_2.Points)
line = Line(StartPoint=clean_tree_2, EndPoint=area.Centroid)
line_2 = Line(StartPoint=clean_tree, EndPoint=area.Centroid)
method_of_extrapolation = ValueList({"Linear": 0, "Cubic": 1, "Catmull-rom": 2}, selected="Linear")
angle = Angle(VectorA=line, VectorB=line_2)  # -> Angle, Reflex
text = Text(angle.Angle)
python_3_script = Python3Script(data=text, method_input=method_of_extrapolation)  # -> out, extended_data; inputs data: tree of String, method_input: Int32
# ---------- python_3_script: Python ----------
import re  # For regular expressions
import numpy as np
from scipy.interpolate import interp1d
import Rhino.Geometry as rg  # For Rhino Point3d
from Grasshopper import DataTree
from Grasshopper.Kernel.Data import GH_Path

def parse_string_item(item_str):
    """
    Parses a string and converts it into a Point3d or a float.
    """
    item_str = item_str.strip()
    
    # Check if it's a point in the format '{x, y, z}'
    point_match = re.match(r'^\{([\d\.\-eE]+),\s*([\d\.\-eE]+),\s*([\d\.\-eE]+)\}$', item_str)
    if point_match:
        x, y, z = map(float, point_match.groups())
        return rg.Point3d(x, y, z)
    
    # Check if it's a number
    try:
        return float(item_str)
    except ValueError:
        return None  # Invalid item

def extrapolate(data, method):
    """
    Extrapolates data for empty branches based on known data from other branches.
    """
    output_data = DataTree[object]()  # Initialize the output DataTree

    indices_known = []  # Branch indices with known data
    indices_empty = []  # Branch indices that are empty

    # Variables to hold known data
    x_known = []
    y_known = []
    z_known = []
    data_known = []

    is_point3d = None  # Will determine data type based on first valid item

    print("Starting extrapolation...")
    print(f"Input DataTree has {data.BranchCount} branches.")

    # First pass: Collect known data and indices
    for i in range(data.BranchCount):
        branch_path = data.Paths[i]
        branch_data = data.Branch(branch_path)

        # Parse items in the branch
        parsed_items = [parse_string_item(str(item)) for item in branch_data]
        valid_items = [item for item in parsed_items if item is not None]

        print(f"Branch {i} has {len(valid_items)} valid items.")

        if len(valid_items) > 0:
            # Determine data type
            if is_point3d is None:
                is_point3d = isinstance(valid_items[0], rg.Point3d)

            indices_known.append(i)

            if is_point3d:
                # Collect Point3d data
                if len(valid_items) != 1:
                    raise ValueError("Each branch should contain only one Point3d item.")
                pt = valid_items[0]
                x_known.append(pt.X)
                y_known.append(pt.Y)
                z_known.append(pt.Z)
            else:
                # Collect numeric data
                if len(valid_items) != 1:
                    raise ValueError("Each branch should contain only one numeric item.")
                val = valid_items[0]
                data_known.append(val)
        else:
            # Branch is empty
            indices_empty.append(i)

    if len(indices_known) < 2:
        print("Not enough data points for interpolation/extrapolation. Filling empty branches with default values.")
        fill_empty_branches_with_defaults(output_data, data, is_point3d)
        return output_data

    # Perform interpolation/extrapolation
    if is_point3d:
        # Convert lists to numpy arrays
        indices_known = np.array(indices_known)
        x_known = np.array(x_known)
        y_known = np.array(y_known)
        z_known = np.array(z_known)
        indices_empty = np.array(indices_empty)

        if method == 'linear':
            kind = 'linear'
        elif method == 'cubic' or method == 'catmull-rom':
            kind = 'cubic'
        else:
            raise ValueError("Unsupported method.")

        # Create interpolation functions with extrapolation
        x_interp = interp1d(indices_known, x_known, kind=kind, fill_value="extrapolate")
        y_interp = interp1d(indices_known, y_known, kind=kind, fill_value="extrapolate")
        z_interp = interp1d(indices_known, z_known, kind=kind, fill_value="extrapolate")

        # Compute extrapolated values at empty indices
        x_extrapolated = x_interp(indices_empty)
        y_extrapolated = y_interp(indices_empty)
        z_extrapolated = z_interp(indices_empty)

        # Fill the output DataTree
        for i in range(data.BranchCount):
            branch_path = data.Paths[i]
            if i in indices_known:
                idx = indices_known.tolist().index(i)
                pt = rg.Point3d(x_known[idx], y_known[idx], z_known[idx])
                output_data.Add(pt, branch_path)
            else:
                idx = np.where(indices_empty == i)[0][0]
                pt = rg.Point3d(x_extrapolated[idx], y_extrapolated[idx], z_extrapolated[idx])
                output_data.Add(pt, branch_path)
    else:
        # Numeric data
        indices_known = np.array(indices_known)
        data_known = np.array(data_known)
        indices_empty = np.array(indices_empty)

        if method == 'linear':
            kind = 'linear'
        elif method == 'cubic' or method == 'catmull-rom':
            kind = 'cubic'
        else:
            raise ValueError("Unsupported method.")

        # Create interpolation function with extrapolation
        y_interp = interp1d(indices_known, data_known, kind=kind, fill_value="extrapolate")

        # Compute extrapolated values at empty indices
        y_extrapolated = y_interp(indices_empty)

        # Fill the output DataTree
        for i in range(data.BranchCount):
            branch_path = data.Paths[i]
            if i in indices_known:
                idx = indices_known.tolist().index(i)
                val = data_known[idx]
                output_data.Add(val, branch_path)
            else:
                idx = np.where(indices_empty == i)[0][0]
                val = y_extrapolated[idx]
                output_data.Add(val, branch_path)

    print("\nExtrapolation complete.")
    return output_data

def fill_empty_branches_with_defaults(output_data, data, is_point3d):
    """
    Fills empty branches with default values when not enough data is available for extrapolation.
    """
    for i in range(data.BranchCount):
        branch_path = data.Paths[i]
        branch_data = data.Branch(branch_path)

        # Parse items in the branch
        parsed_items = [parse_string_item(str(item)) for item in branch_data]
        valid_items = [item for item in parsed_items if item is not None]

        if len(valid_items) > 0:
            # Add the existing item to the output
            output_data.Add(valid_items[0], branch_path)
        else:
            # Fill with default value
            if is_point3d:
                default_value = rg.Point3d(0, 0, 0)
            else:
                default_value = 0.0
            output_data.Add(default_value, branch_path)

# Choose method (this should be defined based on your input; set to 'linear' by default for this example)
if method_input == 0:
    method = 'linear'
elif method_input == 1:
    method = 'cubic'
else:
    method = 'catmull-rom'

# Perform extrapolation
extended_data = extrapolate(data, method)

# Output the extended data to Grasshopper
a = extended_data  # Assuming 'a' is the output parameter in Grasshopper

# Additionally, print the extended data for debugging
print("\nExtended DataTree:")
for i in range(extended_data.BranchCount):
    branch_path = extended_data.Paths[i]
    branch = extended_data.Branch(branch_path)
    print(f"Branch {i} at path {branch_path}:")
    for item in branch:
        print(f"  {item}")
# ---------- end python_3_script ----------
degrees = Degrees(Radians=python_3_script.extended_data)
angle_between_panels = Number(degrees)
plane = Plane(simplify(graft(perp_frame)))
python_3_script_2 = Python3Script(angle=angle_between_panels, shadow_gap=desired_shadowgap)  # -> out, offset_distance; inputs angle: Double, shadow_gap: Double
# ---------- python_3_script_2: Python ----------
import math

# Function to calculate offset distance
def calculate_offset_distance(theta_deg, g):
    """
    Calculate the offset distance for each panel based on the angle and desired shadow gap.

    Parameters:
    - theta_deg (float): Angle in degrees between the two panels.
    - g (float): Desired shadow gap.

    Returns:
    - x (float): Offset distance for each panel.
    """
    # Handle edge cases
    if theta_deg <= 0 or theta_deg >= 360:
        raise ValueError("Angle must be between 0 and 360 degrees (exclusive).")
    if g <= 0:
        raise ValueError("Shadow gap must be a positive value.")
    
    # Convert angle from degrees to radians
    theta_rad = math.radians(theta_deg)
    
    # Calculate sin(theta / 2)
    sin_theta_over_2 = math.sin(theta_rad / 2)
    
    # Prevent division by zero
    if sin_theta_over_2 == 0:
        raise ValueError("sin(theta/2) resulted in zero, cannot divide by zero.")
    
    # Calculate offset distance
    x = g / (2 * sin_theta_over_2)
    
    return x

# Main execution
try:
    # Ensure inputs are provided
    if angle is None or shadow_gap is None:
        raise ValueError("Both angle and shadow_gap inputs must be provided.")
    
    # Calculate offset distance
    offset_distance = calculate_offset_distance(angle, shadow_gap)
    
except Exception as e:
    # Handle exceptions and provide feedback in Grasshopper
    offset_distance = "Error: " + str(e)
# ---------- end python_3_script_2 ----------

# ---- group: Output evaluation
# if min domain != max domain, visually inspect the trimming pipe
round_to_decimal_place = RoundToDecimalPlace(NumberX=python_3_script_2.offset_distance, DecimalPlace=2, RoundType=0)  # -> flatten(Rounded), Difference
bounds = Bounds(Numbers=round_to_decimal_place.Rounded)
radius_of_intersection_pipe = Panel(bounds)

# ----
circle_2 = Circle(Plane=plane, Radius=python_3_script_2.offset_distance)  # -> flatten(Circle)
original_surface_0 = Surface(cluster.panel_0_2)
original_surface_1 = Surface(cluster.panel_1_2)
get_rhino_attributes = GetRhinoAttributes(Geometry=surface, fullpath=False)  # -> Name, Layer, Color, MaterialName, SourceFile
loft = Loft(Curves=circle_2, Options={Adjust=False, Closed=False, LoftEnds=0, LoftSimp=0, LoftType=0, Rebuild=10, Refit=0.01})
cap_holes = CapHoles(Brep=loft)
brep_brep = BrepBrep(BrepA=cap_holes, BrepB=original_surface_0)  # -> Curves, Points
brep_brep_2 = BrepBrep(BrepA=cap_holes, BrepB=original_surface_1)  # -> Curves, Points
value_list = ValueList({"Layer", "Material", "Object", "Parent"}, selected="Object")
surface_split = SurfaceSplit(Surface=original_surface_0, Curves=brep_brep.Curves)
surface_split_2 = SurfaceSplit(Surface=original_surface_1, Curves=brep_brep_2.Curves)
elefront_attributes = EleFrontAttributes(
    Name=get_rhino_attributes.Name,
    Layer=get_rhino_attributes.Layer,
    ColourSource=value_list,
    ObjectColour=get_rhino_attributes.Color)  # -> Attributes, Keys, Values, Name, Layer, ColourSource, DisplayColour, MaterialSource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
surface_4 = Surface(surface_split)
surface_5 = Surface(surface_split_2)
length_2 = Length(Curve=surface_4)
length_3 = Length(Curve=surface_5)
sort_list_2 = SortList(Keys=length_2, ValuesValuesA=surface_4)  # -> Keys, reverse(ValuesValuesA)
sort_list_3 = SortList(Keys=length_3, ValuesValuesA=surface_5)  # -> Keys, reverse(ValuesValuesA)
list_item = ListItem(List=sort_list_2.ValuesValuesA, Index=0, Wrap=True)
list_item_2 = ListItem(List=sort_list_3.ValuesValuesA, Index=0, Wrap=True)
merge = Merge(Data1=list_item, Data2=list_item_2)
bake_objects = BakeObjects(Geometry=merge, Attributes=elefront_attributes.Attributes, Bake=bake_boolean_pipe, createGroups=False)  # -> Message, Ghosts

# ==== cluster Cluster
srfs_for_closest_edge_extraction = ClusterInput()
srfs_for_closest_edge_extraction_2 = Surface(srfs_for_closest_edge_extraction)
brep_edges = BrepEdges(Brep=srfs_for_closest_edge_extraction_2)  # -> simplify(Naked), Interior, NonManifold
curve_middle = CurveMiddle(Curve=brep_edges.Naked)
tree_branch = TreeBranch(Tree=brep_edges.Naked, Path="0", MaintainPaths=True)
tree_branch_2 = TreeBranch(Tree=curve_middle, Path="0", MaintainPaths=True)
tree_branch_3 = TreeBranch(Tree=curve_middle, Path="1", MaintainPaths=True)
tree_branch_4 = TreeBranch(Tree=brep_edges.Naked, Path="1", MaintainPaths=True)
closest_point = ClosestPoint(Point=simplify(graft(tree_branch_2)), Cloud=tree_branch_3)  # -> ClosestPoint, CPIndex, Distance
sort_list = SortList(Keys=flatten(closest_point.Distance), ValuesValuesA=flatten(closest_point.CPIndex), ValuesA=tree_branch)  # -> Keys, ValuesValuesA, ValuesA
list_item = ListItem(List=sort_list.ValuesValuesA, Index=0, Wrap=True)
list_item_2 = ListItem(List=tree_branch_4, Index=list_item, Wrap=True)
list_item_3 = ListItem(List=srfs_for_closest_edge_extraction_2, Index=0, Wrap=True)  # -> Item, Item1
list_item_4 = ListItem(List=sort_list.ValuesA, Index=0, Wrap=True)
panel_0_edge = Curve(list_item_4)
panel_0 = Surface(list_item_3.Item)
panel1_edge = Curve(list_item_2)
panel_1 = Surface(list_item_3.Item1)
panel_1_2 = ClusterOutput(panel_1)
panel_0_2 = ClusterOutput(panel_0)
panel_0_edge_2 = ClusterOutput(panel_0_edge)
panel1_edge_2 = ClusterOutput(panel1_edge)
