# Grasshopper definition 241021_ShadowGapPanelEdgeTrim_rev4_ERSK.gh (Grasshopper 1.0.8)
# plug-ins: RhinoCodePluginGH, treesloth01, Pufferfish, Human, eleFront

# ---- group: Manual output evaluation
# Applies for two surfaces input ONLY
# Test shadowgap between panels
surface = Surface([<surface referenced from the Rhino model> x2])
cluster = Cluster(srfs_for_closest_edge_extraction=surface)  # -> panel_0_2, panel_1_2, panel1_edge_2, panel_0_edge_2
curve = Curve(cluster.panel_0_edge_2)
curve_2 = Curve(cluster.panel1_edge_2)
evaluate_curve = EvaluateCurve(Curve=reparameterize(curve), Parameter=Slider(0.413, range=0..1))  # -> Point, Tangent, Angle
point = Point(evaluate_curve.Point)
curve_closest_point = CurveClosestPoint(Point=point, Curve=curve_2)  # -> Point, Parameter, Distance
point_2 = Point([curve_closest_point.Point, point])
panel = Panel(curve_closest_point.Distance)

# ----
desired_shadowgap = Panel("5")
bake_panel_s = Button()
side_to_pick_single_surface_only = Slider(0, range=0..3)
complex_edge_single_surface_only = ValueList({"Yes": 1, "No": 0}, selected="No")
edge_type_to_modify_single_surface_only = ValueList({"Arc": 0, "Line": 1, "Curved": 1}, selected="Line")

# ---- group: Input two adjecent surfaces / single surface (pick side)
surface_2 = Surface([<surface referenced from the Rhino model> x2])

# ----
list_length = ListLength(List=surface_2)
equality = Equality(FirstNumber=list_length, SecondNumber=2)  # -> Equality, Inequality
stream_gate = StreamGate(Stream=surface_2, Gate=equality.Equality)  # -> Target0, Target1
stream_gate_2 = StreamGate(Stream=bake_panel_s, Gate=equality.Equality)  # -> Target0, Target1
cluster_2 = Cluster(srfs_for_closest_edge_extraction=stream_gate.Target1)  # -> panel_0_2, panel_1_2, panel1_edge_2, panel_0_edge_2
curve_3 = Curve(flatten([cluster_2.panel_0_edge_2, cluster_2.panel1_edge_2]))
length = Length(Curve=curve_3)
surface_3 = Surface(stream_gate.Target0)
curve_4 = Curve(surface_3)
sort_list = SortList(Keys=length, ValuesValuesA=curve_3)  # -> Keys, reverse(ValuesValuesA)
discontinuity = Discontinuity(Curve=curve_4, Level=1)  # -> Points, Parameters
first_last = FirstLast(List=sort_list.ValuesValuesA)  # -> FirstValue, LastValue
length_2 = Length(Curve=first_last.FirstValue)
length_3 = Length(Curve=first_last.LastValue)
sort_list_2 = SortList(Keys=[length_2, length_3], ValuesValuesA=[first_last.FirstValue, first_last.LastValue])  # -> reverse(Keys), reverse(ValuesValuesA)
list_item = ListItem(List=sort_list_2.ValuesValuesA, Index=0, Wrap=True)
shatter = Shatter(Curve=curve_4, Parameters=discontinuity.Parameters)
end_points = EndPoints(Curve=list_item)  # -> Start, End
precision_number_of_sample_pts_along_edg = Panel("1000")  # "Precision: number of sample pts along edge"
flip_curve = FlipCurve(Curve=first_last.LastValue, Guide=first_last.FirstValue)  # -> Curve, Flag
list_item_2 = ListItem(List=shatter, Index=side_to_pick_single_surface_only, Wrap=True)
number = Number(precision_number_of_sample_pts_along_edg)
division = Division(A=number, B=10)
tween_curve = TweenCurve(CurveA=first_last.FirstValue, CurveB=flip_curve.Curve, Factor=0.5, BlendType=0)
end_points_2 = EndPoints(Curve=tween_curve)  # -> Start, End
distance = Distance(PointA=end_points.Start, PointB=end_points_2.Start)
distance_2 = Distance(PointA=end_points.End, PointB=end_points_2.End)
number_2 = Number(precision_number_of_sample_pts_along_edg)
stream_filter = StreamFilter(Gate=complex_edge_single_surface_only, Stream0=division, Stream1=number)
multiplication = Multiplication(A=desired_shadowgap, B=2)
addition = Addition(A=distance_2, B=10)
addition_2 = Addition(A=distance, B=10)
division_2 = Division(A="1", B=number_2)
addition_3 = Addition(A=number_2, B="1")
division_3 = Division(A=1, B=stream_filter)
extend_curve = ExtendCurve(Curve=list_item_2, Type=2, Start=multiplication, End=multiplication)
series = Series(Start=0, Step=division_3, Count=expr("X+1", stream_filter))
curve_5 = Curve(tween_curve)
domain = Domain(extend_curve)
series_2 = Series(Start=0, Step=division_2, Count=addition_3)
remap_numbers = RemapNumbers(Value=series, Source=Domain(0, 1), Target=domain)  # -> Mapped, Clipped
extend_curve_2 = ExtendCurve(Curve=curve_5, Type=2, Start=addition_2, End=addition)  # -> reparameterize(Curve)
perp_frame = PerpFrame(Curve=extend_curve, Parameter=remap_numbers.Clipped)
custom_preview_lineweights = CustomPreviewLineweights(Geometry=extend_curve, Shader=ColourSwatch(SwatchColor=RGB(0, 153, 255)), Thickness="7.5", Absolute=False)
deconstruct_arc = DeconstructArc(Arc=extend_curve)  # -> BasePlane, Radius, Angle
division_4 = Division(A=desired_shadowgap, B=2)
evaluate_curve_2 = EvaluateCurve(Curve=extend_curve_2, Parameter=series_2)  # -> Point, Tangent, Angle
circle = Circle(Plane=perp_frame, Radius=division_4)
curve_closest_point_2 = CurveClosestPoint(Point=evaluate_curve_2.Point, Curve=extend_curve_2)  # -> Point, Parameter, Distance
# Single surface input
loft = Loft(Curves=circle, Options={Adjust=False, Closed=False, LoftEnds=0, LoftSimp=0, LoftType=0, Rebuild=10, Refit=0.01})
original_surface_0 = Surface(surface_3)
perp_frame_2 = PerpFrame(Curve=extend_curve_2, Parameter=curve_closest_point_2.Parameter)
vector_display_ex = VectorDisplayEx(Point=curve_closest_point_2.Point, Vector=evaluate_curve_2.Tangent, Colour=RGB(0, 0, 0), Width=2)
division_5 = Division(A=desired_shadowgap, B=2)
cap_holes = CapHoles(Brep=loft)
circle_2 = Circle(Plane=perp_frame_2, Radius=division_5)
brep_brep = BrepBrep(BrepA=cap_holes, BrepB=original_surface_0)  # -> Curves, Points
# Two surfaces input
surface_curve = SurfaceCurve(Surface=cluster_2.panel_0_2, Curve=circle_2)  # -> Curves, simplify(Points), UVPoints, Normals, Parameters, Tangents
surface_curve_2 = SurfaceCurve(Surface=cluster_2.panel_1_2, Curve=circle_2)  # -> Curves, simplify(Points), UVPoints, Normals, Parameters, Tangents
surface_split = SurfaceSplit(Surface=original_surface_0, Curves=brep_brep.Curves)
area = Area(Geometry=circle_2)  # -> Area, simplify(graft(Centroid))
surface_4 = Surface(surface_split)
clean_tree = CleanTree(RemoveNulls=True, RemoveInvalid=True, RemoveEmpty=False, Tree=surface_curve.Points)
clean_tree_2 = CleanTree(RemoveNulls=True, RemoveInvalid=True, RemoveEmpty=False, Tree=surface_curve_2.Points)
length_4 = Length(Curve=surface_4)
sort_list_3 = SortList(Keys=length_4, ValuesValuesA=surface_4)  # -> Keys, reverse(ValuesValuesA)
list_item_3 = ListItem(List=sort_list_3.ValuesValuesA, Index=0, Wrap=True)
line = Line(StartPoint=clean_tree_2, EndPoint=area.Centroid)
line_2 = Line(StartPoint=clean_tree, EndPoint=area.Centroid)
method_of_extrapolation = ValueList({"Linear": 0, "Cubic": 1, "Catmull-rom": 2}, selected="Linear")
brep_edges = BrepEdges(Brep=list_item_3)  # -> Naked, Interior, NonManifold
curve_middle = CurveMiddle(Curve=list_item_2)
angle = Angle(VectorA=line, VectorB=line_2)  # -> Angle, Reflex
text = Text(angle.Angle)
curve_closest_point_3 = CurveClosestPoint(Point=curve_middle, Curve=brep_edges.Naked)  # -> Point, Parameter, Distance
python_3_script = Python3Script(data=text, method_input=method_of_extrapolation)  # -> out, extended_data; inputs data: tree of String, method_input: Int32
# ---------- python_3_script: Python ----------
import re  # For regular expressions
import numpy as np
from scipy.interpolate import interp1d
import Rhino.Geometry as rg  # For Rhino Point3d
from Grasshopper import DataTree
from Grasshopper.Kernel.Data import GH_Path

def parse_string_item(item_str):
    """
    Parses a string and converts it into a Point3d or a float.
    """
    item_str = item_str.strip()
    
    # Check if it's a point in the format '{x, y, z}'
    point_match = re.match(r'^\{([\d\.\-eE]+),\s*([\d\.\-eE]+),\s*([\d\.\-eE]+)\}$', item_str)
    if point_match:
        x, y, z = map(float, point_match.groups())
        return rg.Point3d(x, y, z)
    
    # Check if it's a number
    try:
        return float(item_str)
    except ValueError:
        return None  # Invalid item

def extrapolate(data, method):
    """
    Extrapolates data for empty branches based on known data from other branches.
    """
    output_data = DataTree[object]()  # Initialize the output DataTree

    indices_known = []  # Branch indices with known data
    indices_empty = []  # Branch indices that are empty

    # Variables to hold known data
    x_known = []
    y_known = []
    z_known = []
    data_known = []

    is_point3d = None  # Will determine data type based on first valid item

    print("Starting extrapolation...")
    print(f"Input DataTree has {data.BranchCount} branches.")

    # First pass: Collect known data and indices
    for i in range(data.BranchCount):
        branch_path = data.Paths[i]
        branch_data = data.Branch(branch_path)

        # Parse items in the branch
        parsed_items = [parse_string_item(str(item)) for item in branch_data]
        valid_items = [item for item in parsed_items if item is not None]

        print(f"Branch {i} has {len(valid_items)} valid items.")

        if len(valid_items) > 0:
            # Determine data type
            if is_point3d is None:
                is_point3d = isinstance(valid_items[0], rg.Point3d)

            indices_known.append(i)

            if is_point3d:
                # Collect Point3d data
                if len(valid_items) != 1:
                    raise ValueError("Each branch should contain only one Point3d item.")
                pt = valid_items[0]
                x_known.append(pt.X)
                y_known.append(pt.Y)
                z_known.append(pt.Z)
            else:
                # Collect numeric data
                if len(valid_items) != 1:
                    raise ValueError("Each branch should contain only one numeric item.")
                val = valid_items[0]
                data_known.append(val)
        else:
            # Branch is empty
            indices_empty.append(i)

    if len(indices_known) < 2:
        print("Not enough data points for interpolation/extrapolation. Filling empty branches with default values.")
        fill_empty_branches_with_defaults(output_data, data, is_point3d)
        return output_data

    # Perform interpolation/extrapolation
    if is_point3d:
        # Convert lists to numpy arrays
        indices_known = np.array(indices_known)
        x_known = np.array(x_known)
        y_known = np.array(y_known)
        z_known = np.array(z_known)
        indices_empty = np.array(indices_empty)

        if method == 'linear':
            kind = 'linear'
        elif method == 'cubic' or method == 'catmull-rom':
            kind = 'cubic'
        else:
            raise ValueError("Unsupported method.")

        # Create interpolation functions with extrapolation
        x_interp = interp1d(indices_known, x_known, kind=kind, fill_value="extrapolate")
        y_interp = interp1d(indices_known, y_known, kind=kind, fill_value="extrapolate")
        z_interp = interp1d(indices_known, z_known, kind=kind, fill_value="extrapolate")

        # Compute extrapolated values at empty indices
        x_extrapolated = x_interp(indices_empty)
        y_extrapolated = y_interp(indices_empty)
        z_extrapolated = z_interp(indices_empty)

        # Fill the output DataTree
        for i in range(data.BranchCount):
            branch_path = data.Paths[i]
            if i in indices_known:
                idx = indices_known.tolist().index(i)
                pt = rg.Point3d(x_known[idx], y_known[idx], z_known[idx])
                output_data.Add(pt, branch_path)
            else:
                idx = np.where(indices_empty == i)[0][0]
                pt = rg.Point3d(x_extrapolated[idx], y_extrapolated[idx], z_extrapolated[idx])
                output_data.Add(pt, branch_path)
    else:
        # Numeric data
        indices_known = np.array(indices_known)
        data_known = np.array(data_known)
        indices_empty = np.array(indices_empty)

        if method == 'linear':
            kind = 'linear'
        elif method == 'cubic' or method == 'catmull-rom':
            kind = 'cubic'
        else:
            raise ValueError("Unsupported method.")

        # Create interpolation function with extrapolation
        y_interp = interp1d(indices_known, data_known, kind=kind, fill_value="extrapolate")

        # Compute extrapolated values at empty indices
        y_extrapolated = y_interp(indices_empty)

        # Fill the output DataTree
        for i in range(data.BranchCount):
            branch_path = data.Paths[i]
            if i in indices_known:
                idx = indices_known.tolist().index(i)
                val = data_known[idx]
                output_data.Add(val, branch_path)
            else:
                idx = np.where(indices_empty == i)[0][0]
                val = y_extrapolated[idx]
                output_data.Add(val, branch_path)

    print("\nExtrapolation complete.")
    return output_data

def fill_empty_branches_with_defaults(output_data, data, is_point3d):
    """
    Fills empty branches with default values when not enough data is available for extrapolation.
    """
    for i in range(data.BranchCount):
        branch_path = data.Paths[i]
        branch_data = data.Branch(branch_path)

        # Parse items in the branch
        parsed_items = [parse_string_item(str(item)) for item in branch_data]
        valid_items = [item for item in parsed_items if item is not None]

        if len(valid_items) > 0:
            # Add the existing item to the output
            output_data.Add(valid_items[0], branch_path)
        else:
            # Fill with default value
            if is_point3d:
                default_value = rg.Point3d(0, 0, 0)
            else:
                default_value = 0.0
            output_data.Add(default_value, branch_path)

# Choose method (this should be defined based on your input; set to 'linear' by default for this example)
if method_input == 0:
    method = 'linear'
elif method_input == 1:
    method = 'cubic'
else:
    method = 'catmull-rom'

# Perform extrapolation
extended_data = extrapolate(data, method)

# Output the extended data to Grasshopper
a = extended_data  # Assuming 'a' is the output parameter in Grasshopper

# Additionally, print the extended data for debugging
print("\nExtended DataTree:")
for i in range(extended_data.BranchCount):
    branch_path = extended_data.Paths[i]
    branch = extended_data.Branch(branch_path)
    print(f"Branch {i} at path {branch_path}:")
    for item in branch:
        print(f"  {item}")
# ---------- end python_3_script ----------
item_index = ItemIndex(List=brep_edges.Naked, Item=brep_edges.Naked)
sort_list_4 = SortList(Keys=curve_closest_point_3.Distance, ValuesValuesA=brep_edges.Naked, ValuesA=item_index)  # -> Keys, ValuesValuesA, ValuesA
degrees = Degrees(Radians=python_3_script.extended_data)
list_item_4 = ListItem(List=sort_list_4.ValuesValuesA, Index=0, Wrap=True)
curve_middle_2 = CurveMiddle(Curve=list_item_4)
end_points_3 = EndPoints(Curve=list_item_4)  # -> Start, End
arc_3pt = Arc3Pt(PointA=end_points_3.Start, PointB=curve_middle_2, PointC=end_points_3.End)  # -> Arc, Plane, Radius
list_item_5 = ListItem(List=sort_list_4.ValuesA, Index=0, Wrap=True)
angle_between_panels = Number(degrees)
cull_index = CullIndex(List=brep_edges.Naked, Indices=list_item_5, Wrap=True)
modified_arc = ModifiedArc(Arc=arc_3pt.Arc, Radius=deconstruct_arc.Radius)
curve_middle_3 = CurveMiddle(Curve=list_item_4)
plane = Plane(simplify(graft(perp_frame_2)))
python_3_script_2 = Python3Script(angle=angle_between_panels, shadow_gap=desired_shadowgap)  # -> out, offset_distance; inputs angle: Double, shadow_gap: Double
# ---------- python_3_script_2: Python ----------
import math

# Function to calculate offset distance
def calculate_offset_distance(theta_deg, g):
    """
    Calculate the offset distance for each panel based on the angle and desired shadow gap.

    Parameters:
    - theta_deg (float): Angle in degrees between the two panels.
    - g (float): Desired shadow gap.

    Returns:
    - x (float): Offset distance for each panel.
    """
    # Handle edge cases
    if theta_deg <= 0 or theta_deg >= 360:
        raise ValueError("Angle must be between 0 and 360 degrees (exclusive).")
    if g <= 0:
        raise ValueError("Shadow gap must be a positive value.")
    
    # Convert angle from degrees to radians
    theta_rad = math.radians(theta_deg)
    
    # Calculate sin(theta / 2)
    sin_theta_over_2 = math.sin(theta_rad / 2)
    
    # Prevent division by zero
    if sin_theta_over_2 == 0:
        raise ValueError("sin(theta/2) resulted in zero, cannot divide by zero.")
    
    # Calculate offset distance
    x = g / (2 * sin_theta_over_2)
    
    return x

# Main execution
try:
    # Ensure inputs are provided
    if angle is None or shadow_gap is None:
        raise ValueError("Both angle and shadow_gap inputs must be provided.")
    
    # Calculate offset distance
    offset_distance = calculate_offset_distance(angle, shadow_gap)
    
except Exception as e:
    # Handle exceptions and provide feedback in Grasshopper
    offset_distance = "Error: " + str(e)
# ---------- end python_3_script_2 ----------

# ---- group: Output evaluation
# Applies for two surfaces input ONLY
# if min domain != max domain, visually inspect the trimming pipe
round_to_decimal_place = RoundToDecimalPlace(NumberX=python_3_script_2.offset_distance, DecimalPlace=2, RoundType=0)  # -> flatten(Rounded), Difference
bounds = Bounds(Numbers=round_to_decimal_place.Rounded)
radius_of_intersection_pipe = Panel(bounds)

# ----
curve_closest_point_4 = CurveClosestPoint(Point=curve_middle_3, Curve=cull_index)  # -> Point, Parameter, Distance
flip_curve_2 = FlipCurve(Curve=modified_arc)  # -> Curve, Flag
sort_list_5 = SortList(Keys=curve_closest_point_4.Distance, ValuesValuesA=cull_index)  # -> Keys, reverse(ValuesValuesA)
circle_3 = Circle(Plane=plane, Radius=python_3_script_2.offset_distance)  # -> flatten(Circle)
original_surface_0_2 = Surface(cluster_2.panel_0_2)
original_surface_1 = Surface(cluster_2.panel_1_2)
list_item_6 = ListItem(List=sort_list_5.ValuesValuesA, Index=0, Wrap=True)  # -> Item, Item1, Item2
get_rhino_attributes = GetRhinoAttributes(Geometry=surface_2, fullpath=False)  # -> Name, Layer, Color, MaterialName, SourceFile
loft_2 = Loft(Curves=circle_3, Options={Adjust=False, Closed=False, LoftEnds=0, LoftSimp=0, LoftType=0, Rebuild=10, Refit=0.01})
cap_holes_2 = CapHoles(Brep=loft_2)
brep_brep_2 = BrepBrep(BrepA=cap_holes_2, BrepB=original_surface_0_2)  # -> Curves, Points
brep_brep_3 = BrepBrep(BrepA=cap_holes_2, BrepB=original_surface_1)  # -> Curves, Points
merge = Merge(Data1=flip_curve_2.Curve, Data2=list_item_6.Item)  # -> flatten(Result)
value_list = ValueList({"Layer", "Material", "Object", "Parent"}, selected="Object")
surface_split_2 = SurfaceSplit(Surface=original_surface_0_2, Curves=brep_brep_2.Curves)
surface_split_3 = SurfaceSplit(Surface=original_surface_1, Curves=brep_brep_3.Curves)
loft_3 = Loft(Curves=merge, Options={Adjust=False, Closed=False, LoftEnds=0, LoftSimp=0, LoftType=0, Rebuild=10, Refit=0.01})
get_rhino_attributes_2 = GetRhinoAttributes(Geometry=surface_3, fullpath=False)  # -> Name, Layer, Color, MaterialName, SourceFile
elefront_attributes = EleFrontAttributes(Name=get_rhino_attributes.Name)  # -> Attributes, Keys, Values, Name, Layer, ColourSource, DisplayColour, MaterialSource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
surface_5 = Surface(surface_split_2)
surface_6 = Surface(surface_split_3)
stream_filter_2 = StreamFilter(Gate=edge_type_to_modify_single_surface_only, Stream0=loft_3, Stream1=list_item_3)
length_5 = Length(Curve=surface_5)
length_6 = Length(Curve=surface_6)
value_list_2 = ValueList({"Layer", "Material", "Object", "Parent"}, selected="Object")
sort_list_6 = SortList(Keys=length_5, ValuesValuesA=surface_5)  # -> Keys, reverse(ValuesValuesA)
curve_6 = Curve(stream_filter_2)
sort_list_7 = SortList(Keys=length_6, ValuesValuesA=surface_6)  # -> Keys, reverse(ValuesValuesA)
elefront_attributes_2 = EleFrontAttributes(Name=get_rhino_attributes_2.Name)  # -> Attributes, Keys, Values, Name, Layer, ColourSource, DisplayColour, MaterialSource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
list_item_7 = ListItem(List=sort_list_6.ValuesValuesA, Index=0, Wrap=True)
list_item_8 = ListItem(List=sort_list_7.ValuesValuesA, Index=0, Wrap=True)
merge_2 = Merge(Data1=list_item_7, Data2=list_item_8)

# ---- group: Output evaluation
# Applies for two surfaces input ONLY
# Test shadowgap between panels
surface_7 = Surface(merge_2)
cluster_3 = Cluster(srfs_for_closest_edge_extraction=surface_7)  # -> panel_0_2, panel_1_2, panel1_edge_2, panel_0_edge_2
curve_7 = Curve(cluster_3.panel_0_edge_2)
curve_8 = Curve(cluster_3.panel1_edge_2)
evaluate_curve_3 = EvaluateCurve(Curve=reparameterize(curve_7), Parameter=Slider(0.848, range=0..1))  # -> Point, Tangent, Angle
point_3 = Point(evaluate_curve_3.Point)
curve_closest_point_5 = CurveClosestPoint(Point=point_3, Curve=curve_8)  # -> Point, Parameter, Distance
point_4 = Point([curve_closest_point_5.Point, point_3])
panel_2 = Panel(curve_closest_point_5.Distance)

# ----
bake_objects = BakeObjects(Geometry=merge_2, Attributes=elefront_attributes.Attributes, Bake=stream_gate_2.Target1, createGroups=False)  # -> Message, Ghosts
bake_objects_2 = BakeObjects(Geometry=stream_filter_2, Attributes=elefront_attributes_2.Attributes, Bake=stream_gate_2.Target0, createGroups=False)  # -> Message, Ghosts

# ==== cluster Cluster
srfs_for_closest_edge_extraction = ClusterInput()
srfs_for_closest_edge_extraction_2 = Surface(srfs_for_closest_edge_extraction)
brep_edges = BrepEdges(Brep=srfs_for_closest_edge_extraction_2)  # -> simplify(Naked), Interior, NonManifold
join_curves = JoinCurves(Curves=brep_edges.Naked, Preserve=False)
join_curves_2 = JoinCurves(Curves=brep_edges.Naked, Preserve=False)  # -> simplify(Curves)
divide_distance = DivideDistance(Curve=brep_edges.Naked, Distance="100")  # -> Points, Tangents, Parameters
end_points = EndPoints(Curve=brep_edges.Naked)  # -> Start, End
shift_paths = ShiftPaths(Data=divide_distance.Points, Offset=-1)
plane_fit = PlaneFit(Points=end_points.Start)  # -> Plane, Deviation
offset_curve = OffsetCurve(Curve=join_curves, Distance="-5", Plane=plane_fit.Plane, Corners=1)
surface_closest_point = SurfaceClosestPoint(Point=shift_paths, Surface=reparameterize(graft(srfs_for_closest_edge_extraction_2)))  # -> Point, UVPoint, Distance
tree_branch = TreeBranch(Tree=join_curves_2, Path="0", MaintainPaths=True)
tree_branch_2 = TreeBranch(Tree=join_curves_2, Path="1", MaintainPaths=True)
absolute = Absolute(Value="-5")
evaluate_surface = EvaluateSurface(Surface=reparameterize(graft(srfs_for_closest_edge_extraction_2)), Point=surface_closest_point.UVPoint)  # -> Point, Normal, UDirection, VDirection, Frame
curve_proximity = CurveProximity(CurveA=tree_branch, CurveB=tree_branch_2)  # -> PointA, PointB, Distance
amplitude = Amplitude(Vector=evaluate_surface.Normal, Amplitude=absolute)
curve_closest_point = CurveClosestPoint(Point=evaluate_surface.Point, Curve=offset_curve)  # -> Point, Parameter, Distance
move = Move(Geometry=evaluate_surface.Point, Motion=amplitude)  # -> Geometry, Transform
plane_3pt = Plane3Pt(PointA=evaluate_surface.Point, PointB=curve_closest_point.Point, PointC=move.Geometry)
multiplication = Multiplication(A=curve_proximity.Distance, B="1.1")
python_3_script = Python3Script(x=multiplication)  # -> out, a; inputs x: Double
# ---------- python_3_script: Python ----------
if x < 0.5:
    a = 0.5
else:
    a = x
# ---------- end python_3_script ----------
circle = Circle(Plane=plane_3pt, Radius=python_3_script.a)  # -> simplify(Circle)
boundary_surfaces = BoundarySurfaces(Edges=circle)
tree_branch_3 = TreeBranch(Tree=brep_edges.Naked, Path="0", MaintainPaths=True)
tree_branch_4 = TreeBranch(Tree=boundary_surfaces, Path="0", MaintainPaths=True)
tree_branch_5 = TreeBranch(Tree=brep_edges.Naked, Path="1", MaintainPaths=True)
tree_branch_6 = TreeBranch(Tree=boundary_surfaces, Path="1", MaintainPaths=True)
surface_curve = SurfaceCurve(Surface=tree_branch_4, Curve=graft(tree_branch_5))  # -> Curves, simplify(Points), UVPoints, Normals, Parameters, Tangents
surface_curve_2 = SurfaceCurve(Surface=tree_branch_6, Curve=graft(tree_branch_3))  # -> Curves, simplify(Points), UVPoints, Normals, Parameters, Tangents
clean_tree = CleanTree(RemoveNulls=True, RemoveInvalid=True, RemoveEmpty=True, Tree=surface_curve.Points)
clean_tree_2 = CleanTree(RemoveNulls=True, RemoveInvalid=True, RemoveEmpty=True, Tree=surface_curve_2.Points)
tree_statistics = TreeStatistics(Tree=clean_tree)  # -> Paths, Length, Count
tree_statistics_2 = TreeStatistics(Tree=clean_tree_2)  # -> Paths, Length, Count
python_3_script_2 = Python3Script(x=tree_statistics.Paths)  # -> out, a; inputs x: String
# ---------- python_3_script_2: Python ----------
a = x[1]
# ---------- end python_3_script_2 ----------
python_3_script_3 = Python3Script(x=tree_statistics_2.Paths)  # -> out, a; inputs x: String; same code as python_3_script_2
python_3_script_4 = Python3Script(x=python_3_script_2.a)  # -> out, index; inputs x: list of Int32
# ---------- python_3_script_4: Python ----------
def most_frequent_integer(x):
    if not x:
        return None
    
    # Count occurrences of each integer
    count_dict = {}
    for num in x:
        count_dict[num] = count_dict.get(num, 0) + 1
    
    # Find the integer with the highest count
    max_count = 0
    most_frequent = None
    for num, count in count_dict.items():
        if count > max_count:
            max_count = count
            most_frequent = num
    
    return most_frequent

index = most_frequent_integer(x)
# ---------- end python_3_script_4 ----------
python_3_script_5 = Python3Script(x=python_3_script_3.a)  # -> out, index; inputs x: list of Int32; same code as python_3_script_4
list_item = ListItem(List=tree_branch_3, Index=python_3_script_5.index, Wrap=True)
list_item_2 = ListItem(List=srfs_for_closest_edge_extraction_2, Index=0, Wrap=True)  # -> Item, Item1
list_item_3 = ListItem(List=tree_branch_5, Index=python_3_script_4.index, Wrap=True)
panel_0_edge = Curve(list_item)
panel1_edge = Curve(list_item_3)
panel_1 = Surface(list_item_2.Item1)
panel_0 = Surface(list_item_2.Item)
panel_0_edge_2 = ClusterOutput(panel_0_edge)
panel1_edge_2 = ClusterOutput(panel1_edge)
panel_0_2 = ClusterOutput(panel_0)
panel_1_2 = ClusterOutput(panel_1)
