# Grasshopper definition 241021_UndoShadowGap_v1_ERSK.gh (Grasshopper 1.0.8)
# plug-ins: RhinoCodePluginGH, eleFront

shadowgap_to_remove = Panel("2.5")

# ---- group: DESIGN INTENT
bottom_edge = Curve(<curve referenced from the Rhino model>)

# ---- group: TARGET
top_edge = Curve(<curve referenced from the Rhino model>)

# ---- group: Concave
# Only works on VTM wall panels for now
surface = Surface(<surface referenced from the Rhino model>)

# ---- group: walls
# Only works on VTM wall panels for now
surface_2 = Surface(<surface referenced from the Rhino model>)

# ----
number = Number(shadowgap_to_remove)
get_rhino_attributes = GetRhinoAttributes(Geometry=surface, fullpath=False)  # -> Name, Layer, Color, MaterialName, SourceFile
python_3_script = Python3Script(srf=surface, topGuideCrv=top_edge, bottomGuideCrv=bottom_edge, extensionLength=number)  # -> out, extendedSrf, arcRight, arcLeft; inputs srf: Brep, topGuideCrv: Curve, bottomGuideCrv: Curve, extensionLength: Double
# ---------- python_3_script: Python ----------
import Rhino
import Rhino.Geometry as rg
import scriptcontext as sc

def extend_surface(srf, extensionLength):

    
    # Extract the edges of the Brep
    edges = srf.Edges

    # Collect edge data: curve, midpoint, Z-coordinate, start point, end point
    edge_data = []
    for edge in edges:
        edge_curve = edge.EdgeCurve
        midpoint = edge_curve.PointAtNormalizedLength(0.5)
        startPt = edge_curve.PointAtStart
        endPt = edge_curve.PointAtEnd
        z_midPt = midpoint.Z
        edge_data.append({
            'curve': edge_curve,
            'midpoint': midpoint,
            'startPt': startPt,
            'endPt': endPt,
            'z-midPt': z_midPt
        })
    
    # Sort the edges based on the Z-coordinate of their midpoints
    edge_data.sort(key=lambda x: x['z-midPt'])

    # Identify bottom and top edges
    topEdge = edge_data[-1]    # Edge with highest Z-coordinate
    bottomEdge = edge_data[0]  # Edge with lowest Z-coordinate

    firstSideEdge = edge_data[1]
    lastSideEdge = edge_data[-2]

    # topGuideCrv, botGuideCrv are defined outside this script
    topEdgeCrv = topEdge['curve']
    topTweenCrv = rg.Curve.CreateTweenCurves(topEdgeCrv, topGuideCrv, 1, 0.01)[0]

    # extend topTweenCrv by extensionLength
    extendedTopTweenCrv = topTweenCrv.Extend(rg.CurveEnd.Both, extensionLength, rg.CurveExtensionStyle.Line) 

   # vector between firstSideEdge['midpoint'] and lastSideEdge['midpoint']
    vec1 = topEdge['startPt'] - topEdge['endPt']
    vec2 = bottomEdge['startPt'] - bottomEdge['endPt']
    vec = vec1 + vec2
    vec.Unitize() 
    vec *= extensionLength

    # create arcs 
    arcRightStartPt = bottomGuideCrv.PointAtEnd
    arcRightEndPt = extendedTopTweenCrv.PointAtEnd
    arcRightMidPt = firstSideEdge['midpoint'] - vec
    arcRight = rg.Arc(arcRightStartPt, arcRightMidPt, arcRightEndPt)

    arcLeftStartPt = bottomGuideCrv.PointAtStart
    arcLeftEndPt = extendedTopTweenCrv.PointAtStart
    arcLeftMidPt = lastSideEdge['midpoint'] + vec
    arcLeft = rg.Arc(arcLeftStartPt, arcLeftMidPt, arcLeftEndPt)
    
    # Define original arcs from the first and last side edges
    originalRight = firstSideEdge['curve']
    originalLeft = lastSideEdge['curve']
    
    # Add print statements to compare the radii of the original arcs and the new arcs
    originalRightArc = rg.Arc(firstSideEdge['startPt'], firstSideEdge['midpoint'], firstSideEdge['endPt'])
    originalRightRadius = originalRightArc.Radius
    originalLeftArc = rg.Arc(lastSideEdge['startPt'], lastSideEdge['midpoint'], lastSideEdge['endPt'])
    originalLeftRadius = originalLeftArc.Radius
    newArcRightRadius = arcRight.Radius
    newArcLeftRadius = arcLeft.Radius
    print(f"Right Arc Radius Difference After Rebuild: {originalRightRadius-newArcRightRadius}")
    print(f"Left Arc Radius Difference After Rebuild: {originalLeftRadius-newArcLeftRadius}")

    curves = [arcRight.ToNurbsCurve(), arcLeft.ToNurbsCurve()]
    extendedSrf = rg.Brep.CreateFromLoft(curves, rg.Point3d.Unset, rg.Point3d.Unset, rg.LoftType.Normal, False)[0]
    return extendedSrf, arcRight, arcLeft


extendedSrf, arcRight, arcLeft = extend_surface(srf, extensionLength)
# ---------- end python_3_script ----------
python_3_script_2 = Python3Script(srf=surface_2, extensionLength=shadowgap_to_remove)  # -> out, extendedSrf; inputs srf: Brep, extensionLength: Double
# ---------- python_3_script_2: Python ----------
import Rhino
import Rhino.Geometry as rg
import scriptcontext as sc

def extend_surface(srf, extensionLength):
    
    # Extract the edges of the Brep
    edges = srf.Edges

    # Collect edge data: curve, midpoint, Z-coordinate, start point, end point
    edge_data = []
    for edge in edges:
        edge_curve = edge.EdgeCurve
        midpoint = edge_curve.PointAtNormalizedLength(0.5)
        z_startPt = edge_curve.PointAtStart.Z
        z_endPt = edge_curve.PointAtEnd.Z
        z_midPt = midpoint.Z
        edge_data.append({
            'curve': edge_curve,
            'midpoint': midpoint,
            'z-startPt': z_startPt,
            'z-endPt': z_endPt,
            'z-midPt': z_midPt
        })
    
    # Sort the edges based on the Z-coordinate of their midpoints
    edge_data.sort(key=lambda x: x['z-midPt'])

    # Identify bottom and top edges
    bottomEdge = edge_data[0]  # Edge with lowest Z-coordinate
    topEdge = edge_data[-1]    # Edge with highest Z-coordinate
    

    # Move and extend bottomEdge curve by extensionLength as an arc in both directions
    bottomCrv = bottomEdge['curve']
    move_vector = rg.Vector3d(0, 0, -extensionLength)
    translation = rg.Transform.Translation(move_vector)
    movedBottom = bottomCrv.DuplicateCurve()
    movedBottom.Transform(translation)

    extendedBottom = movedBottom.Extend(rg.CurveEnd.Both, extensionLength, rg.CurveExtensionStyle.Arc)

    # For extendedBottom, get start and end points
    extendedBottom_start = extendedBottom.PointAtStart
    extendedBottom_end = extendedBottom.PointAtEnd
    
    # Calculate new Z-value for extendedTop (highest Z + extensionLength)
    start_z = topEdge['z-endPt']
    new_start_z = start_z + extensionLength

    end_z = topEdge['z-startPt']
    new_end_z = end_z + extensionLength

    # Create extendedTop curve by replacing Z values            
    extendedTopStartPt = rg.Point3d(extendedBottom_start.X, extendedBottom_start.Y, new_start_z)
    extendedTopEndPt = rg.Point3d(extendedBottom_end.X, extendedBottom_end.Y, new_end_z)
    extendedTop = rg.LineCurve(extendedTopStartPt, extendedTopEndPt)    

    # Create lofted surface
    curves = [extendedBottom, extendedTop]
    extendedSrf = rg.Brep.CreateFromLoft(curves, rg.Point3d.Unset, rg.Point3d.Unset, rg.LoftType.Normal, False)[0]

    return extendedSrf, extendedTopStartPt, extendedTopEndPt

# Inputs:
#   srf: The input surface to extend (Surface)
#   extensionLength: The extension length (float)
# Output:
#   extendedSrf: The extended surface (Brep)

extendedSrf, extendedTopStartPt, extendedTopEndPt  = extend_surface(srf, extensionLength)
# ---------- end python_3_script_2 ----------
get_rhino_attributes_2 = GetRhinoAttributes(Geometry=surface_2, fullpath=False)  # -> Name, Layer, Color, MaterialName, SourceFile
panel = Panel(python_3_script.out)
curve = Curve(python_3_script.arcRight)
curve_2 = Curve(python_3_script.arcLeft)
surface_3 = Surface(python_3_script.extendedSrf)
value_list = ValueList({"Layer", "Material", "Object", "Parent"}, selected="Object")
value_list_2 = ValueList({"Layer", "Material", "Object", "Parent"}, selected="Object")
surface_4 = Surface(python_3_script_2.extendedSrf)
elefront_attributes = EleFrontAttributes(
    Name=get_rhino_attributes.Name,
    Layer=get_rhino_attributes.Layer,
    ColourSource=value_list,
    ObjectColour=get_rhino_attributes.Color)  # -> Attributes, Keys, Values, Name, Layer, ColourSource, DisplayColour, MaterialSource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
elefront_attributes_2 = EleFrontAttributes(
    Name=get_rhino_attributes_2.Name,
    Layer=get_rhino_attributes_2.Layer,
    ColourSource=value_list_2,
    ObjectColour=get_rhino_attributes_2.Color)  # -> Attributes, Keys, Values, Name, Layer, ColourSource, DisplayColour, MaterialSource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
bake_objects = BakeObjects(Geometry=python_3_script.extendedSrf, Attributes=elefront_attributes.Attributes, Bake=False, createGroups=False)  # -> Message, Ghosts
bake_objects_2 = BakeObjects(Geometry=python_3_script_2.extendedSrf, Attributes=elefront_attributes_2.Attributes, Bake=False, createGroups=False)  # -> Message, Ghosts
