# Grasshopper definition 241025_OffsetBorderOnSurface_R8_ERSK.gh (Grasshopper 1.0.8)
# plug-ins: RhinoCodePluginGH

surface = Surface()
shadowgap_2 = Panel("2.5")
python_3_script = Python3Script(surface=surface, distance=shadowgap_2)  # -> out, offsetBorder, originalBorder; inputs surface: list of Brep, distance: Double
# ---------- python_3_script: Python ----------
import Rhino

offsetBorder = []
originalBorder = []

both = Rhino.Geometry.CurveEnd.Both
continuity = Rhino.Geometry.Continuity.G1_continuous
rnd = 2 # Decimal places (precision)
tol = 1/10**rnd

def discontinuity(crv):
    # Get curve domain min/max
    tStart = crv.Domain.Min
    tMin = tStart
    tMax = crv.Domain.Max
    
    # Perform search
    dctParams = []
    getNext = True
    while getNext:
        getNext, t = crv.GetNextDiscontinuity(continuity, tMin, tMax)
        if not Rhino.RhinoMath.IsValidDouble(t):
            t = tStart
        dctParams.append(t)
        if getNext:
            tMin = t
    
    return dctParams

sCount = len(surface)
for s in range(sCount):
    srf = surface[s].Faces[0]
    border = Rhino.Geometry.Curve.JoinCurves(surface[s].DuplicateEdgeCurves(True), tol)[0]
    unSrf = srf.UnderlyingSurface() # Untrims input
    
    # Test curve orientation
    plane = Rhino.Geometry.Plane.WorldXY
    size = Rhino.Geometry.Interval(0, 1000)
    testCrv = border.Duplicate()
    testSrf = Rhino.Geometry.PlaneSurface(plane, size, size)
    morph = Rhino.Geometry.Morphs.SporphSpaceMorph(unSrf, testSrf)
    morph.Morph(testCrv)
    testResult = int(testCrv.ClosedCurveOrientation(plane))
    if testResult == 1:
        border.Reverse()
    
    if not round(distance, rnd) == 0:
        success = False
        attempt = 0
        while not success and attempt < 2:
            attempt += 1
            border.Reverse()
            pTrim = discontinuity(border)
            eCount = len(pTrim)
            
            offsetEdges = []
            for e in range(eCount):
                offsetResult = border.Trim(pTrim[e-1], pTrim[e]).OffsetOnSurface(unSrf, distance, tol)
                if offsetResult is not None:
                    offsetEdges.append(offsetResult[0].ExtendOnSurface(both, unSrf)) # Extend for trim intersections
            
            if len(offsetEdges) == eCount:
                
                intersectionsEnd = []
                intersectionsStart = []
                for e, edge in enumerate(offsetEdges):
                    prevEdge = offsetEdges[e-1]
                    intersection = Rhino.Geometry.Intersect.Intersection.CurveCurve(edge, prevEdge, tol, tol)
                    if len(intersection) > 0:
                        intersectionsStart.append(intersection[0].ParameterA)
                        intersectionsEnd.append(intersection[0].ParameterB)
                    else:
                        intersectionsStart.append(edge.Domain.Min)
                        intersectionsEnd.append(prevEdge.Domain.Max)
                
                trimmedEdges = []
                for e, edge in enumerate(offsetEdges):
                    if e < eCount-1:
                        trimmedEdges.append(edge.Trim(intersectionsStart[e], intersectionsEnd[e+1]))
                    else:
                        trimmedEdges.append(edge.Trim(intersectionsStart[e], intersectionsEnd[0]))
                joinedEdges = Rhino.Geometry.Curve.JoinCurves(trimmedEdges, tol)
                
                if len(joinedEdges) == 1 and joinedEdges[0].IsClosed and joinedEdges[0].GetLength() < border.GetLength():
                    success = True
                    pSeam = joinedEdges[0].ClosestPoint(trimmedEdges[0].PointAtStart)[1]
                    joinedEdges[0].ChangeClosedCurveSeam(pSeam)
                    offsetBorder.append(joinedEdges[0])
        
        if not success:
            result = "Border offset on surface failed."
        else:
            if attempt > 1:
                result = "Border offset on surface successful ("+str(attempt)+" attempts)."
            else:
                result = "Border offset on surface successful (1 attempt)."
        
    else:
        offsetBorder.append(border)
        result = "Border not offset (distance = 0)."
    
    originalBorder.append(border)
    
    print (result)
# ---------- end python_3_script ----------
curve = Curve(python_3_script.offsetBorder)
surface_split = SurfaceSplit(Surface=surface, Curves=curve)
list_item = ListItem(List=surface_split, Index=0, Wrap=True)  # -> Item, flatten(Item1)
