# Grasshopper definition 241029_PointCluster_v1_ERSK.gh (Grasshopper 1.0.8)
# plug-ins: RhinoCodePluginGH

# Clusters points based on proximity
point = Point([Point(-8757.499355, 120266.7538, 21748.999), Point(-10381.16654, 119263.3558, 21748.999), Point(-11965.60018, 118189.6042, 21748.999), Point(-13367.06942, 117155.2371, 21748.999), Point(-15031.89421, 115813.0661, 21748.999), Point(-16499.98144, 114516.1107, 21748.999)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])
python_3_script = Python3Script(points=point, threshold="10")  # -> out, clusters, indices; inputs points: list of Point3d, threshold: Double
# ---------- python_3_script: Python ----------
import Rhino.Geometry as rg
from Grasshopper import DataTree
from Grasshopper.Kernel.Data import GH_Path

def cluster_points(points, threshold):
    clusters = DataTree[rg.Point3d]()
    indices = DataTree[int]()
    
    for i, point in enumerate(points):
        added_to_cluster = False
        
        # Check if the point can be added to an existing cluster
        for cluster_idx in range(clusters.BranchCount):
            cluster_path = GH_Path(cluster_idx)
            cluster = clusters.Branch(cluster_path)
            for cluster_point in cluster:
                if point.DistanceTo(cluster_point) <= threshold:
                    clusters.Add(point, cluster_path)
                    indices.Add(i, cluster_path)
                    added_to_cluster = True
                    break
            if added_to_cluster:
                break
        
        # If not added, create a new cluster
        if not added_to_cluster:
            new_path = GH_Path(clusters.BranchCount)
            clusters.Add(point, new_path)
            indices.Add(i, new_path)
    
    return clusters, indices

# Call the function and get clusters and indices
clusters, indices = cluster_points(points, threshold)

# Output clusters and indices
for idx in range(clusters.BranchCount):
    cluster = clusters.Branch(GH_Path(idx))
    cluster_indices = indices.Branch(GH_Path(idx))
    print(f"Cluster {idx + 1}: {[str(pt) for pt in cluster]}")
    print(f"Indices: {cluster_indices}")
# ---------- end python_3_script ----------
point_2 = Point(python_3_script.clusters)
number = Number(python_3_script.indices)
list_length = ListLength(List=point_2)
indices = Panel(number)
tree_statistics = TreeStatistics(Tree=point_2)  # -> Paths, Length, Count
equality = Equality(FirstNumber=list_length, SecondNumber=2)  # -> flatten(Equality), Inequality
cull_pattern = CullPattern(List=tree_statistics.Paths, CullPattern=equality.Equality)
tree_branch = TreeBranch(Tree=point_2, Path=cull_pattern, MaintainPaths=True)
