# Grasshopper definition 250211_FitCircleWithMaxTilt_v1.gh (Grasshopper 1.0.8)
# plug-ins: RhinoCodePluginGH, treesloth01

point = Point(Tree({0}: [Point(2960.992851, 110982.5742, 28444.77959), Point(4258.924006, 111469.6072, 28429.38474), Point(5607.63942, 111915.0638, 28413.43688), Point(6968.898259, 112304.4425, 28397.18029), Point(8336.631257, 112636.8138, 28380.63368), Point(9820.504177, 112932.6503, 28362.3872)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], {1}: [Point(3493.935024, 109843.9132, 28041.96895), Point(4750.030993, 110296.7894, 28021.33753), Point(6065.02292, 110715.9067, 28000.6656), Point(7390.241501, 111083.3838, 27980.61597), Point(8720.290629, 111398.5096, 27961.21027), Point(10161.33327, 111680.8694, 27940.92397)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], {2}: [Point(3899.748946, 108976.8689, 27735.24437), Point(5113.82964, 109427.998, 27719.07224), Point(6395.401908, 109849.727, 27702.53044), Point(7687.993094, 110220.4955, 27686.27604), Point(8986.420593, 110539.5448, 27670.32216), Point(10393.91064, 110826.6704, 27653.39051)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], {3}: [Point(2238.736095, 112525.7165, 28990.6788), Point(3609.973884, 113019.372, 28968.57943), Point(5017.243967, 113462.9485, 28946.24641), Point(6436.280031, 113847.9776, 28923.75749), Point(7860.499196, 114173.5842, 28901.14993), Point(9404.731379, 114459.6808, 28876.5245)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], {4}: [Point(4565.884785, 107553.6321, 27231.75968), Point(5710.395105, 108003.3336, 27223.42874), Point(6935.749033, 108433.0578, 27214.98652), Point(8173.057004, 108814.7735, 27206.88351), Point(9417.666121, 109147.6509, 27199.11392), Point(10768.02837, 109452.6286, 27191.0722)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], {5}: [Point(5158.148661, 106288.2269, 26784.10955), Point(6250.609807, 106713.2411, 26774.60305), Point(7434.403293, 107125.698, 26765.0612), Point(8629.111451, 107493.1213, 26756.16126), Point(9830.615854, 107814.8086, 26747.89691), Point(11133.31826, 108111.0093, 26739.66295)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]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))
value_list = ValueList({"inner": 0, "outer": 1}, selected="outer")
point_2 = Point(Tree({0}: [Point(-2455.530442, 122555.2816, 22768.15185), Point(-666.0883574, 123231.0819, 22770.18037), Point(1072.169018, 123806.0514, 22771.3906), Point(2826.81334, 124308.2626, 22772.52893), Point(4587.965397, 124736.0591, 22776.22733), Point(6502.983778, 125117.0809, 22774.66387)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], {1}: [Point(-1650.786297, 120835.9004, 23967.25703), Point(66.17448754, 121482.3572, 23964.84669), Point(1746.87277, 122037.1287, 23961.5319), Point(3443.220846, 122521.9041, 23957.96986), Point(5145.935484, 122935.1472, 23954.59102), Point(6996.791731, 123303.4458, 23949.83996)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], {2}: [Point(-1310.982511, 120109.8904, 24473.57583), Point(376.0959324, 120742.2304, 24470.47757), Point(2033.226287, 121286.3739, 24466.64886), Point(3705.685263, 121761.2786, 24462.72792), Point(5384.401155, 122165.4722, 24458.74042), Point(7208.795, 122524.8104, 24454.35403)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], {3}: [Point(-1204.824864, 119883.0786, 24631.75319), Point(472.8262466, 120511.2277, 24628.29187), Point(2122.524927, 121052.253, 24624.16944), Point(3787.469496, 121524.2668, 24620.01137), Point(5458.653243, 121925.8151, 24615.84488), Point(7274.759853, 122282.5379, 24611.32989)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], {4}: [Point(-561.3761533, 118508.3142, 25590.50668), Point(1059.636477, 119109.86, 25585.66544), Point(2664.231449, 119632.0203, 25579.7263), Point(4283.139131, 120087.81, 25573.25905), Point(5907.875393, 120475.8995, 25566.32058), Point(7672.697513, 120821.012, 25558.29789)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], {5}: [Point(-241.7608458, 117825.4381, 26066.71196), Point(1348.788923, 118419.3319, 26057.42366), Point(2929.426066, 118936.7396, 26047.51907), Point(4524.541287, 119388.2235, 26037.49779), Point(6125.818149, 119772.4645, 26027.42479), Point(7865.247826, 120113.8227, 26016.47312)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], {6}: [Point(528.1148101, 116180.5553, 27213.72862), Point(2049.369342, 116746.2683, 27200.45019), Point(3575.028028, 117244.1164, 27186.32917), Point(5114.452879, 117678.6522, 27171.93093), Point(6659.894467, 118048.6725, 27157.33947), Point(8338.004432, 118377.5055, 27141.35002)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], {7}: [Point(826.5467102, 115542.9387, 27658.34825), Point(2321.480277, 116096.4373, 27644.41441), Point(3826.373508, 116585.1448, 27629.67752), Point(5344.735069, 117011.2911, 27614.74691), Point(6869.010332, 117373.7272, 27599.70983), Point(8523.783815, 117695.1838, 27583.33928)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], {8}: [Point(1566.350425, 113962.3064, 28760.53889), Point(2997.171596, 114482.8117, 28746.8477), Point(4451.105854, 114947.2359, 28731.62568), Point(5917.231929, 115352.1864, 28715.57644), Point(7388.604675, 115696.6774, 28698.81591), Point(8984.739318, 116002.2077, 28679.92831)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]))
stream_filter = StreamFilter(Gate=value_list, Stream0=point, Stream1=point_2)
degrees = Slider(5, range=0..100)

point_3 = Point(Tree({0}: [Point(2960.992851, 110982.5742, 28444.77959), Point(4258.924006, 111469.6072, 28429.38474), Point(5607.63942, 111915.0638, 28413.43688), Point(6968.898259, 112304.4425, 28397.18029), Point(8336.631257, 112636.8138, 28380.63368), Point(9820.504177, 112932.6503, 28362.3872)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], {1}: [Point(3493.935024, 109843.9132, 28041.96895), Point(4750.030993, 110296.7894, 28021.33753), Point(6065.02292, 110715.9067, 28000.6656), Point(7390.241501, 111083.3838, 27980.61597), Point(8720.290629, 111398.5096, 27961.21027), Point(10161.33327, 111680.8694, 27940.92397)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], {2}: [Point(3899.748946, 108976.8689, 27735.24437), Point(5113.82964, 109427.998, 27719.07224), Point(6395.401908, 109849.727, 27702.53044), Point(7687.993094, 110220.4955, 27686.27604), Point(8986.420593, 110539.5448, 27670.32216), Point(10393.91064, 110826.6704, 27653.39051)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], {3}: [Point(2238.736095, 112525.7165, 28990.6788), Point(3609.973884, 113019.372, 28968.57943), Point(5017.243967, 113462.9485, 28946.24641), Point(6436.280031, 113847.9776, 28923.75749), Point(7860.499196, 114173.5842, 28901.14993), Point(9404.731379, 114459.6808, 28876.5245)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], {4}: [Point(4565.884785, 107553.6321, 27231.75968), Point(5710.395105, 108003.3336, 27223.42874), Point(6935.749033, 108433.0578, 27214.98652), Point(8173.057004, 108814.7735, 27206.88351), Point(9417.666121, 109147.6509, 27199.11392), Point(10768.02837, 109452.6286, 27191.0722)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], {5}: [Point(5158.148661, 106288.2269, 26784.10955), Point(6250.609807, 106713.2411, 26774.60305), Point(7434.403293, 107125.698, 26765.0612), Point(8629.111451, 107493.1213, 26756.16126), Point(9830.615854, 107814.8086, 26747.89691), Point(11133.31826, 108111.0093, 26739.66295)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]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))
python_3_script = Python3Script(ptsTree=point_3, maxClusters="50", acceptedTolerance="10", maxAllowedTilt="5")  # -> out, outCircles, outClusterPoints, outError, outClusterCount, outCircleTilts, outDiscardedPoints; inputs ptsTree: tree of Point3d, maxClusters: Int32, acceptedTolerance: Double, maxAllowedTilt: Double
# ---------- python_3_script: Python ----------
"""
Inputs:
    ptsTree (Tree[Point3d]):
        Each branch contains a sorted list of points.
    acceptedTolerance (float):
        (1) Used as the maximum allowed sum error for a cluster before it is split.
        (2) Also used here as a per‐point deviation threshold.
    maxClusters (int):
        Maximum number of clusters allowed.
    maxAllowedTilt (float):
        Maximum allowed deviation (in degrees) of any output circle's plane from horizontal.
        (If a best‐fit circle exceeds this, the algorithm will try to split that cluster;
         if maxClusters is reached and the tilt is still too high, the cluster's points will be discarded.)
    penalty_factor (float):
        Factor by which the squared excess tilt (over maxAllowedTilt) is weighted in candidate cost.
        
Outputs:
    outCircles (Tree[Circle]):
        2D tree, with each branch containing the best‐fit circle (for every cluster) 
        – unless the branch as a whole is deemed "degenerate" (all clusters have 0 tilt).
    outClusterPoints (Tree[Point3d]):
        2D tree, with each branch containing the points that "fit" their circle
        (i.e. for clusters whose tilt is acceptable and where a point's deviation is ≤ pointTolerance).
    outError (Tree[float]):
        A tree with one float per original path: total sum error (sum of errors from all clusters).
    outClusterCount (Tree[int]):
        A tree with one integer per original path: the number of clusters.
    outCircleTilts (Tree[float]):
        A tree, with each branch reporting the measured tilt (in degrees) of each cluster's circle.
    outDiscardedPoints (Tree[Point3d]):
        A tree, with each branch containing points that are "discarded" because they do not
        "fit" the circle (either because their distance exceeds pointTolerance or because, in a branch,
        every cluster's best‑fit circle has 0 tilt).
"""

import Rhino
import math
from Grasshopper import DataTree
from Grasshopper.Kernel.Data import GH_Path

DEBUG = True  # Set to True for debug prints.

# For this example, we use acceptedTolerance as the per‐point threshold.
pointTolerance = acceptedTolerance

# ------------------------------------------------------------
# HELPER FUNCTIONS
# ------------------------------------------------------------

def distance_point_to_circle(pt, circle):
    """Compute the 3D distance from pt to the nearest point on 'circle'."""
    plane = circle.Plane
    pt_on_plane = plane.ClosestPoint(pt)
    dist_to_plane = pt_on_plane.DistanceTo(pt)
    dist_center   = pt_on_plane.DistanceTo(circle.Center)
    dist_in_plane = abs(dist_center - circle.Radius)
    return math.sqrt(dist_to_plane**2 + dist_in_plane**2)

def fit_circle_and_error(pts):
    """
    Fits a circle to points and returns circle and max error to any point.
    Throws error for invalid cases.
    """
    if len(pts) < 3:
        raise ValueError(f"Cannot fit circle with {len(pts)} points - minimum 3 required")
    
    success, circle = Rhino.Geometry.Circle.TryFitCircleToPoints(pts)
    if not success:
        raise ValueError("Failed to fit circle to points")
    
    if circle.Radius < 1000:
        raise ValueError(f"Circle radius {circle.Radius} is less than minimum 1000")
    
    # Calculate maximum error to any point
    max_error = max(distance_point_to_circle(p, circle) for p in pts)
    return circle, max_error

def angle_from_horizontal(circle):
    """
    Returns the acute angle (in degrees) between the circle's plane normal and world Z (vertical).
    (Flips the normal if needed so that we always get the smaller angle.)
    """
    n = circle.Plane.Normal
    if n * Rhino.Geometry.Vector3d.ZAxis < 0:
        n = -n
    return math.degrees(Rhino.Geometry.Vector3d.VectorAngle(n, Rhino.Geometry.Vector3d.ZAxis))

def check_tolerances(circle, max_error, num_clusters):
    """Check if circle meets all tolerances"""
    if max_error > acceptedTolerance:
        return False, "Point distance exceeds tolerance"
    if angle_from_horizontal(circle) > maxAllowedTilt:
        return False, "Circle tilt exceeds maximum"
    if num_clusters >= maxClusters:
        return False, "Maximum number of clusters reached"
    return True, ""

def split_points(pts):
    """Split points into two groups at midpoint"""
    mid = len(pts) // 2
    return pts[:mid], pts[mid:]

# ------------------------------------------------------------
# GRASSHOPPER OUTPUTS
# ------------------------------------------------------------

# Original outputs:
outCircles       = DataTree[Rhino.Geometry.Circle]()
outClusterPoints = DataTree[Rhino.Geometry.Point3d]()
outError         = DataTree[float]()
outClusterCount  = DataTree[int]()

# New outputs:
outCircleTilts     = DataTree[float]()           # Overview of actual tilts (deg) for each cluster's circle
outDiscardedPoints = DataTree[Rhino.Geometry.Point3d]()  # Points that are discarded

# Initialize output trees
outCircles = DataTree[Rhino.Geometry.Circle]()
outClusterPoints = DataTree[Rhino.Geometry.Point3d]()
outError = DataTree[float]()
outClusterCount = DataTree[int]()
outCircleTilts = DataTree[float]()
outDiscardedPoints = DataTree[Rhino.Geometry.Point3d]()

for path in ptsTree.Paths:
    pts_in_path = list(ptsTree.Branch(path))
    if len(pts_in_path) < 3:
        print(f"Branch {path}: Insufficient points ({len(pts_in_path)})")
        for pt in pts_in_path:
            outDiscardedPoints.Add(pt, GH_Path(path))
        continue

    # Start with all points in one cluster
    clusters_to_process = [(pts_in_path, 0)]  # (points, cluster_index)
    valid_clusters = []
    num_clusters = 0
    
    while clusters_to_process:
        current_points, cluster_idx = clusters_to_process.pop(0)
        
        try:
            # Try to fit circle to current cluster
            circle, max_error = fit_circle_and_error(current_points)
            meets_tolerances, reason = check_tolerances(circle, max_error, num_clusters)
            
            if meets_tolerances:
                # Add successful cluster
                valid_clusters.append((current_points, circle, max_error, cluster_idx))
                num_clusters += 1
            else:
                if len(current_points) > 6:  # Enough points to split into two valid clusters
                    # Split cluster and add back to processing
                    left_pts, right_pts = split_points(current_points)
                    clusters_to_process.append((left_pts, cluster_idx))
                    clusters_to_process.append((right_pts, cluster_idx + 1))
                else:
                    # Not enough points to split, discard them
                    print(f"Branch {path}: Discarding {len(current_points)} points - {reason}")
                    for pt in current_points:
                        outDiscardedPoints.Add(pt, GH_Path(path))
                        
        except ValueError as e:
            # Circle fitting failed, discard points
            print(f"Branch {path}: Discarding points - {str(e)}")
            for pt in current_points:
                outDiscardedPoints.Add(pt, GH_Path(path))
    
    # Output valid clusters
    for points, circle, error, idx in valid_clusters:
        cluster_path = GH_Path(path).AppendElement(idx)
        outCircles.Add(circle, cluster_path)
        outCircleTilts.Add(angle_from_horizontal(circle), cluster_path)
        for pt in points:
            outClusterPoints.Add(pt, cluster_path)
    
    if valid_clusters:
        outError.Add(sum(err for _, _, err, _ in valid_clusters), GH_Path(path))
        outClusterCount.Add(len(valid_clusters), GH_Path(path))
# ---------- end python_3_script ----------
point_4 = Point(python_3_script.outDiscardedPoints)

python_3_script_2 = Python3Script(ptsTree=stream_filter, maxTilt=degrees)  # -> out, outCircles, outClusterPoints, flatten(outError), flatten(outClusterCount), flatten(outCircleTilts), outDiscardedPoints, outLog; inputs ptsTree: tree of Point3d, maxTilt: Double
# ---------- python_3_script_2: Python ----------
"""
Inputs:
    ptsTree (Tree[Point3d]):
        Each branch contains a sorted list of points.
    maxTilt (float):
        Maximum allowed tilt angle in degrees.
        
Outputs:
    outCircles (Tree[Circle]):
        2D tree containing the best-fit circles for each cluster.
    outClusterPoints (Tree[Point3d]):
        2D tree containing the points that fit their circle.
    outError (Tree[float]):
        Tree with total error for each branch.
    outClusterCount (Tree[int]):
        Tree with number of clusters for each branch.
    outCircleTilts (Tree[float]):
        Tree with tilt angles for each cluster's circle.
    outDiscardedPoints (Tree[Point3d]):
        Tree with points that couldn't be fit to any circle.
    outMinTolerance (Tree[float]):
        Found minimum tolerance for each branch.
    outMinTilt (Tree[float]):
        Found minimum tilt for each branch.
    outLog (Tree[str]):
        Tree with logging information for each branch.
"""

import Rhino
import math
from Grasshopper import DataTree
from Grasshopper.Kernel.Data import GH_Path

def distance_point_to_circle(pt, circle):
    """Compute the 3D distance from pt to the nearest point on 'circle'."""
    plane = circle.Plane
    pt_on_plane = plane.ClosestPoint(pt)
    dist_to_plane = pt_on_plane.DistanceTo(pt)
    dist_center = pt_on_plane.DistanceTo(circle.Center)
    dist_in_plane = abs(dist_center - circle.Radius)
    return math.sqrt(dist_to_plane**2 + dist_in_plane**2)

def get_max_error_to_circle(pts, circle):
    """
    Calculate maximum error using curve closest point.
    Returns max error and the point with max error for debugging.
    """
    curve = circle.ToNurbsCurve()  # Convert circle to curve for closest point calculation
    max_error = 0
    worst_pt = None
    
    for pt in pts:
        t = curve.ClosestPoint(pt)[1]  # Get parameter of closest point
        closest = curve.PointAt(t)      # Get actual point on curve
        error = pt.DistanceTo(closest)
        if error > max_error:
            max_error = error
            worst_pt = pt
    
    return max_error, worst_pt

def fit_circle_and_error(pts):
    """Fits a circle to points and returns circle, max error, tilt, and worst point."""
    if len(pts) < 3:
        raise ValueError(f"Cannot fit circle with {len(pts)} points - minimum 3 required")
    
    success, circle = Rhino.Geometry.Circle.TryFitCircleToPoints(pts)
    if not success:
        raise ValueError("Failed to fit circle to points")
    
    if circle.Radius < 1000:
        raise ValueError(f"Circle radius {circle.Radius} is less than minimum 1000")
    
    max_error, worst_pt = get_max_error_to_circle(pts, circle)
    tilt = angle_from_horizontal(circle)
    return circle, max_error, tilt, worst_pt

def angle_from_horizontal(circle):
    """Returns the acute angle between circle's plane normal and world Z."""
    n = circle.Plane.Normal
    if n * Rhino.Geometry.Vector3d.ZAxis < 0:
        n = -n
    return math.degrees(Rhino.Geometry.Vector3d.VectorAngle(n, Rhino.Geometry.Vector3d.ZAxis))

def find_best_clustering(pts, path):
    """Find best clustering that minimizes error and tilt."""
    if len(pts) < 3:
        return None
    
    max_possible_clusters = len(pts) // 3
    
    def try_split(points, num_clusters):
        if len(points) < num_clusters * 3:
            return None
            
        points_per_cluster = len(points) // num_clusters
        clusters = []
        discarded = []
        
        for i in range(num_clusters):
            start_idx = i * points_per_cluster
            end_idx = start_idx + points_per_cluster if i < num_clusters - 1 else len(points)
            cluster_points = points[start_idx:end_idx]
            
            try:
                circle, error, tilt, worst_pt = fit_circle_and_error(cluster_points)
                
                # Check if we should try more clusters - changed threshold to 3mm
                if error > 3 and len(points) >= (num_clusters + 1) * 3:
                    return None  # Force trying more clusters
                
                if tilt <= maxTilt:  # Use input maxTilt
                    clusters.append((cluster_points, circle, error, tilt, worst_pt))
                else:
                    # Instead of failing the whole split, add these points to discarded
                    discarded.extend(cluster_points)
            except ValueError as e:
                # Add points from failed circle fit to discarded
                discarded.extend(cluster_points)
        
        # Return both valid clusters and discarded points
        return (clusters, discarded) if clusters else None
    
    best_result = None
    best_discarded = []
    best_max_error = float('inf')
    best_max_tilt = float('inf')
    best_num_clusters = 0
    
    # Try different numbers of clusters
    for num_clusters in range(1, max_possible_clusters + 1):
        result = try_split(pts, num_clusters)
        if result is None:
            continue
            
        clusters, discarded = result
        max_error = max(error for _, _, error, _, _ in clusters)
        max_tilt = max(tilt for _, _, _, tilt, _ in clusters)
        
        if best_result is None or max_error < best_max_error:
            best_result = clusters
            best_discarded = discarded
            best_max_error = max_error
            best_max_tilt = max_tilt
            best_num_clusters = num_clusters
    
    return best_result, best_discarded

# Initialize output trees
outCircles = DataTree[Rhino.Geometry.Circle]()
outClusterPoints = DataTree[Rhino.Geometry.Point3d]()
outError = DataTree[float]()
outClusterCount = DataTree[int]()
outCircleTilts = DataTree[float]()
outDiscardedPoints = DataTree[Rhino.Geometry.Point3d]()
outMinTolerance = DataTree[float]()
outMinTilt = DataTree[float]()
outLog = DataTree[str]()

for path in ptsTree.Paths:
    pts_in_path = list(ptsTree.Branch(path))
    if len(pts_in_path) < 3:
        branchPath = GH_Path(path)
        outLog.Add(f"Insufficient points ({len(pts_in_path)})", branchPath)
        for pt in pts_in_path:
            outDiscardedPoints.Add(pt, branchPath)
        continue
    
    result = find_best_clustering(pts_in_path, path)
    
    if result:
        clusters, discarded_points = result
        max_error = 0
        max_tilt = 0
        
        # Process valid clusters
        for idx, (points, circle, error, tilt, worst_pt) in enumerate(clusters):
            cluster_path = GH_Path(path).AppendElement(idx)
            
            outCircles.Add(circle, cluster_path)
            outCircleTilts.Add(tilt, cluster_path)
            
            log_info = [
                f"Cluster {idx + 1} of {len(clusters)}:",
                f"Points: {len(points)}",
                f"Radius: {circle.Radius:.2f}",
                f"Max Error: {error:.2f}mm",
                f"Tilt: {tilt:.2f}°"
            ]
            if worst_pt:
                log_info.append(f"Worst point distance: {error:.2f}mm")
            
            for log_line in log_info:
                outLog.Add(log_line, cluster_path)
            
            for pt in points:
                outClusterPoints.Add(pt, cluster_path)
                
            max_error = max(max_error, error)
            max_tilt = max(max_tilt, tilt)
        
        # Add discarded points
        branchPath = GH_Path(path)
        for pt in discarded_points:
            outDiscardedPoints.Add(pt, branchPath)
            
        outError.Add(max_error, branchPath)
        outClusterCount.Add(len(clusters), branchPath)
        outMinTolerance.Add(max_error, branchPath)
        outMinTilt.Add(max_tilt, branchPath)
    else:
        # If no valid clustering found, discard all points
        branchPath = GH_Path(path)
        outLog.Add("No valid clustering found - all points discarded", branchPath)
        for pt in pts_in_path:
            outDiscardedPoints.Add(pt, branchPath)

# Assign outputs
a = outCircles
b = outClusterPoints
c = outError
d = outClusterCount
e = outCircleTilts
f = outDiscardedPoints
g = outMinTolerance
h = outMinTilt
i = outLog
# ---------- end python_3_script_2 ----------

# ---- group: rev0
python_3_script_3 = Python3Script(ptsTree=stream_filter, maxTilt=degrees)  # -> out, outCircles, outClusterPoints, flatten(outError), flatten(outClusterCount), flatten(outCircleTilts), outDiscardedPoints, outLog; inputs ptsTree: tree of Point3d, maxTilt: Double; disabled
# ---------- python_3_script_3: Python ----------
"""
Inputs:
    ptsTree (Tree[Point3d]):
        Each branch contains a sorted list of points.
    maxClusters (int):
        Maximum number of clusters allowed.
        
Outputs:
    outCircles (Tree[Circle]):
        2D tree containing the best-fit circles for each cluster.
    outClusterPoints (Tree[Point3d]):
        2D tree containing the points that fit their circle.
    outError (Tree[float]):
        Tree with total error for each branch.
    outClusterCount (Tree[int]):
        Tree with number of clusters for each branch.
    outCircleTilts (Tree[float]):
        Tree with tilt angles for each cluster's circle.
    outDiscardedPoints (Tree[Point3d]):
        Tree with points that couldn't be fit to any circle.
    outMinTolerance (Tree[float]):
        Found minimum tolerance for each branch.
    outMinTilt (Tree[float]):
        Found minimum tilt for each branch.
    outLog (Tree[str]):
        Tree with logging information for each branch.
"""

import Rhino
import math
from Grasshopper import DataTree
from Grasshopper.Kernel.Data import GH_Path

def distance_point_to_circle(pt, circle):
    """Compute the 3D distance from pt to the nearest point on 'circle'."""
    plane = circle.Plane
    pt_on_plane = plane.ClosestPoint(pt)
    dist_to_plane = pt_on_plane.DistanceTo(pt)
    dist_center = pt_on_plane.DistanceTo(circle.Center)
    dist_in_plane = abs(dist_center - circle.Radius)
    return math.sqrt(dist_to_plane**2 + dist_in_plane**2)

def get_max_error_to_circle(pts, circle):
    """
    Calculate maximum error using curve closest point.
    Returns max error and the point with max error for debugging.
    """
    curve = circle.ToNurbsCurve()  # Convert circle to curve for closest point calculation
    max_error = 0
    worst_pt = None
    
    for pt in pts:
        t = curve.ClosestPoint(pt)[1]  # Get parameter of closest point
        closest = curve.PointAt(t)      # Get actual point on curve
        error = pt.DistanceTo(closest)
        if error > max_error:
            max_error = error
            worst_pt = pt
    
    return max_error, worst_pt

def fit_circle_and_error(pts):
    """Fits a circle to points and returns circle, max error, tilt, and worst point."""
    if len(pts) < 3:
        raise ValueError(f"Cannot fit circle with {len(pts)} points - minimum 3 required")
    
    success, circle = Rhino.Geometry.Circle.TryFitCircleToPoints(pts)
    if not success:
        raise ValueError("Failed to fit circle to points")
    
    if circle.Radius < 1000:
        raise ValueError(f"Circle radius {circle.Radius} is less than minimum 1000")
    
    max_error, worst_pt = get_max_error_to_circle(pts, circle)
    tilt = angle_from_horizontal(circle)
    return circle, max_error, tilt, worst_pt

def angle_from_horizontal(circle):
    """Returns the acute angle between circle's plane normal and world Z."""
    n = circle.Plane.Normal
    if n * Rhino.Geometry.Vector3d.ZAxis < 0:
        n = -n
    return math.degrees(Rhino.Geometry.Vector3d.VectorAngle(n, Rhino.Geometry.Vector3d.ZAxis))

def find_best_clustering(pts, path):
    """Find best clustering that minimizes error and tilt."""
    if len(pts) < 3:
        return None
    
    # Calculate maximum possible clusters for this branch
    max_possible_clusters = len(pts) // 3  # Each cluster needs minimum 3 points
    
    def try_split(points, num_clusters):
        if len(points) < num_clusters * 3:
            return None
            
        points_per_cluster = len(points) // num_clusters
        clusters = []
        
        for i in range(num_clusters):
            start_idx = i * points_per_cluster
            end_idx = start_idx + points_per_cluster if i < num_clusters - 1 else len(points)
            cluster_points = points[start_idx:end_idx]
            
            try:
                circle, error, tilt, worst_pt = fit_circle_and_error(cluster_points)
                
                # Check if we should try more clusters
                if error > 10 and len(points) >= (num_clusters + 1) * 3:  # If error is high and we can split further
                    return None  # Force trying more clusters
                
                if tilt <= maxTilt:  # Only check tilt if we're satisfied with error
                    clusters.append((cluster_points, circle, error, tilt, worst_pt))
                else:
                    return None
            except ValueError as e:
                return None
                
        return clusters if len(clusters) == num_clusters else None
    
    best_result = None
    best_max_error = float('inf')
    best_max_tilt = float('inf')
    best_num_clusters = 0
    
    # Try different numbers of clusters up to maximum possible
    for num_clusters in range(1, max_possible_clusters + 1):
        result = try_split(pts, num_clusters)
        if result is None:
            continue
            
        max_error = max(error for _, _, error, _, _ in result)
        max_tilt = max(tilt for _, _, _, tilt, _ in result)
        
        if best_result is None or max_error < best_max_error:
            best_result = result
            best_max_error = max_error
            best_max_tilt = max_tilt
            best_num_clusters = num_clusters
    
    return best_result

# Initialize output trees
outCircles = DataTree[Rhino.Geometry.Circle]()
outClusterPoints = DataTree[Rhino.Geometry.Point3d]()
outError = DataTree[float]()
outClusterCount = DataTree[int]()
outCircleTilts = DataTree[float]()
outDiscardedPoints = DataTree[Rhino.Geometry.Point3d]()
outMinTolerance = DataTree[float]()
outMinTilt = DataTree[float]()
outLog = DataTree[str]()

for path in ptsTree.Paths:
    pts_in_path = list(ptsTree.Branch(path))
    if len(pts_in_path) < 3:
        branchPath = GH_Path(path)
        outLog.Add(f"Insufficient points ({len(pts_in_path)})", branchPath)
        for pt in pts_in_path:
            outDiscardedPoints.Add(pt, branchPath)
        continue
    
    clusters = find_best_clustering(pts_in_path, path)
    
    if clusters:
        max_error = 0
        max_tilt = 0
        
        for idx, (points, circle, error, tilt, worst_pt) in enumerate(clusters):
            cluster_path = GH_Path(path).AppendElement(idx)
            
            # Add circle and points
            outCircles.Add(circle, cluster_path)
            outCircleTilts.Add(tilt, cluster_path)
            
            # Add detailed log for this cluster
            log_info = [
                f"Cluster {idx + 1} of {len(clusters)}:",
                f"Points: {len(points)}",
                f"Radius: {circle.Radius:.2f}",
                f"Max Error: {error:.2f}mm",
                f"Tilt: {tilt:.2f}°"
            ]
            if worst_pt:
                log_info.append(f"Worst point distance: {error:.2f}mm")
            
            for log_line in log_info:
                outLog.Add(log_line, cluster_path)
            
            # Add points
            for pt in points:
                outClusterPoints.Add(pt, cluster_path)
                
            max_error = max(max_error, error)
            max_tilt = max(max_tilt, tilt)
        
        branchPath = GH_Path(path)
        outError.Add(max_error, branchPath)
        outClusterCount.Add(len(clusters), branchPath)
        outMinTolerance.Add(max_error, branchPath)
        outMinTilt.Add(max_tilt, branchPath)
    else:
        # If no valid clustering found, discard all points
        branchPath = GH_Path(path)
        outLog.Add("No valid clustering found - all points discarded", branchPath)
        for pt in pts_in_path:
            outDiscardedPoints.Add(pt, branchPath)

# Assign outputs
a = outCircles
b = outClusterPoints
c = outError
d = outClusterCount
e = outCircleTilts
f = outDiscardedPoints
g = outMinTolerance
h = outMinTilt
i = outLog
# ---------- end python_3_script_3 ----------

# ----
shift_paths = ShiftPaths(Data=python_3_script_2.outCircles, Offset=-1)
tree_branch = TreeBranch(Tree=shift_paths, Path=Slider(0, range=0..8), MaintainPaths=True)
point_5 = Point(python_3_script_2.outDiscardedPoints)
panel = Panel(python_3_script_2.outClusterCount)
tree_statistics = TreeStatistics(Tree=python_3_script_2.outCircles)  # -> Paths, Length, Count
curve_closest_point = CurveClosestPoint(Point=python_3_script_2.outClusterPoints, Curve=python_3_script_2.outCircles)  # -> Point, Parameter, flatten(Distance)
list_item = ListItem(List=tree_statistics.Paths, Index=Slider(5, range=0..100), Wrap=True)
bounds = Bounds(Numbers=curve_closest_point.Distance)
tree_branch_2 = TreeBranch(Tree=python_3_script_2.outClusterPoints, Path=list_item, MaintainPaths=True)
tree_branch_3 = TreeBranch(Tree=python_3_script_2.outLog, Path=list_item, MaintainPaths=True)
tree_branch_4 = TreeBranch(Tree=python_3_script_2.outCircles, Path=list_item, MaintainPaths=True)
panel_2 = Panel(bounds)
curve_closest_point_2 = CurveClosestPoint(Point=tree_branch_2, Curve=tree_branch_4)  # -> Point, Parameter, Distance
bounds_2 = Bounds(Numbers=curve_closest_point_2.Distance)
deconstruct_domain = DeconstructDomain(Domain=bounds_2)  # -> Start, End
panel_3 = Panel(tree_branch_3)
maximum = Maximum(A=deconstruct_domain.Start, B=deconstruct_domain.End)
panel_4 = Panel(maximum)
