# Grasshopper definition 250613_VTM_B04_Walls&Concave_DataExtraction_v1_ERSK.gh (Grasshopper 1.0.8)
# plug-ins: treesloth01, Human, eleFront

# ---- group: Concave target
# Inner
surface = Surface([<surface referenced from the Rhino model> x40])

# ---- group: Walls target
surface_2 = Surface([<surface referenced from the Rhino model> x40])

# ---- group: projector opening top edges
curve = Curve([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])

# ---- group: projector opening bottom edges
curve_2 = Curve([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])

# ---- group: shelf pts
point = Point([Point(-7861.441591, 65145.55211, 21750), Point(-7102.056771, 62090.18941, 21750), Point(-7644.927999, 77434.43463, 21750), Point(-4226.072003, 85756.40303, 21750), Point(2415.6685, 93565.83134, 21750), Point(6199.824299, 96353.45276, 21750)])

# ----
surface_3 = Surface([<surface referenced from the Rhino model> x139])

# ---- group: Concave target
# Outer
surface_4 = Surface([<surface referenced from the Rhino model> x40])

# ---- group: Walls target
surface_5 = Surface([<surface referenced from the Rhino model> x55])

# ----
brep_wireframe = BrepWireframe(Brep=[surface_4, surface_5, surface_3], Density=-1)
surface_6 = Surface([<surface referenced from the Rhino model> x139])
brep_wireframe_2 = BrepWireframe(Brep=[surface, surface_2, surface_6], Density=-1)
discontinuity = Discontinuity(Curve=surface_4, Level=1)  # -> simplify(Points), Parameters
custom_preview_lineweights = CustomPreviewLineweights(Geometry=brep_wireframe, Shader=ColourSwatch(SwatchColor=RGB(0, 0, 0)), Absolute=False)
deconstruct = Deconstruct(Point=discontinuity.Points)  # -> XComponent, YComponent, ZComponent
discontinuity_2 = Discontinuity(Curve=surface, Level=1)  # -> simplify(Points), Parameters
custom_preview_lineweights_2 = CustomPreviewLineweights(Geometry=brep_wireframe_2, Shader=ColourSwatch(SwatchColor=RGB(0, 0, 0)), Absolute=False)
deconstruct_2 = Deconstruct(Point=discontinuity_2.Points)  # -> XComponent, YComponent, ZComponent
discontinuity_3 = Discontinuity(Curve=surface_5, Level=1)  # -> simplify(Points), Parameters
sort_list = SortList(Keys=deconstruct.ZComponent, ValuesValuesA=discontinuity.Points)  # -> Keys, ValuesValuesA
curve_middle = CurveMiddle(Curve=curve_2)
average = Average(Input=discontinuity.Points)
sort_list_2 = SortList(Keys=deconstruct_2.ZComponent, ValuesValuesA=discontinuity_2.Points)  # -> Keys, ValuesValuesA
average_2 = Average(Input=discontinuity_3.Points)
guidecrv = Curve(<curve referenced from the Rhino model>)
list_item = ListItem(List=sort_list.ValuesValuesA, Index=0, Wrap=True)  # -> Item, Item1
discontinuity_4 = Discontinuity(Curve=surface_2, Level=1)  # -> simplify(Points), Parameters
average_3 = Average(Input=discontinuity_2.Points)
merge = Merge(Data1=list_item.Item, Data2=list_item.Item1)  # -> flatten(Result)
guidecrv_2 = Curve(<curve referenced from the Rhino model>)
list_item_2 = ListItem(List=sort_list_2.ValuesValuesA, Index=0, Wrap=True)  # -> Item, Item1
sort_along_curve = SortAlongCurve(Points=flatten(average), Curve=guidecrv)  # -> Points, Indices
list_item_3 = ListItem(List=surface_4, Index=flatten(sort_along_curve.Indices), Wrap=True)  # -> simplify(graft(Item))

# ---- group: sorted concave
surface_7 = Surface(list_item_3)

# ----
sort_along_curve_2 = SortAlongCurve(Points=merge, Curve=guidecrv)  # -> Points, Indices
sort_along_curve_3 = SortAlongCurve(Points=flatten(average_2), Curve=guidecrv)  # -> Points, Indices
average_4 = Average(Input=discontinuity_4.Points)
xy_plane = XYPlane(Origin=Point(0, 0, 0))
merge_2 = Merge(Data1=list_item_2.Item, Data2=list_item_2.Item1)  # -> flatten(Result)
curve_middle_2 = CurveMiddle(Curve=curve)
sort_along_curve_4 = SortAlongCurve(Points=flatten(average_3), Curve=guidecrv_2)  # -> Points, Indices
list_item_4 = ListItem(List=surface, Index=flatten(sort_along_curve_4.Indices), Wrap=True)  # -> simplify(graft(Item))
sort_along_curve_5 = SortAlongCurve(Points=merge_2, Curve=guidecrv_2)  # -> Points, Indices
sort_along_curve_6 = SortAlongCurve(Points=curve_middle, Curve=guidecrv_2)  # -> Points, Indices

# ---- group: sorted concave
surface_8 = Surface(list_item_4)

# ---- group: Finds bottom edge
cluster = Cluster_10(surface=surface_8)  # -> flatten(i)

# ----
offset_curve = OffsetCurve(Curve=guidecrv, Distance=Slider(55, range=0..100), Plane=xy_plane, Corners=1)
xy_plane_2 = XYPlane(Origin=Point(0, 0, 0))
list_item_5 = ListItem(List=surface_5, Index=flatten(sort_along_curve_3.Indices), Wrap=True)

# ----
# Clusters points based on proximity
panel = Panel("10")
python_3_script = Python3Script(points=sort_along_curve_2.Points, threshold=panel)  # -> out, clusters, indices; inputs points: list of Point3d, threshold: Double
# ---------- python_3_script: Python ----------
import Rhino.Geometry as rg
from Grasshopper import DataTree
from Grasshopper.Kernel.Data import GH_Path

def cluster_points(points, threshold):
    clusters = DataTree[rg.Point3d]()
    indices = DataTree[int]()
    
    for i, point in enumerate(points):
        added_to_cluster = False
        
        # Check if the point can be added to an existing cluster
        for cluster_idx in range(clusters.BranchCount):
            cluster_path = GH_Path(cluster_idx)
            cluster = clusters.Branch(cluster_path)
            for cluster_point in cluster:
                if point.DistanceTo(cluster_point) <= threshold:
                    clusters.Add(point, cluster_path)
                    indices.Add(i, cluster_path)
                    added_to_cluster = True
                    break
            if added_to_cluster:
                break
        
        # If not added, create a new cluster
        if not added_to_cluster:
            new_path = GH_Path(clusters.BranchCount)
            clusters.Add(point, new_path)
            indices.Add(i, new_path)
    
    return clusters, indices

# Call the function and get clusters and indices
clusters, indices = cluster_points(points, threshold)

# Output clusters and indices
for idx in range(clusters.BranchCount):
    cluster = clusters.Branch(GH_Path(idx))
    cluster_indices = indices.Branch(GH_Path(idx))
    print(f"Cluster {idx + 1}: {[str(pt) for pt in cluster]}")
    print(f"Indices: {cluster_indices}")
# ---------- end python_3_script ----------
point_2 = Point(python_3_script.clusters)

sort_along_curve_7 = SortAlongCurve(Points=curve_middle_2, Curve=guidecrv_2)  # -> Points, Indices
sort_along_curve_8 = SortAlongCurve(Points=flatten(average_4), Curve=guidecrv_2)  # -> Points, Indices
offset_curve_2 = OffsetCurve(Curve=guidecrv_2, Distance=Slider(55, range=0..100), Plane=xy_plane_2, Corners=1)
guidecrv_3 = Curve(guidecrv)
unit_z = UnitZ(Factor=1)

# ----
# Clusters points based on proximity
panel_2 = Panel("10")
python_3_script_2 = Python3Script(points=sort_along_curve_5.Points, threshold=panel_2)  # -> out, clusters, indices; inputs points: list of Point3d, threshold: Double; same code as python_3_script
point_3 = Point(python_3_script_2.clusters)

point_4 = Point(point_3)
point_5 = Point(flatten(point_4))
python_3_script_3 = Python3Script(pts=point_5, crvs=cluster)  # -> out, simplify(crvPairs); inputs pts: tree of Point3d, crvs: list of Curve
# ---------- python_3_script_3: Python ----------
""" Name: ClosestCurvePairs
    Written by: Erik Lima Müller
    Date: 2025/06/25

Description ────────────────────────────────────────────────────────────
For every Point3d in a DataTree, find the two closest curves (within 6 mm)
from a supplied list and output them to a mirrored DataTree structure.

Inputs ────────────────────────────────────────────────────────────────
    pts  : DataTree[Point3d]  – nested point collection  
    crvs : List[Curve]        – candidate curves

Outputs ───────────────────────────────────────────────────────────────
    crvPairs : DataTree[Curve] – per-point branch containing 0–2 curves
"""

import Rhino.Geometry as rg
from Grasshopper import DataTree
from Grasshopper.Kernel.Data import GH_Path

# --- parameters ---
tolerance = 6.0   # mm

# --- initialise output ---
crvPairs = DataTree[rg.Curve]()

# --- iterate through every point in the incoming DataTree ---
for i_branch in range(pts.BranchCount):
    branch = pts.Branch(i_branch)

    for j_item, pt in enumerate(branch):
        # gather (distance, curve) tuples for all curves
        dists = []
        for crv in crvs:
            ok, t = crv.ClosestPoint(pt)
            if not ok:
                continue
            closest = crv.PointAt(t)
            d = pt.DistanceTo(closest)
            if d <= tolerance:
                dists.append((d, crv))

        # sort by distance and take the two nearest
        dists.sort(key=lambda x: x[0])
        closest_two = [c for _, c in dists[:2]]

        # write results to a branch that mirrors the point’s path
        # (e.g. {i;j}) so the tree shape stays aligned
        path = GH_Path(i_branch, j_item)
        for crv in closest_two:
            crvPairs.Add(crv, path)

# --- If you need the output tree named exactly ‘crvPairs’, simply pass it
#      out of the GhPython component (or set it in the ‘Outputs’ pane).
# ---------- end python_3_script_3 ----------
list_length = ListLength(List=python_3_script_3.crvPairs)
larger_than = LargerThan(FirstNumber=list_length, SecondNumber=2)  # -> LargerThan, OrEqualTo
cull_pattern = CullPattern(List=python_3_script_3.crvPairs, CullPattern=invert(larger_than.OrEqualTo))
cull_pattern_2 = CullPattern(List=python_3_script_3.crvPairs, CullPattern=larger_than.OrEqualTo)
end_points = EndPoints(Curve=cull_pattern)  # -> Start, End
clean_tree = CleanTree(RemoveNulls=True, RemoveInvalid=True, RemoveEmpty=True, Tree=cull_pattern_2)
vector_2pt = Vector2Pt(PointA=end_points.Start, PointB=end_points.End, Unitize=False)  # -> Vector, Length
list_item_6 = ListItem(List=clean_tree, Index=0, Wrap=True)  # -> Item, Item1
end_points_2 = EndPoints(Curve=list_item_6.Item)  # -> Start, End
end_points_3 = EndPoints(Curve=list_item_6.Item1)  # -> Start, End
clean_tree_2 = CleanTree(RemoveNulls=True, RemoveInvalid=True, RemoveEmpty=True, Tree=vector_2pt.Vector)
point_6 = Point(end_points_2.Start)
point_7 = Point(end_points_3.End)
tree_statistics = TreeStatistics(Tree=point_4)  # -> Paths, Length, Count
vector_2pt_2 = Vector2Pt(PointA=point_6, PointB=point_7, Unitize=False)  # -> Vector, Length
trim_data_ends = TrimDataEnds(Data=tree_statistics.Paths, ListStart=1, ListEnd=1, PathStart=0, PathEnd=0, RenumberPaths=True)

# ---- group: sorted walls
surface_9 = Surface(list_item_5)

# ----
amplitude = Amplitude(Vector=vector_2pt_2.Vector, Amplitude=55)
list_item_7 = ListItem(List=curve, Index=sort_along_curve_7.Indices, Wrap=True)
surface_closest_point = SurfaceClosestPoint(Point=point_2, Surface=surface_7)  # -> Point, UVPoint, Distance
list_item_8 = ListItem(List=curve_2, Index=sort_along_curve_6.Indices, Wrap=True)
point_8 = Point(point_2)
list_item_9 = ListItem(List=surface_2, Index=flatten(sort_along_curve_8.Indices), Wrap=True)
point_9 = Point(flatten(point_8))

# ---- group: Finds bottom edge
cluster_2 = Cluster_10(surface=surface_7)  # -> flatten(i)

# ----
surface_closest_point_2 = SurfaceClosestPoint(Point=point_3, Surface=surface_8)  # -> Point, UVPoint, Distance
rotate = Rotate(Vector=clean_tree_2, Axis=unit_z, Angle=".5*pi")
deconstruct_path = DeconstructPath(Branch=tree_statistics.Paths)  # -> flatten(Indices)
evaluate_surface = EvaluateSurface(Surface=surface_7, Point=surface_closest_point.UVPoint)  # -> Point, Normal, UDirection, VDirection, Frame

# ---- group: projector edges top (sorted)
curve_3 = Curve(list_item_7)

# ----
deconstruct_path_2 = DeconstructPath(Branch=trim_data_ends)  # -> flatten(Indices)

# ---- group: projector edges bottom (sorted)
curve_4 = Curve(list_item_8)

# ----
discontinuity_5 = Discontinuity(Curve=surface_9, Level=1)  # -> simplify(Points), Parameters

# ---- group: sorted walls
surface_10 = Surface(list_item_9)

# ----
curve_middle_3 = CurveMiddle(Curve=guidecrv_3)
python_3_script_4 = Python3Script(pts=point_9, crvs=cluster_2)  # -> out, simplify(crvPairs); inputs pts: tree of Point3d, crvs: list of Curve; same code as python_3_script_3
tree_statistics_2 = TreeStatistics(Tree=point_4)  # -> Paths, Length, Count
unit_z_2 = UnitZ(Factor="85")
evaluate_surface_2 = EvaluateSurface(Surface=surface_8, Point=surface_closest_point_2.UVPoint)  # -> Point, Normal, UDirection, VDirection, Frame
discontinuity_6 = Discontinuity(Curve=surface_10, Level=1)  # -> simplify(Points), Parameters
partition_list = PartitionList(List=flatten(amplitude), Size=2)  # -> simplify(Chunks)
move = Move(Geometry=point_2, Motion=unit_z_2)  # -> Geometry, Transform
set_difference = SetDifference(SetA=deconstruct_path, SetB=deconstruct_path_2)
deconstruct_3 = Deconstruct(Point=discontinuity_5.Points)  # -> XComponent, YComponent, ZComponent
deconstruct_4 = Deconstruct(Point=curve_middle_3)  # -> XComponent, YComponent, ZComponent
unit_z_3 = UnitZ(Factor="85")
list_length_2 = ListLength(List=python_3_script_4.crvPairs)
move_2 = Move(Geometry=point_3, Motion=unit_z_3)  # -> Geometry, Transform
trim_data_ends_2 = TrimDataEnds(Data=tree_statistics_2.Paths, ListStart=1, ListEnd=1, PathStart=0, PathEnd=0, RenumberPaths=True)
vector_display_ex = VectorDisplayEx(Point=point_2, Vector=unit_z_2, Colour=ColourSwatch(SwatchColor=RGB(0, 255, 0)), Width=2)
data_path = DataPath(set_difference)
tree_branch = TreeBranch(Tree=point_4, Path=data_path, MaintainPaths=True)
vector_display_ex_2 = VectorDisplayEx(Point=tree_branch, Vector=rotate, Colour=RGB(0, 0, 0), Width=2)
list_length_3 = ListLength(List=move.Geometry)
tree_statistics_3 = TreeStatistics(Tree=partition_list)  # -> Paths, Length, Count
tree_branch_2 = TreeBranch(Tree=point_4, Path=trim_data_ends_2, MaintainPaths=True)
larger_than_2 = LargerThan(FirstNumber=list_length_2, SecondNumber=2)  # -> LargerThan, OrEqualTo
sort_list_3 = SortList(Keys=deconstruct_3.ZComponent, ValuesValuesA=discontinuity_5.Points)  # -> Keys, ValuesValuesA
vector_display_ex_3 = VectorDisplayEx(Point=point_3, Vector=unit_z_3, Colour=ColourSwatch(SwatchColor=RGB(0, 255, 0)), Width=2)
deconstruct_5 = Deconstruct(Point=discontinuity_6.Points)  # -> XComponent, YComponent, ZComponent
average_5 = Average(Input=discontinuity_5.Points)
list_length_4 = ListLength(List=move_2.Geometry)
equality = Equality(FirstNumber=list_length_3, SecondNumber=1)  # -> Equality, Inequality
unit_z_4 = UnitZ(Factor=1)
plane = Plane(evaluate_surface.Frame)
replace_paths = ReplacePaths(Data=partition_list, Search=tree_statistics_3.Paths, Replace=trim_data_ends_2)
equality_2 = Equality(FirstNumber=list_length_4, SecondNumber=1)  # -> Equality, Inequality
list_item_10 = ListItem(List=sort_list_3.ValuesValuesA, Index=0, Wrap=True)  # -> Item, Item1
cull_pattern_3 = CullPattern(List=python_3_script_4.crvPairs, CullPattern=invert(larger_than_2.OrEqualTo))
sort_list_4 = SortList(Keys=deconstruct_5.ZComponent, ValuesValuesA=discontinuity_6.Points)  # -> Keys, ValuesValuesA
cull_pattern_4 = CullPattern(List=python_3_script_4.crvPairs, CullPattern=larger_than_2.OrEqualTo)
plane_2 = Plane(evaluate_surface_2.Frame)
average_6 = Average(Input=discontinuity_6.Points)
sort_along_curve_9 = SortAlongCurve(Points=flatten(average_5), Curve=guidecrv)  # -> Points, Indices
cull_pattern_5 = CullPattern(List=move.Geometry, CullPattern=invert(equality.Equality))
cull_pattern_6 = CullPattern(List=move.Geometry, CullPattern=equality.Equality)
dispatch = Dispatch(List=replace_paths, DispatchPattern=[True, False])  # -> ListA, ListB
cull_pattern_7 = CullPattern(List=plane, CullPattern=equality.Equality)
end_points_4 = EndPoints(Curve=guidecrv)  # -> Start, End
merge_3 = Merge(Data1=list_item_10.Item, Data2=list_item_10.Item1)
sort_along_curve_10 = SortAlongCurve(Points=flatten(merge_3), Curve=guidecrv)  # -> Points, Indices
cull_pattern_8 = CullPattern(List=move_2.Geometry, CullPattern=invert(equality_2.Equality))
cull_pattern_9 = CullPattern(List=move_2.Geometry, CullPattern=equality_2.Equality)
list_item_11 = ListItem(List=sort_list_4.ValuesValuesA, Index=0, Wrap=True)  # -> Item, Item1
# compare against valdemars data
clean_tree_3 = CleanTree(RemoveNulls=True, RemoveInvalid=True, RemoveEmpty=True, Tree=cull_pattern_4)
clean_tree_4 = CleanTree(RemoveNulls=True, RemoveInvalid=True, RemoveEmpty=True, Tree=cull_pattern_3)
curve_middle_4 = CurveMiddle(Curve=clean_tree_4)
deconstruct_6 = Deconstruct(Point=curve_middle_4)  # -> XComponent, YComponent, ZComponent
construct_point = ConstructPoint(XCoordinate=deconstruct_6.XComponent, YCoordinate=deconstruct_6.YComponent, ZCoordinate=deconstruct_4.ZComponent)
curve_closest_point = CurveClosestPoint(Point=construct_point, Curve=guidecrv_3)  # -> Point, Parameter, Distance
vector_2pt_3 = Vector2Pt(PointA=construct_point, PointB=curve_closest_point.Point, Unitize=False)  # -> Vector, Length
amplitude_2 = Amplitude(Vector=vector_2pt_3.Vector, Amplitude=1000)
vector_display_ex_4 = VectorDisplayEx(Point=construct_point, Vector=amplitude_2, Colour=RGB(0, 0, 0), Width=2)
cull_pattern_10 = CullPattern(List=plane_2, CullPattern=equality_2.Equality)
end_points_5 = EndPoints(Curve=guidecrv_2)  # -> Start, End
sort_along_curve_11 = SortAlongCurve(Points=flatten(average_6), Curve=guidecrv_2)  # -> Points, Indices
merge_4 = Merge(Data1=end_points_4.Start, Data2=end_points_4.End)

# ---- group: Ends of run
point_10 = Point(cull_pattern_6)

# ---- group: Centers of run
D = Point(cull_pattern_5)

# ----
# compare against valdemars data
reverse = Reverse(Vector=dispatch.ListB)
deconstruct_plane = DeconstructPlane(Plane=cull_pattern_7)  # -> Origin, XAxis, YAxis, ZAxis
merge_5 = Merge(Data1=list_item_11.Item, Data2=list_item_11.Item1)
partition_list_2 = PartitionList(List=sort_along_curve_10.Points, Size=2)  # -> simplify(Chunks)
list_item_12 = ListItem(List=surface_9, Index=flatten(sort_along_curve_9.Indices), Wrap=True)
discontinuity_7 = Discontinuity(Curve=list_item_12, Level=1)  # -> simplify(Points), Parameters
closest_point = ClosestPoint(Point=point_10, Cloud=merge_4)  # -> ClosestPoint, CPIndex, Distance
merge_6 = Merge(Data1=end_points_5.Start, Data2=end_points_5.End)
sort_along_curve_12 = SortAlongCurve(Points=flatten(merge_5), Curve=guidecrv_2)  # -> Points, Indices

# ---- group: Ends of run
point_11 = Point(cull_pattern_9)

# ---- group: Centers of run
D_2 = Point(cull_pattern_8)

# ----
deconstruct_plane_2 = DeconstructPlane(Plane=cull_pattern_10)  # -> Origin, XAxis, YAxis, ZAxis
list_item_13 = ListItem(List=D, Index=0, Wrap=True)  # -> Item, Item1
end_points_6 = EndPoints(Curve=clean_tree_4)  # -> Start, End
merge_7 = Merge(Data1=dispatch.ListA, Data2=reverse)
rotate_2 = Rotate(Vector=merge_7, Axis=unit_z_4, Angle=".5*pi")
merge_8 = Merge(Data1=rotate, Data2=rotate_2)
list_item_14 = ListItem(List=merge_8, Index=0, Wrap=True)  # -> Item, Item1
addition = Addition(A=list_item_14.Item, B=list_item_14.Item1)
vector_display_ex_5 = VectorDisplayEx(Point=tree_branch_2, Vector=rotate_2, Colour=RGB(0, 0, 0), Width=2)
list_item_15 = ListItem(List=clean_tree_3, Index=0, Wrap=True)  # -> Item, Item1
shatter = Shatter(Curve=simplify(graft(list_item_12)), Parameters=simplify(discontinuity_7.Parameters))  # -> simplify(Segments)
closest_point_2 = ClosestPoint(Point=point_11, Cloud=merge_6)  # -> ClosestPoint, CPIndex, Distance
list_item_16 = ListItem(List=D_2, Index=0, Wrap=True)  # -> Item, Item1
line = Line(StartPoint=list_item_13.Item, EndPoint=list_item_13.Item1)
amplitude_3 = Amplitude(Vector=deconstruct_plane.XAxis, Amplitude="2.5")
list_item_17 = ListItem(List=partition_list_2, Index=0, Wrap=True)  # -> Item, Item1
end_points_7 = EndPoints(Curve=list_item_15.Item)  # -> Start, End
panel_3 = Panel("""Start
End""")
partition_list_3 = PartitionList(List=sort_along_curve_12.Points, Size=2)  # -> simplify(Chunks)
list_item_18 = ListItem(List=surface_10, Index=flatten(sort_along_curve_11.Indices), Wrap=True)
discontinuity_8 = Discontinuity(Curve=list_item_18, Level=1)  # -> simplify(Points), Parameters
merge_9 = Merge(Data1=graft(list_item_12), Data2=graft(list_item_12))  # -> flatten(Result)
vector_2pt_4 = Vector2Pt(PointA=end_points_6.Start, PointB=end_points_6.End, Unitize=False)  # -> Vector, Length
end_points_8 = EndPoints(Curve=list_item_15.Item1)  # -> Start, End
line_2 = Line(StartPoint=list_item_16.Item1, EndPoint=list_item_16.Item)

curve_5 = Curve([<curve referenced from the Rhino model> x2])
list_item_19 = ListItem(List=curve_5, Index=0, Wrap=True)  # -> Item, Item1
curve_middle_5 = CurveMiddle(Curve=list_item_19.Item)
curve_middle_6 = CurveMiddle(Curve=list_item_19.Item1)
curve_closest_point_2 = CurveClosestPoint(Point=curve_middle_6, Curve=list_item_19.Item1)  # -> Point, Parameter, Distance
curve_closest_point_3 = CurveClosestPoint(Point=curve_middle_5, Curve=list_item_19.Item)  # -> Point, Parameter, Distance
evaluate_curve = EvaluateCurve(Curve=list_item_19.Item1, Parameter=curve_closest_point_2.Parameter)  # -> Point, Tangent, Angle
evaluate_curve_2 = EvaluateCurve(Curve=list_item_19.Item, Parameter=curve_closest_point_3.Parameter)  # -> Point, Tangent, Angle
unit_z_5 = UnitZ(Factor=1)
unit_z_6 = UnitZ(Factor=1)
rotate_3 = Rotate(Vector=evaluate_curve.Tangent, Axis=unit_z_5, Angle=1.570796327)
rotate_4 = Rotate(Vector=evaluate_curve_2.Tangent, Axis=unit_z_6, Angle=1.570796327)
amplitude_4 = Amplitude(Vector=rotate_3, Amplitude=55)
amplitude_5 = Amplitude(Vector=expr("-x", rotate_4), Amplitude=55)
vector_display_ex_6 = VectorDisplayEx(Point=evaluate_curve_2.Point, Vector=amplitude_5, Colour=RGB(0, 0, 0), Width=2)
addition_2 = Addition(A=amplitude_5, B=amplitude_4)
vector_display_ex_7 = VectorDisplayEx(Point=evaluate_curve.Point, Vector=amplitude_4, Colour=RGB(0, 0, 0), Width=2)
amplitude_6 = Amplitude(Vector=addition_2, Amplitude=55)
point_12 = Point(<point referenced from the Rhino model>)
vector_display_ex_8 = VectorDisplayEx(Point=point_12, Vector=amplitude_6, Colour=RGB(0, 0, 0), Width=2)

amplitude_7 = Amplitude(Vector=deconstruct_plane_2.XAxis, Amplitude="2.5")
panel_4 = Panel("""Start
End""")
shatter_2 = Shatter(Curve=simplify(graft(list_item_18)), Parameters=simplify(discontinuity_8.Parameters))  # -> simplify(Segments)
list_item_20 = ListItem(List=panel_3, Index=closest_point.CPIndex, Wrap=True)
point_13 = Point(end_points_7.Start)
point_14 = Point(end_points_8.End)
curve_middle_7 = CurveMiddle(Curve=shatter)
line_3 = Line(StartPoint=list_item_17.Item1, EndPoint=list_item_17.Item)
python_3_script_5 = Python3Script(x=list_item_20, y=amplitude_3)  # -> out, a; inputs x: String, y: Vector3d
# ---------- python_3_script_5: Python ----------
a = None

if x:
    a = -y if x == "End" else y
# ---------- end python_3_script_5 ----------
discontinuity_9 = Discontinuity(Curve=simplify(graft(list_item_18)), Level=1)  # -> Points, Parameters
list_item_21 = ListItem(List=partition_list_3, Index=0, Wrap=True)  # -> Item, Item1
line_4 = Line(line)
cluster_3 = Cluster_6(curve=line)  # -> vector_2, point
list_item_22 = ListItem(List=panel_4, Index=closest_point_2.CPIndex, Wrap=True)
vector_2pt_5 = Vector2Pt(PointA=point_13, PointB=point_14, Unitize=False)  # -> Vector, Length
python_3_script_6 = Python3Script(x=list_item_22, y=amplitude_7)  # -> out, a; inputs x: String, y: Vector3d; same code as python_3_script_5
cluster_4 = Cluster_4(line=line_4)
deconstruct_7 = Deconstruct(Point=curve_middle_7)  # -> XComponent, YComponent, ZComponent
evaluate_curve_3 = EvaluateCurve(Curve=reparameterize(line_3), Parameter=0.5)  # -> Point, Tangent, Angle
line_5 = Line(line_2)
cluster_5 = Cluster_5(geometry=point_10, motion=python_3_script_5.a)
tree_statistics_4 = TreeStatistics(Tree=cluster_5)  # -> Paths, simplify(graft(Length)), Count
line_6 = Line(StartPoint=point_10, EndPoint=cluster_5)
cluster_6 = Cluster_6(curve=line_2)  # -> vector_2, point
extend_curve = ExtendCurve(Curve=line_3, Type=0, Start="2.5", End="2.5")
curve_middle_8 = CurveMiddle(Curve=shatter_2)
line_7 = Line(StartPoint=list_item_21.Item1, EndPoint=list_item_21.Item)
tree_statistics_5 = TreeStatistics(Tree=cluster_4)  # -> Paths, simplify(graft(Length)), Count
cluster_7 = Cluster_5(geometry=point_11, motion=python_3_script_6.a)
tree_statistics_6 = TreeStatistics(Tree=cluster_7)  # -> Paths, simplify(graft(Length)), Count
shatter_3 = Shatter(Curve=simplify(graft(list_item_18)), Parameters=discontinuity_9.Parameters)  # -> simplify(Segments)
line_8 = Line(StartPoint=point_11, EndPoint=cluster_7)
cluster_8 = Cluster_4(line=line_5)
merge_10 = Merge(Data1=cluster_7, Data2=cluster_8)
match_tree = MatchTree(Tree=addition, Guide=merge_10)
amplitude_8 = Amplitude(Vector=match_tree, Amplitude="55")
move_3 = Move(Geometry=merge_10, Motion=amplitude_8)  # -> Geometry, Transform
amplitude_9 = Amplitude(Vector=vector_2pt_5.Vector, Amplitude=55)
cluster_9 = Cluster_6(curve=line_6)  # -> vector_2, point
tree_branch_3 = TreeBranch(Tree=cluster_9.vector_2, Path=tree_statistics_4.Paths, MaintainPaths=True)
sort_list_5 = SortList(Keys=deconstruct_7.ZComponent, ValuesValuesA=shatter)  # -> Keys, ValuesValuesA
list_length_5 = ListLength(List=point_8)
end_points_9 = EndPoints(Curve=extend_curve)  # -> Start, End
tree_statistics_7 = TreeStatistics(Tree=cluster_8)  # -> Paths, simplify(graft(Length)), Count
deconstruct_8 = Deconstruct(Point=curve_middle_8)  # -> XComponent, YComponent, ZComponent
evaluate_curve_4 = EvaluateCurve(Curve=reparameterize(line_7), Parameter=0.5)  # -> Point, Tangent, Angle
repeat_data = RepeatData(Data=tree_branch_3, Length=tree_statistics_4.Length)  # -> simplify(Data)
extend_curve_2 = ExtendCurve(Curve=line_7, Type=0, Start="2.5", End="2.5")
unit_z_7 = UnitZ(Factor=1)
tree_branch_4 = TreeBranch(Tree=cluster_3.vector_2, Path=tree_statistics_5.Paths, MaintainPaths=True)
cluster_10 = Cluster_6(curve=line_8)  # -> vector_2, point
tree_branch_5 = TreeBranch(Tree=cluster_10.vector_2, Path=tree_statistics_6.Paths, MaintainPaths=True)
vector_display_ex_9 = VectorDisplayEx(Point=cluster_3.point, Vector=cluster_3.vector_2, Colour=RGB(0, 0, 0), Width=2)
panel_5 = Panel("""1
2""")
equality_3 = Equality(FirstNumber=list_length_5, SecondNumber=1)  # -> Equality, Inequality
cull_pattern_11 = CullPattern(List=point_8, CullPattern=equality_3.Equality)
clean_tree_5 = CleanTree(RemoveNulls=True, RemoveInvalid=True, RemoveEmpty=True, Tree=cull_pattern_11)
tree_statistics_8 = TreeStatistics(Tree=clean_tree_5)  # -> Paths, Length, Count
match_tree_2 = MatchTree(Tree=repeat_data, Guide=tree_branch_3)
repeat_data_2 = RepeatData(Data=tree_branch_5, Length=tree_statistics_6.Length)  # -> simplify(Data)
merge_11 = Merge(Data1=end_points_9.Start, Data2=end_points_9.End)
sort_list_6 = SortList(Keys=deconstruct_8.ZComponent, ValuesValuesA=shatter_2)  # -> Keys, ValuesValuesA
list_item_23 = ListItem(List=sort_list_5.ValuesValuesA, Index=panel_5, Wrap=True)
tree_branch_6 = TreeBranch(Tree=point_8, Path=tree_statistics_8.Paths, MaintainPaths=True)
repeat_data_3 = RepeatData(Data=tree_branch_4, Length=tree_statistics_5.Length)  # -> simplify(Data)
vector_display_ex_10 = VectorDisplayEx(Point=cluster_9.point, Vector=cluster_9.vector_2, Colour=RGB(0, 0, 0), Width=2)
tree_branch_7 = TreeBranch(Tree=cluster_6.vector_2, Path=tree_statistics_7.Paths, MaintainPaths=True)
move_4 = Move(Geometry=cluster_5, Motion=match_tree_2)  # -> Geometry, Transform
end_points_10 = EndPoints(Curve=extend_curve_2)  # -> Start, End
amplitude_10 = Amplitude(Vector=cluster_10.vector_2, Amplitude=1000)
vector_display_ex_11 = VectorDisplayEx(Point=cluster_6.point, Vector=cluster_6.vector_2, Colour=RGB(0, 0, 0), Width=2)
unit_z_8 = UnitZ(Factor=1)
match_tree_3 = MatchTree(Tree=repeat_data_2, Guide=tree_branch_5)
rotate_5 = Rotate(Vector=evaluate_curve_3.Tangent, Axis=unit_z_7, Angle=1.570796327)
match_tree_4 = MatchTree(Tree=repeat_data_3, Guide=tree_branch_4)
move_5 = Move(Geometry=cluster_4, Motion=match_tree_4)  # -> Geometry, Transform
partition_list_4 = PartitionList(List=flatten(amplitude_9), Size=2)  # -> simplify(Chunks)
repeat_data_4 = RepeatData(Data=tree_branch_7, Length=tree_statistics_7.Length)  # -> simplify(Data)
panel_6 = Panel("""1
2""")
move_6 = Move(Geometry=cluster_7, Motion=match_tree_3)  # -> Geometry, Transform
list_length_6 = ListLength(List=merge_11)
vector_display_ex_12 = VectorDisplayEx(Point=tree_branch_6, Vector=amplitude_2, Colour=RGB(0, 0, 0), Width=2)
merge_12 = Merge(Data1=end_points_10.Start, Data2=end_points_10.End)
list_item_24 = ListItem(List=sort_list_6.ValuesValuesA, Index=panel_6, Wrap=True)
cull_pattern_12 = CullPattern(List=point_8, CullPattern=invert(equality_3.Equality))
merge_13 = Merge(Data1=cluster_4, Data2=cluster_5)

# ---- group: CullPointsByTolerance
python_3_script_7 = Python3Script(pts=flatten(merge_11), tol="1")  # -> out, unique_pts, index_map; inputs pts: list of Point3d, tol: Double
# ---------- python_3_script_7: Python ----------
"""
Name: CullPointsByTolerance
Written by: Erik Lima Müller
Date: 2025/06/19

Description ────────────────────────────────────────────────────────────
Culls duplicate points within a specified tolerance, returning the unique points
and a map of which original indices were culled (and to which kept point they map).

Inputs ────────────────────────────────────────────────────────────────
    pts      : list of Rhino.Geometry.Point3d
    tol      : float

Outputs ───────────────────────────────────────────────────────────────
    unique_pts : list of Rhino.Geometry.Point3d
    index_map  : dict[int, int]   # maps removed point index -> index in unique_pts
"""

import Rhino.Geometry as rg

def cull_duplicates_by_tolerance(pts, tol):
    """
    Parameters
    ----------
    pts : list of rg.Point3d
        Input list of points to be filtered.
    tol : float
        Distance tolerance for considering points as duplicates.

    Returns
    -------
    unique_pts : list of rg.Point3d
        Points after removing duplicates.
    index_map : dict[int, int]
        Mapping from original indices of removed points to the index of the
        kept point they were considered duplicates of.
    """
    unique_pts = []
    index_map = {}
    
    for i, p in enumerate(pts):
        found = False
        for j, q in enumerate(unique_pts):
            if p.DistanceTo(q) <= tol:
                # p is a duplicate of unique_pts[j]
                index_map[i] = j
                found = True
                break
        if not found:
            # p is unique so far
            unique_pts.append(p)
    
    return unique_pts, index_map

# Example usage in a GhPython component:
# Inputs:
#   pts (List[Point3d]) | List of points
#   tol (float)         | Cull tolerance
#
# Outputs:
#   unique_pts          | CullPointsByTolerance: unique points list
#   index_map           | CullPointsByTolerance: dict of removed indices

if __name__ == "__main__":
    # In GhPython, replace the following with the component inputs:
    # pts = x
    # tol = y
    unique_pts, index_map = cull_duplicates_by_tolerance(pts, tol)

    # Assign to component outputs:
    a = unique_pts
    b = index_map
# ---------- end python_3_script_7 ----------

# ----
unit_z_9 = UnitZ(Factor="100")
match_tree_5 = MatchTree(Tree=repeat_data_4, Guide=tree_branch_7)
move_7 = Move(Geometry=cluster_8, Motion=match_tree_5)  # -> Geometry, Transform

# ---- group: Ends of run (shadowgap)
point_15 = Point(move_4.Geometry)

# ---- group: Centers of run (shadowgap)
D_3 = Point(move_5.Geometry)

# ----
amplitude_11 = Amplitude(Vector=rotate_5, Amplitude="55")
vector_display_ex_13 = VectorDisplayEx(Point=cluster_10.point, Vector=amplitude_10, Colour=RGB(0, 0, 0), Width=2)
rotate_6 = Rotate(Vector=evaluate_curve_4.Tangent, Axis=unit_z_8, Angle=1.570796327)
tree_statistics_9 = TreeStatistics(Tree=partition_list_4)  # -> Paths, Length, Count
list_length_7 = ListLength(List=merge_12)
clean_tree_6 = CleanTree(RemoveNulls=True, RemoveInvalid=True, RemoveEmpty=True, Tree=cull_pattern_12)
merge_14 = Merge(Data1=point_15, Data2=D_3)  # -> flatten(Result)

# ---- group: Ends of run (shadowgap)
point_16 = Point(move_6.Geometry)

# ---- group: Centers of run (shadowgap)
D_4 = Point(move_7.Geometry)

# ----
repeat_data_5 = RepeatData(Data=amplitude_11, Length=list_length_6)  # -> simplify(flatten(Data))

# ---- group: CullPointsByTolerance
python_3_script_8 = Python3Script(pts=flatten(merge_12), tol="1")  # -> out, unique_pts, index_map; inputs pts: list of Point3d, tol: Double; same code as python_3_script_7

# ----
unit_z_10 = UnitZ(Factor="100")
colour_swatch = ColourSwatch(SwatchColor=RGB(255, 255, 0))
unit_z_11 = UnitZ(Factor=1)
amplitude_12 = Amplitude(Vector=rotate_6, Amplitude="55")
merge_15 = Merge(Data1=point_16, Data2=D_4)  # -> flatten(Result)
cull_index = CullIndex(List=repeat_data_5, Indices=python_3_script_7.index_map, Wrap=True)
polyline = PolyLine(Vertices=merge_14, Closed=False)
tree_statistics_10 = TreeStatistics(Tree=clean_tree_6)  # -> Paths, Length, Count
tree_branch_8 = TreeBranch(Tree=point_8, Path=tree_statistics_10.Paths, MaintainPaths=True)
replace_paths_2 = ReplacePaths(Data=partition_list_4, Search=tree_statistics_9.Paths, Replace=tree_statistics_10.Paths)
colour_swatch_2 = ColourSwatch(SwatchColor=RGB(255, 255, 0))
dot_display = DotDisplay(Point=merge_14, Colour=colour_swatch, Size=10)
merge_16 = Merge(Data1=cluster_5, Data2=cluster_4)
repeat_data_6 = RepeatData(Data=amplitude_12, Length=list_length_7)  # -> simplify(flatten(Data))
dispatch_2 = Dispatch(List=replace_paths_2, DispatchPattern=[True, False])  # -> ListA, ListB
polyline_2 = PolyLine(Vertices=merge_15, Closed=False)
vector = Vector(cull_index)
point_17 = Point(python_3_script_7.unique_pts)
explode = Explode(Curve=polyline, Recursive=True)  # -> Segments, Vertices
dot_display_2 = DotDisplay(Point=merge_15, Colour=colour_swatch_2, Size=10)
cull_index_2 = CullIndex(List=repeat_data_6, Indices=python_3_script_8.index_map, Wrap=True)
length = Length(Curve=explode.Segments)
smaller_than = SmallerThan(FirstNumber=length, SecondNumber="500")  # -> SmallerThan, OrEqualTo
reverse_2 = Reverse(Vector=dispatch_2.ListA)
vector_display_ex_14 = VectorDisplayEx(Point=point_17, Vector=vector, Colour=RGB(0, 0, 0), Width=2)
explode_2 = Explode(Curve=polyline_2, Recursive=True)  # -> Segments, Vertices
move_8 = Move(Geometry=point_17, Motion=vector)  # -> Geometry, Transform
length_2 = Length(Curve=explode_2.Segments)
smaller_than_2 = SmallerThan(FirstNumber=length_2, SecondNumber="500")  # -> SmallerThan, OrEqualTo
vector_2 = Vector(cull_index_2)
point_18 = Point(python_3_script_8.unique_pts)
colour_swatch_3 = ColourSwatch(SwatchColor=RGB(0, 0, 0))
negative = Negative(Value="150")
reverse_3 = Reverse(Vector=vector_2)
cull_pattern_13 = CullPattern(List=explode.Segments, CullPattern=invert(smaller_than.SmallerThan))
dash_pattern = DashPattern(Curve=cull_pattern_13, Pattern="10, 10")  # -> Dashes, Gaps
merge_17 = Merge(Data1=reverse_2, Data2=dispatch_2.ListB)
rotate_7 = Rotate(Vector=merge_17, Axis=unit_z_11, Angle=".5*pi")
merge_18 = Merge(Data1=vector_2pt_3.Vector, Data2=rotate_7)
list_item_25 = ListItem(List=merge_18, Index=0, Wrap=True)  # -> Item, Item1
addition_3 = Addition(A=list_item_25.Item, B=list_item_25.Item1)
match_tree_6 = MatchTree(Tree=addition_3, Guide=merge_16)
amplitude_13 = Amplitude(Vector=merge_18, Amplitude="55")
vector_display_ex_15 = VectorDisplayEx(Point=tree_branch_8, Vector=rotate_7, Colour=RGB(0, 0, 0), Width=2)
move_9 = Move(Geometry=merge_16, Motion=amplitude_13)  # -> Geometry, Transform
move_10 = Move(Geometry=point_18, Motion=reverse_3)  # -> Geometry, Transform
sort_along_curve_13 = SortAlongCurve(Points=move_8.Geometry, Curve=guidecrv)  # -> Points, Indices
move_11 = Move(Geometry=sort_along_curve_13.Points, Motion=unit_z_9)  # -> Geometry, Transform
negative_2 = Negative(Value="152.5")
cull_pattern_14 = CullPattern(List=explode_2.Segments, CullPattern=invert(smaller_than_2.SmallerThan))
dash_pattern_2 = DashPattern(Curve=cull_pattern_14, Pattern="10, 10")  # -> Dashes, Gaps
vector_display_ex_16 = VectorDisplayEx(Point=point_18, Vector=reverse_3, Colour=RGB(0, 0, 0), Width=2)
extend_curve_3 = ExtendCurve(Curve=cull_pattern_13, Type=0, Start=negative, End=negative)
end_points_11 = EndPoints(Curve=extend_curve_3)  # -> Start, End
surface_closest_point_3 = SurfaceClosestPoint(Point=end_points_11.Start, Surface=flatten(surface_7))  # -> Point, UVPoint, Distance
surface_closest_point_4 = SurfaceClosestPoint(Point=end_points_11.Start, Surface=flatten(surface_7))  # -> Point, UVPoint, Distance
sort_along_curve_14 = SortAlongCurve(Points=move_10.Geometry, Curve=guidecrv_2)  # -> Points, Indices
move_12 = Move(Geometry=sort_along_curve_14.Points, Motion=unit_z_10)  # -> Geometry, Transform
panel_7 = Panel("""204,255,0
0,255,255
70,160,255
72,0,255
255,0,210
115,255,55
0,255,170
210,0,255
200,150,255
255,0,120""")
cluster_11 = Cluster()
extend_curve_4 = ExtendCurve(Curve=cull_pattern_14, Type=0, Start=negative_2, End=negative_2)
end_points_12 = EndPoints(Curve=extend_curve_4)  # -> Start, End
surface_closest_point_5 = SurfaceClosestPoint(Point=end_points_12.Start, Surface=flatten(surface_8))  # -> Point, UVPoint, Distance
surface_closest_point_6 = SurfaceClosestPoint(Point=end_points_12.Start, Surface=flatten(surface_8))  # -> Point, UVPoint, Distance
polyline_3 = PolyLine(Vertices=move_11.Geometry, Closed=False)
evaluate_surface_3 = EvaluateSurface(Surface=flatten(surface_7), Point=surface_closest_point_3.UVPoint)  # -> Point, Normal, UDirection, VDirection, Frame
evaluate_surface_4 = EvaluateSurface(Surface=flatten(surface_7), Point=surface_closest_point_4.UVPoint)  # -> Point, Normal, UDirection, VDirection, Frame
panel_8 = Panel("""204,255,0
0,255,255
70,160,255
72,0,255
255,0,210
115,255,55
0,255,170
210,0,255
200,150,255
255,0,120""")
cluster_12 = Cluster()
merge_19 = Merge(Data1=move_9.Geometry, Data2=move_3.Transform)
evaluate_surface_5 = EvaluateSurface(Surface=flatten(surface_8), Point=surface_closest_point_5.UVPoint)  # -> Point, Normal, UDirection, VDirection, Frame
evaluate_surface_6 = EvaluateSurface(Surface=flatten(surface_8), Point=surface_closest_point_6.UVPoint)  # -> Point, Normal, UDirection, VDirection, Frame
polyline_4 = PolyLine(Vertices=move_12.Geometry, Closed=False)
construct_plane = ConstructPlane(Origin=end_points_11.End, XAxis=unit_z_2, YAxis=evaluate_surface_3.Normal)
orient = Orient(Geometry=cluster_11, Source=PlaneXY(0, 0, 0), Target=construct_plane)  # -> simplify(graft(Geometry)), Transform
construct_plane_2 = ConstructPlane(Origin=end_points_11.Start, XAxis=unit_z_2, YAxis=evaluate_surface_4.Normal)
orient_2 = Orient(Geometry=cluster_11, Source=PlaneXY(0, 0, 0), Target=construct_plane_2)  # -> simplify(graft(Geometry)), Transform
construct_plane_3 = ConstructPlane(Origin=end_points_12.End, XAxis=unit_z_3, YAxis=evaluate_surface_5.Normal)
orient_3 = Orient(Geometry=cluster_12, Source=PlaneXY(0, 0, 0), Target=construct_plane_3)  # -> simplify(graft(Geometry)), Transform
construct_plane_4 = ConstructPlane(Origin=end_points_12.Start, XAxis=unit_z_3, YAxis=evaluate_surface_6.Normal)
orient_4 = Orient(Geometry=cluster_12, Source=PlaneXY(0, 0, 0), Target=construct_plane_4)  # -> simplify(graft(Geometry)), Transform
# Neon Chartreuse
# Electric Cyan
# Azure Flash
# Indigo Blaze
# Vivid Magenta
# Laser Lime
# Aqua Glow
# Ultraviolet Burst
# Radiant Lavender
# Electric Rose
number_slider = Slider(2, range=0..9)
explode_3 = Explode(Curve=polyline_4, Recursive=True)  # -> Segments, Vertices
explode_4 = Explode(Curve=polyline_3, Recursive=True)  # -> Segments, Vertices
merge_20 = Merge(Data1=orient.Geometry, Data2=orient_2.Geometry)
length_3 = Length(Curve=explode_3.Segments)
# Neon Chartreuse
# Electric Cyan
# Azure Flash
# Indigo Blaze
# Vivid Magenta
# Laser Lime
# Aqua Glow
# Ultraviolet Burst
# Radiant Lavender
# Electric Rose
number_slider_2 = Slider(2, range=0..9)
loft_options = LoftOptions(Closed=False, Adjust=False, Rebuild=0, Refit=0, Type="3")
merge_21 = Merge(Data1=orient_3.Geometry, Data2=orient_4.Geometry)
loft = Loft(Curves=merge_20, Options=loft_options)  # -> flatten(Loft)
smaller_than_3 = SmallerThan(FirstNumber=length_3, SecondNumber="375")  # -> SmallerThan, OrEqualTo
door_opening_index = Panel("44")
loft_options_2 = LoftOptions(Closed=False, Adjust=False, Rebuild=0, Refit=0, Type="3")
list_item_26 = ListItem(List=panel_7, Index=number_slider, Wrap=True)
list_item_27 = ListItem(List=panel_7, Index=Slider(6, range=0..9), Wrap=True)
list_item_28 = ListItem(List=panel_7, Index=Slider(3, range=0..9), Wrap=True)
cull_pattern_15 = CullPattern(List=explode_3.Segments, CullPattern=invert(smaller_than_3.SmallerThan))
loft_2 = Loft(Curves=merge_21, Options=loft_options_2)  # -> flatten(Loft)
cap_holes = CapHoles(Brep=loft)
colour = Colour(list_item_28)
list_item_29 = ListItem(List=panel_8, Index=number_slider_2, Wrap=True)
list_item_30 = ListItem(List=panel_8, Index=Slider(6, range=0..9), Wrap=True)
list_item_31 = ListItem(List=panel_8, Index=Slider(3, range=0..9), Wrap=True)
deconstruct_brep = DeconstructBrep(Brep=cap_holes)  # -> Faces, Edges, Vertices
cull_index_3 = CullIndex(List=explode_4.Segments, Indices=door_opening_index, Wrap=True)
length_4 = Length(Curve=cull_index_3)
colour_2 = Colour(list_item_27)
colour_3 = Colour(list_item_26)
cap_holes_2 = CapHoles(Brep=loft_2)

# ---- group: projector edges (sorted)
curve_6 = Curve(curve_4)

# ----
dash_pattern_3 = DashPattern(Curve=cull_pattern_15, Pattern="10, 10")  # -> Dashes, Gaps
colour_4 = Colour(list_item_31)
deconstruct_brep_2 = DeconstructBrep(Brep=cap_holes_2)  # -> Faces, Edges, Vertices
list_item_32 = ListItem(List=deconstruct_brep.Faces, Index=1, Wrap=True)
evaluate_curve_5 = EvaluateCurve(Curve=reparameterize(curve_6), Parameter=0.5)  # -> Point, Tangent, Angle
colour_5 = Colour(list_item_30)
colour_6 = Colour(list_item_29)
smaller_than_4 = SmallerThan(FirstNumber=length_4, SecondNumber="375")  # -> SmallerThan, OrEqualTo
extend_curve_5 = ExtendCurve(Curve=cull_pattern_15, Type=0, Start="-105", End="-105")
unit_z_12 = UnitZ(Factor=1)
cull_pattern_16 = CullPattern(List=cull_index_3, CullPattern=invert(smaller_than_4.SmallerThan))
list_item_33 = ListItem(List=deconstruct_brep_2.Faces, Index=1, Wrap=True)
plane_3 = Plane(flatten(list_item_32))
project = Project(Geometry=end_points_11.End, Plane=plane_3)  # -> Geometry, Transform
project_2 = Project(Geometry=end_points_11.Start, Plane=plane_3)  # -> Geometry, Transform
end_points_13 = EndPoints(Curve=extend_curve_5)  # -> Start, End
plane_4 = Plane(flatten(list_item_33))
project_3 = Project(Geometry=end_points_12.End, Plane=plane_4)  # -> Geometry, Transform
project_4 = Project(Geometry=end_points_12.Start, Plane=plane_4)  # -> Geometry, Transform
plane_origin = PlaneOrigin(Base=plane_3, Origin=project.Geometry)
plane_origin_2 = PlaneOrigin(Base=plane_3, Origin=project_2.Geometry)
dash_pattern_4 = DashPattern(Curve=cull_pattern_16, Pattern="10, 10")  # -> Dashes, Gaps
curve_closest_point_4 = CurveClosestPoint(Point=end_points_13.Start, Curve=extend_curve_5)  # -> Point, Parameter, Distance
extend_curve_6 = ExtendCurve(Curve=curve_6, Type=0, Start="20.5", End="20.5")
curve_closest_point_5 = CurveClosestPoint(Point=end_points_13.End, Curve=extend_curve_5)  # -> Point, Parameter, Distance
rotate_8 = Rotate(Vector=evaluate_curve_5.Tangent, Axis=unit_z_12, Angle=1.570796327)
amplitude_14 = Amplitude(Vector=rotate_8, Amplitude=300)
extend_curve_7 = ExtendCurve(Curve=cull_pattern_16, Type=0, Start="-85", End="-85")
plane_origin_3 = PlaneOrigin(Base=plane_4, Origin=project_3.Geometry)
plane_origin_4 = PlaneOrigin(Base=plane_4, Origin=project_4.Geometry)
unit_z_13 = UnitZ(Factor="-(20.5+30)")
extrude = Extrude(Base=extend_curve_6, Direction=expr("-x", amplitude_14))
evaluate_curve_6 = EvaluateCurve(Curve=extend_curve_5, Parameter=curve_closest_point_4.Parameter)  # -> Point, Tangent, Angle
move_13 = Move(Geometry=plane_origin_2, Motion=unit_z_13)  # -> Geometry, Transform
evaluate_curve_7 = EvaluateCurve(Curve=extend_curve_5, Parameter=curve_closest_point_5.Parameter)  # -> Point, Tangent, Angle
move_14 = Move(Geometry=plane_origin, Motion=unit_z_13)  # -> Geometry, Transform
deconstruct_plane_3 = DeconstructPlane(Plane=move_14.Geometry)  # -> Origin, XAxis, YAxis, ZAxis
unit_z_14 = UnitZ(Factor="-(20.5+30)")
end_points_14 = EndPoints(Curve=extend_curve_7)  # -> Start, End
unit_z_15 = UnitZ(Factor=1)
move_15 = Move(Geometry=plane_origin_4, Motion=unit_z_14)  # -> Geometry, Transform
deconstruct_plane_4 = DeconstructPlane(Plane=move_13.Geometry)  # -> Origin, XAxis, YAxis, ZAxis
move_16 = Move(Geometry=plane_origin_3, Motion=unit_z_14)  # -> Geometry, Transform
deconstruct_plane_5 = DeconstructPlane(Plane=move_16.Geometry)  # -> Origin, XAxis, YAxis, ZAxis
unit_z_16 = UnitZ(Factor=1)
curve_closest_point_6 = CurveClosestPoint(Point=end_points_14.Start, Curve=extend_curve_7)  # -> Point, Parameter, Distance
curve_closest_point_7 = CurveClosestPoint(Point=end_points_14.End, Curve=extend_curve_7)  # -> Point, Parameter, Distance
amplitude_15 = Amplitude(Vector=deconstruct_plane_3.XAxis, Amplitude="20.5")

# ---- group: panel edges
curve_7 = Curve(shatter_3)

# ----
rotate_9 = Rotate(Vector=evaluate_curve_7.Tangent, Axis=unit_z_15, Angle=1.570796327)
deconstruct_plane_6 = DeconstructPlane(Plane=move_15.Geometry)  # -> Origin, XAxis, YAxis, ZAxis
move_17 = Move(Geometry=move_14.Geometry, Motion=amplitude_15)  # -> Geometry, Transform
evaluate_curve_8 = EvaluateCurve(Curve=extend_curve_7, Parameter=curve_closest_point_6.Parameter)  # -> Point, Tangent, Angle
amplitude_16 = Amplitude(Vector=deconstruct_plane_5.XAxis, Amplitude="20.5")
amplitude_17 = Amplitude(Vector=deconstruct_plane_4.XAxis, Amplitude="-20.5")
evaluate_curve_9 = EvaluateCurve(Curve=extend_curve_7, Parameter=curve_closest_point_7.Parameter)  # -> Point, Tangent, Angle
move_18 = Move(Geometry=move_16.Geometry, Motion=amplitude_16)  # -> Geometry, Transform
panel_side_edges = Curve(flatten(list_item_23))
construct_plane_5 = ConstructPlane(Origin=evaluate_curve_7.Point, XAxis=expr("-x", evaluate_curve_7.Tangent), YAxis=expr("-x", rotate_9))  # -> graft(Plane)
point_19 = Point(flatten(construct_plane_5))
move_19 = Move(Geometry=move_13.Geometry, Motion=amplitude_17)  # -> Geometry, Transform
unit_z_17 = UnitZ(Factor=1)
rotate_10 = Rotate(Vector=evaluate_curve_6.Tangent, Axis=unit_z_16, Angle=1.570796327)
construct_plane_6 = ConstructPlane(Origin=evaluate_curve_6.Point, XAxis=evaluate_curve_6.Tangent, YAxis=expr("-x", rotate_10))  # -> graft(Plane)
point_20 = Point(flatten(construct_plane_6))
cluster_13 = Cluster_7(curve=curve_7, point_left=point_19, edges=curve_7, point_right=point_20)  # -> edges_left_2, edges_right_2
plane_5 = Plane(move_19.Geometry)
construct_plane_7 = ConstructPlane(Origin=evaluate_curve_7.Point, XAxis=evaluate_curve_7.Tangent, YAxis=rotate_9)
amplitude_18 = Amplitude(Vector=deconstruct_plane_6.XAxis, Amplitude="-20.5")
plane_6 = Plane(move_17.Geometry)

# ---- group: projector edges top (sorted)
curve_8 = Curve(curve_3)

# ----
unit_z_18 = UnitZ(Factor=1)
move_20 = Move(Geometry=move_15.Geometry, Motion=amplitude_18)  # -> Geometry, Transform
plane_7 = Plane(move_20.Geometry)
deconstruct_plane_7 = DeconstructPlane(Plane=plane_6)  # -> Origin, XAxis, YAxis, ZAxis
deconstruct_plane_8 = DeconstructPlane(Plane=plane_5)  # -> Origin, XAxis, YAxis, ZAxis
rotate_11 = Rotate(Vector=evaluate_curve_9.Tangent, Axis=unit_z_17, Angle=1.570796327)
plane_8 = Plane(move_18.Geometry)
evaluate_curve_10 = EvaluateCurve(Curve=reparameterize(curve_8), Parameter=0.5)  # -> Point, Tangent, Angle
unit_z_19 = UnitZ(Factor=1)
merge_22 = Merge(Data1=construct_plane_6, Data2=construct_plane_7)

# ---- group: L
plane_9 = Plane(flatten(construct_plane_5))
curve_9 = Curve(flatten(cluster_13.edges_left_2))

# ---- group: R
curve_10 = Curve(flatten(cluster_13.edges_right_2))
plane_10 = Plane(flatten(construct_plane_6))

# ----
merge_23 = Merge(Data1=construct_plane_6, Data2=construct_plane_5)  # -> simplify(Result)
brep = Brep(extrude)
rotate_12 = Rotate(Vector=evaluate_curve_8.Tangent, Axis=unit_z_18, Angle=1.570796327)
construct_plane_8 = ConstructPlane(Origin=evaluate_curve_9.Point, XAxis=expr("-x", evaluate_curve_9.Tangent), YAxis=rotate_11)
construct_plane_9 = ConstructPlane(Origin=evaluate_curve_8.Point, XAxis=evaluate_curve_8.Tangent, YAxis=rotate_12)
deconstruct_plane_9 = DeconstructPlane(Plane=plane_8)  # -> Origin, XAxis, YAxis, ZAxis
deconstruct_plane_10 = DeconstructPlane(Plane=plane_7)  # -> Origin, XAxis, YAxis, ZAxis
construct_plane_10 = ConstructPlane(Origin=plane_6, XAxis=deconstruct_plane_7.ZAxis, YAxis=deconstruct_plane_7.XAxis)
construct_plane_11 = ConstructPlane(Origin=plane_5, XAxis=deconstruct_plane_8.ZAxis, YAxis=deconstruct_plane_8.XAxis)
construct_plane_12 = ConstructPlane(Origin=evaluate_curve_9.Point, XAxis=evaluate_curve_9.Tangent, YAxis=rotate_11)
rotate_13 = Rotate(Vector=evaluate_curve_10.Tangent, Axis=unit_z_19, Angle=1.570796327)
point_21 = Point(plane_10)
point_22 = Point(plane_9)
merge_24 = Merge(Data1=construct_plane_9, Data2=construct_plane_8)
python_3_script_9 = Python3Script(crvs=panel_side_edges, pts=merge_24)  # -> out, simplify(graft(closest_crvs)); inputs crvs: list of Curve, pts: list of Point3d
# ---------- python_3_script_9: Python ----------
"""
Name: ClosestCurvesToPoints
Written by: Erik Lima Müller
Date: 2025/06/19

Description ────────────────────────────────────────────────────────────
Finds, for each point in the input list, the curve in the input list that is closest to that point.

Inputs ────────────────────────────────────────────────────────────────
    crvs : list[Rhino.Geometry.Curve]
    pts  : list[Rhino.Geometry.Point3d]

Outputs ───────────────────────────────────────────────────────────────
    closest_crvs : list[Rhino.Geometry.Curve]
"""

import Rhino.Geometry as rg
import math

def get_closest_curves(crvs, pts):
    """
    For each point in pts, find the curve in crvs with the minimum distance to that point.
    Returns a list of curves in the same order as pts.
    """
    closest = []
    if not crvs or not pts:
        return closest

    for p in pts:
        min_dist = math.inf
        nearest_curve = None
        for c in crvs:
            # Find parameter t on curve closest to point p
            rc, t = c.ClosestPoint(p)
            if not rc:
                continue
            # Evaluate the point on the curve at parameter t
            pt_on_curve = c.PointAt(t)
            d = p.DistanceTo(pt_on_curve)
            if d < min_dist:
                min_dist = d
                nearest_curve = c
        closest.append(nearest_curve)
    return closest

# Run the function and assign to output variable
closest_crvs = get_closest_curves(crvs, pts)
# ---------- end python_3_script_9 ----------
construct_plane_13 = ConstructPlane(Origin=plane_8, XAxis=expr("-x", deconstruct_plane_9.ZAxis), YAxis=deconstruct_plane_9.XAxis)
construct_plane_14 = ConstructPlane(Origin=plane_7, XAxis=expr("-x", deconstruct_plane_10.ZAxis), YAxis=deconstruct_plane_10.XAxis)
plane_11 = Plane(construct_plane_11)
merge_25 = Merge(Data1=construct_plane_9, Data2=construct_plane_12)
plane_12 = Plane(construct_plane_10)
python_3_script_10 = Python3Script(panelEdges=curve_9, edgeBreps=brep, unistrutPts=point_22)  # -> out, projectionLines; inputs panelEdges: list of Curve, edgeBreps: list of Brep, unistrutPts: list of Point3d
# ---------- python_3_script_10: Python ----------
""" Name: ExtendPointsToPanelLines
    Written by: Erik Lima Müller
    Date: 2025/06/13

Description ────────────────────────────────────────────────────────────
Create +Z SDL lines trimmed by breps; length = panelEdge length − 400.

Inputs ────────────────────────────────────────────────────────────────
    edgeBreps   : List[Brep]                 (List)[Brep]
    unistrutPts : DataTree/List[Point3d]     (DataTree/List)[Point3d]
    panelEdges  : List[Curve]                (List)[Curve]

Outputs ───────────────────────────────────────────────────────────────
    projectionLines : DataTree[Line]         (DataTree)[Line]
"""

import Rhino.Geometry as rg
import scriptcontext as sc
from Grasshopper import DataTree
from Grasshopper.Kernel.Data import GH_Path

# ────────────────────────────────────────────────────────────────────
def iterate_points_with_paths(pts):
    """Yield (point, path, flat_index) preserving the original tree."""
    counter = 0
    if isinstance(pts, DataTree):
        for b in range(pts.BranchCount):
            branch = pts.Branch(b)
            path   = pts.Path(b)
            for p in branch:
                yield p, path, counter
                counter += 1
    else:                                     # plain python list
        for i, p in enumerate(pts):
            yield p, GH_Path(i), i

# ────────────────────────────────────────────────────────────────────
projectionLines = DataTree[rg.Line]()
tol              = sc.doc.ModelAbsoluteTolerance if sc.doc else 0.001
up_vec           = rg.Vector3d(0, 0, 1)

for pt, path, idx in iterate_points_with_paths(unistrutPts):

    # ── target length supplied by matching panelEdge ────────────────
    try:
        target_len = panelEdges[idx].GetLength() - 400.0
    except IndexError:
        target_len = 0.0                        # fallback if list too short
    target_len = max(target_len, 0.0)

    # ── find first brep hit along +Z, if any ────────────────────────
    min_gap = float("+inf")
    for brep in edgeBreps:
        hit = rg.Intersect.Intersection.ProjectPointsToBreps(
                  [brep], [pt], up_vec, tol)
        if hit:
            gap = hit[0].Z - pt.Z
            if 0.0 < gap < min_gap:
                min_gap = gap

    # ── choose final length ─────────────────────────────────────────
    final_len = min(min_gap, target_len) if min_gap < float("+inf") else target_len

    # ── build SDL line and store ────────────────────────────────────
    line = rg.Line(pt, up_vec, final_len)
    projectionLines.Add(line, path)
# ---------- end python_3_script_10 ----------
python_3_script_11 = Python3Script(panelEdges=curve_10, edgeBreps=brep, unistrutPts=point_21)  # -> out, projectionLines; inputs panelEdges: list of Curve, edgeBreps: list of Brep, unistrutPts: list of Point3d; same code as python_3_script_10
extend_curve_8 = ExtendCurve(Curve=curve_8, Type=0, Start="20.5", End="20.5")
amplitude_19 = Amplitude(Vector=rotate_13, Amplitude=300)
plane_13 = Plane(construct_plane_14)
plane_14 = Plane(construct_plane_13)
cluster_14 = Cluster_3()
plane_15 = Plane(merge_24)
construct_domain = ConstructDomain(DomainStart="-20.5", DomainEnd="0")
construct_domain_2 = ConstructDomain(DomainStart="0", DomainEnd="41")
extrude_2 = Extrude(Base=extend_curve_8, Direction=expr("-x", amplitude_19))
orient_5 = Orient(Geometry=cluster_14, Source=PlaneXY(0, 0, 0), Target=plane_11)  # -> simplify(graft(Geometry)), Transform
orient_6 = Orient(Geometry=cluster_14, Source=PlaneXY(0, 0, 0), Target=plane_12)  # -> simplify(graft(Geometry)), Transform
cluster_15 = Cluster_3()
curve_11 = Curve(python_3_script_10.projectionLines)
curve_12 = Curve(python_3_script_11.projectionLines)
deconstruct_9 = Deconstruct(Point=point)  # -> XComponent, YComponent, ZComponent
plane_16 = Plane(merge_23)
orient_7 = Orient(Geometry=cluster_15, Source=PlaneXY(0, 0, 0), Target=plane_13)  # -> simplify(graft(Geometry)), Transform
orient_8 = Orient(Geometry=cluster_15, Source=PlaneXY(0, 0, 0), Target=plane_14)  # -> simplify(graft(Geometry)), Transform
merge_26 = Merge(Data1=curve_12, Data2=curve_11)
deconstruct_plane_11 = DeconstructPlane(Plane=merge_25)  # -> Origin, XAxis, YAxis, ZAxis
brep_2 = Brep(extrude_2)
rectangle = Rectangle(Plane=PlaneXY(0, 0, 0), XSize=construct_domain_2, YSize=construct_domain, Radius=0)  # -> Rectangle, Length
level_01 = Panel("19250")
merge_27 = Merge(Data1=orient_6.Geometry, Data2=orient_5.Geometry)
create_set = CreateSet(List=deconstruct_9.ZComponent)  # -> Set, Map
length_5 = Length(Curve=merge_26)
deconstruct_plane_12 = DeconstructPlane(Plane=merge_22)  # -> Origin, XAxis, YAxis, ZAxis
length_6 = Length(Curve=python_3_script_9.closest_crvs)
cluster_16 = Cluster_8()
orient_9 = Orient(Geometry=rectangle.Rectangle, Source=PlaneXY(0, 0, 0), Target=plane_15)  # -> simplify(graft(Geometry)), Transform
construct_point_2 = ConstructPoint(XCoordinate=0, YCoordinate=0, ZCoordinate=level_01)
construct_plane_15 = ConstructPlane(Origin=deconstruct_plane_11.Origin, XAxis=deconstruct_plane_11.ZAxis, YAxis=deconstruct_plane_11.YAxis)
merge_28 = Merge(Data1=orient_8.Geometry, Data2=orient_7.Geometry)
list_item_34 = ListItem(List=merge_28, Index=0, Wrap=True)  # -> flatten(Item), flatten(Item1)
plane_17 = Plane(list_item_34.Item1)
plane_18 = Plane(list_item_34.Item)
construct_point_3 = ConstructPoint(XCoordinate=0, YCoordinate=0, ZCoordinate=create_set.Set)
unit_z_20 = UnitZ(Factor=length_5)
orient_10 = Orient(Geometry=cluster_16, Source=PlaneXY(0, 0, 0), Target=plane_16)  # -> Geometry, Transform

# ---- group: +Z SDL line: brep hit → gap + 150 mm, no hit → 250 mm total.
python_3_script_12 = Python3Script(edgeBreps=brep_2, unistrutPts=plane_17)  # -> out, projectionLines; inputs edgeBreps: list of Brep, unistrutPts: list of Point3d
# ---------- python_3_script_12: Python ----------
""" Name: ExtendPointsConditionalLength
    Written by: Erik Lima Müller
    Date: 2025/06/13

Description ────────────────────────────────────────────────────────────
+Z SDL line: brep hit → gap + 150 mm, no hit → 250 mm total.

Inputs ────────────────────────────────────────────────────────────────
    edgeBreps   : List[Brep]                 (List)[Brep]
    unistrutPts : DataTree/List[Point3d]     (DataTree/List)[Point3d]

Outputs ───────────────────────────────────────────────────────────────
    projectionLines : DataTree[Line]         (DataTree)[Line]
"""

import Rhino.Geometry as rg
import scriptcontext as sc
from Grasshopper import DataTree
from Grasshopper.Kernel.Data import GH_Path

# ────────────────────────────────────────────────────────────────────
def iterate_points_with_paths(pts):
    """Yield (point, path) pairs while preserving the original tree."""
    if isinstance(pts, DataTree):
        for b in range(pts.BranchCount):
            branch = pts.Branch(b)
            path   = pts.Path(b)
            for p in branch:
                yield p, path
    else:  # plain python list
        for i, p in enumerate(pts):
            yield p, GH_Path(i)

# ────────────────────────────────────────────────────────────────────
projectionLines      = DataTree[rg.Line]()
tol                  = sc.doc.ModelAbsoluteTolerance if sc.doc else 0.001
up_vec               = rg.Vector3d(0, 0, 1)
extra_len_hit        = 150.0   # mm beyond brep hit
extra_len_no_hit     = 250.0   # mm total when no brep is hit

for pt, path in iterate_points_with_paths(unistrutPts):

    # find closest brep hit along +Z
    min_gap = float("+inf")
    for brep in edgeBreps:
        hit = rg.Intersect.Intersection.ProjectPointsToBreps(
                  [brep], [pt], up_vec, tol)
        if hit:
            gap = hit[0].Z - pt.Z
            if 0.0 < gap < min_gap:
                min_gap = gap

    # choose final extension
    if min_gap < float("+inf"):                     # brep collision
        final_len = min_gap + extra_len_hit
    else:                                           # no collision
        final_len = extra_len_no_hit

    # create SDL line and add to tree
    projectionLines.Add(rg.Line(pt, up_vec, final_len), path)
# ---------- end python_3_script_12 ----------
python_3_script_13 = Python3Script(edgeBreps=brep_2, unistrutPts=plane_18)  # -> out, projectionLines; inputs edgeBreps: list of Brep, unistrutPts: list of Point3d; same code as python_3_script_12

# ----
construct_plane_16 = ConstructPlane(Origin=deconstruct_plane_12.Origin, XAxis=deconstruct_plane_12.ZAxis, YAxis=deconstruct_plane_12.YAxis)
subtraction = Subtraction(A=length_6, B="400")

# ---- group: "Shelf" plane
xy_plane_3 = XYPlane(Origin=construct_point_2)

# ----
construct_point_4 = ConstructPoint(XCoordinate=0, YCoordinate=0, ZCoordinate=construct_point_3)
unit_z_21 = UnitZ(Factor="250")
project_5 = Project(Geometry=merge_14, Plane=xy_plane_3)  # -> Geometry, Transform
unit_z_22 = UnitZ(Factor=subtraction)
extrude_3 = Extrude(Base=orient_10.Geometry, Direction=unit_z_20)
merge_29 = Merge(Data1=python_3_script_13.projectionLines, Data2=python_3_script_12.projectionLines)
extrude_4 = Extrude(Base=merge_27, Direction=unit_z_21)

# ---- group: "Shelf" plane
xy_plane_4 = XYPlane(Origin=construct_point_4)

# ----
extrude_5 = Extrude(Base=orient_9.Geometry, Direction=unit_z_22)
sweep1 = Sweep1(Rail=graft(merge_29), Sections=graft(merge_28), Miter=1)

# ---- group: Center of shadowgap projected in "shelf"
point_23 = Point(simplify(graft(project_5.Geometry)))

# ----
cap_holes_3 = CapHoles(Brep=extrude_3)
project_6 = Project(Geometry=merge_15, Plane=xy_plane_4)  # -> Geometry, Transform
cap_holes_4 = CapHoles(Brep=extrude_5)
project_7 = Project(Geometry=plane_15, Plane=xy_plane_3)  # -> Geometry, Transform
cap_holes_5 = CapHoles(Brep=extrude_4)

# ---- group: Center of shadowgap projected in "shelf"
point_24 = Point(simplify(graft(project_6.Geometry)))

# ----
cap_holes_6 = CapHoles(Brep=sweep1)
scale = Panel("0.05")
point_25 = Point([<point referenced from the Rhino model> x30])
project_8 = Project(Geometry=plane_16, Plane=xy_plane_4)  # -> Geometry, Transform
cluster_17 = Cluster_2(number=scale)  # -> dimension_settings, text_settings, leader_settings, arrow_settings, units_settings, tolerance_settings
curve_13 = Curve(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)
scale_2 = Panel("0.05")
sort_along_curve_15 = SortAlongCurve(Points=point_25, Curve=guidecrv)  # -> Points, Indices
point_26 = Point(project_7.Geometry)
point_27 = Point(plane_15)
deconstruct_brep_3 = DeconstructBrep(Brep=cap_holes_5)  # -> Faces, Edges, Vertices
scale_3 = Panel("0.05")
cluster_18 = Cluster_2(number=scale_2)  # -> dimension_settings, text_settings, leader_settings, arrow_settings, units_settings, tolerance_settings
curve_closest_point_8 = CurveClosestPoint(Point=sort_along_curve_15.Points, Curve=curve_13)  # -> Point, Parameter, Distance
cluster_19 = Cluster_2(number=scale_3)  # -> dimension_settings, text_settings, leader_settings, arrow_settings, units_settings, tolerance_settings
point_28 = Point(project_8.Geometry)
point_29 = Point(plane_16)
deconstruct_brep_4 = DeconstructBrep(Brep=cap_holes_6)  # -> Faces, Edges, Vertices
area = Area(Geometry=deconstruct_brep_3.Faces)  # -> Area, Centroid
scale_4 = Panel("0.05")
list_item_35 = ListItem(List=deconstruct_brep_3.Faces, Index=Slider(3, range=0..5), Wrap=True)
aligned_dimension = AlignedDimension(
    Plane=simplify(graft(construct_plane_15)),
    PointA=simplify(graft(point_26)),
    PointB=simplify(graft(point_27)),
    Offset="200",
    TextSettings=cluster_17.text_settings,
    DimensionSettings=cluster_17.dimension_settings,
    ArrowSettings=cluster_17.arrow_settings,
    UnitsSettings=cluster_17.units_settings,
    ToleranceSettings=cluster_17.tolerance_settings)  # -> AlignedDimension, Plane, PointA, PointB, Offset
line_9 = Line(StartPoint=sort_along_curve_15.Points, EndPoint=curve_closest_point_8.Point)
colour_swatch_4 = ColourSwatch(SwatchColor=RGB(228, 183, 170))
cluster_20 = Cluster_2(number=scale_4)  # -> dimension_settings, text_settings, leader_settings, arrow_settings, units_settings, tolerance_settings
clean_tree_7 = CleanTree(RemoveNulls=True, RemoveInvalid=True, RemoveEmpty=False, Tree=line_9)
plane_19 = Plane(list_item_35)
area_2 = Area(Geometry=deconstruct_brep_4.Faces)  # -> Area, Centroid
list_item_36 = ListItem(List=deconstruct_brep_4.Faces, Index=Slider(3, range=0..5), Wrap=True)
aligned_dimension_2 = AlignedDimension(
    Plane=simplify(graft(construct_plane_16)),
    PointA=simplify(graft(point_28)),
    PointB=simplify(graft(point_29)),
    Offset="-200",
    TextSettings=cluster_18.text_settings,
    DimensionSettings=cluster_18.dimension_settings,
    ArrowSettings=cluster_18.arrow_settings,
    UnitsSettings=cluster_18.units_settings,
    ToleranceSettings=cluster_18.tolerance_settings)  # -> AlignedDimension, Plane, PointA, PointB, Offset
shift_list = ShiftList(List=curve_closest_point_8.Point, Shift=1, Wrap=True)
deconstruct_10 = Deconstruct(Point=area.Centroid)  # -> XComponent, YComponent, ZComponent
line_10 = Line(flatten([line_9, curve_13]))
plane_20 = Plane(list_item_36)
sort_list_7 = SortList(Keys=deconstruct_10.ZComponent, ValuesValuesA=area.Centroid)  # -> Keys, reverse(ValuesValuesA)
clean_tree_8 = CleanTree(RemoveNulls=True, RemoveInvalid=True, RemoveEmpty=False, Tree=line_10)
deconstruct_11 = Deconstruct(Point=area_2.Centroid)  # -> XComponent, YComponent, ZComponent
clean_tree_9 = CleanTree(RemoveNulls=True, RemoveInvalid=True, RemoveEmpty=False, Tree=line_10)
end_points_15 = EndPoints(Curve=clean_tree_7)  # -> Start, End
sort_list_8 = SortList(Keys=deconstruct_11.ZComponent, ValuesValuesA=area_2.Centroid)  # -> Keys, reverse(ValuesValuesA)
scale_5 = Panel("0.05")
list_item_37 = ListItem(List=sort_list_7.ValuesValuesA, Index=0, Wrap=True)
linear_dimension = LinearDimension(aligned_dimension_2.AlignedDimension)
custom_preview_lineweights_3 = CustomPreviewLineweights(Geometry=clean_tree_9, Shader=colour_swatch_4, Absolute=False)
project_9 = Project(Geometry=list_item_37, Plane=xy_plane_3)  # -> Geometry, Transform
aligned_dimension_3 = AlignedDimension(
    Plane=plane_19,
    PointA=list_item_37,
    PointB=project_9.Geometry,
    Offset="200",
    TextSettings=cluster_19.text_settings,
    DimensionSettings=cluster_19.dimension_settings,
    ArrowSettings=cluster_19.arrow_settings,
    UnitsSettings=cluster_19.units_settings,
    ToleranceSettings=cluster_19.tolerance_settings)  # -> AlignedDimension, Plane, PointA, PointB, Offset
linear_dimension_2 = LinearDimension(aligned_dimension_3.AlignedDimension)
cluster_21 = Cluster_2(number=scale_5)  # -> dimension_settings, text_settings, leader_settings, arrow_settings, units_settings, tolerance_settings
list_item_38 = ListItem(List=sort_list_8.ValuesValuesA, Index=0, Wrap=True)
project_10 = Project(Geometry=list_item_38, Plane=xy_plane_4)  # -> Geometry, Transform
aligned_dimension_4 = AlignedDimension(
    Plane=plane_20,
    PointA=list_item_38,
    PointB=project_10.Geometry,
    Offset="200",
    TextSettings=cluster_20.text_settings,
    DimensionSettings=cluster_20.dimension_settings,
    ArrowSettings=cluster_20.arrow_settings,
    UnitsSettings=cluster_20.units_settings,
    ToleranceSettings=cluster_20.tolerance_settings)  # -> AlignedDimension, Plane, PointA, PointB, Offset
linear_dimension_3 = LinearDimension(aligned_dimension_4.AlignedDimension)
linear_dimension_4 = LinearDimension(aligned_dimension.AlignedDimension)
merge_30 = Merge(Data1=cap_holes_5)
aligned_dimension_5 = AlignedDimension(
    PointA=simplify(graft(curve_closest_point_8.Point)),
    PointB=simplify(graft(shift_list)),
    Offset="100",
    TextSettings=cluster_21.text_settings,
    DimensionSettings=cluster_21.dimension_settings,
    ArrowSettings=cluster_21.arrow_settings,
    UnitsSettings=cluster_21.units_settings,
    ToleranceSettings=cluster_21.tolerance_settings)  # -> AlignedDimension, Plane, PointA, PointB, Offset
aligned_dimension_6 = AlignedDimension(
    PointA=simplify(graft(end_points_15.Start)),
    PointB=simplify(graft(end_points_15.End)),
    Offset="100",
    TextSettings=cluster_21.text_settings,
    DimensionSettings=cluster_21.dimension_settings,
    ArrowSettings=cluster_21.arrow_settings,
    UnitsSettings=cluster_21.units_settings,
    ToleranceSettings=cluster_21.tolerance_settings)  # -> AlignedDimension, Plane, PointA, PointB, Offset
color = Data(colour_swatch_4)
to_bake = Data(clean_tree_9)
color_2 = Data(colour_swatch_4)
color_3 = Data(colour_swatch_4)
linear_dimension_5 = LinearDimension(aligned_dimension_6.AlignedDimension)
to_bake_2 = Data(linear_dimension_5)
linear_dimension_6 = LinearDimension(aligned_dimension_5.AlignedDimension)
to_bake_3 = Data(linear_dimension_6)
colour_7 = Colour(colour)
cluster_22 = Cluster_9(geo=to_bake_3, colour=color)
cluster_23 = Cluster_9(geo=to_bake, colour=color_2)
cluster_24 = Cluster_9(geo=to_bake_2, colour=color_3)
colour_swatch_5 = ColourSwatch(SwatchColor=RGB(0, 0, 0))
colour_8 = Colour(colour_2)
colour_9 = Colour(colour)
custom_preview = CustomPreview(Geometry=linear_dimension_6, Material=colour_swatch_4)
custom_preview_2 = CustomPreview(Geometry=linear_dimension_5, Material=colour_swatch_4)
colour_swatch_6 = ColourSwatch(SwatchColor=RGB(0, 0, 0))
colour_10 = Colour(colour_5)
colour_11 = Colour(colour_4)

custom_preview_3 = CustomPreview(Geometry=cap_holes_5, Material=colour_7)
custom_preview_4 = CustomPreview(Geometry=cap_holes, Material=colour_3)
custom_preview_5 = CustomPreview(Geometry=cap_holes_4, Material=colour_2)

custom_preview_6 = CustomPreview(Geometry=project_9.Geometry, Material=colour_9)
custom_preview_7 = CustomPreview(Geometry=list_item_37, Material=colour_9)
custom_preview_8 = CustomPreview(Geometry=linear_dimension_2, Material=colour_9)

custom_preview_9 = CustomPreview(Geometry=point_27, Material=colour_8)
custom_preview_10 = CustomPreview(Geometry=point_26, Material=colour_8)
custom_preview_11 = CustomPreview(Geometry=linear_dimension_4, Material=colour_8)

custom_preview_lineweights_4 = CustomPreviewLineweights(Geometry=cull_pattern_13, Shader=ColourSwatch(SwatchColor=RGB(0, 0, 0)), Thickness="3", Absolute=False)
custom_preview_lineweights_5 = CustomPreviewLineweights(Geometry=cull_pattern_16, Shader=colour_swatch_5, Thickness="3", Absolute=False)

colour_12 = Colour(colour_4)
colour_13 = Colour(colour_6)
colour_14 = Colour(colour_5)
button = Button()
bake_objects = BakeObjects(
    Geometry=flatten(to_bake_3),
    Attributes=flatten(cluster_22),
    Bake=button,
    createGroups=True,
    ValueTable_createGroups=False)  # -> Message, Ghosts
bake_objects_2 = BakeObjects(Geometry=flatten(to_bake), Attributes=flatten(cluster_23), Bake=button, createGroups=True, ValueTable_createGroups=False)  # -> Message, Ghosts
bake_objects_3 = BakeObjects(
    Geometry=flatten(to_bake_2),
    Attributes=flatten(cluster_24),
    Bake=button,
    createGroups=True,
    ValueTable_createGroups=False)  # -> Message, Ghosts

custom_preview_12 = CustomPreview(Geometry=cap_holes_6, Material=colour_12)
custom_preview_13 = CustomPreview(Geometry=cap_holes_2, Material=colour_13)
custom_preview_14 = CustomPreview(Geometry=cap_holes_3, Material=colour_14)

custom_preview_15 = CustomPreview(Geometry=project_10.Geometry, Material=colour_11)
custom_preview_16 = CustomPreview(Geometry=list_item_38, Material=colour_11)
custom_preview_17 = CustomPreview(Geometry=linear_dimension_3, Material=colour_11)

custom_preview_18 = CustomPreview(Geometry=point_29, Material=colour_10)
custom_preview_19 = CustomPreview(Geometry=point_28, Material=colour_10)
custom_preview_20 = CustomPreview(Geometry=linear_dimension, Material=colour_10)

custom_preview_lineweights_6 = CustomPreviewLineweights(Geometry=cull_pattern_14, Shader=colour_swatch_3, Thickness="3", Absolute=False)
custom_preview_lineweights_7 = CustomPreviewLineweights(Geometry=cull_pattern_15, Shader=colour_swatch_6, Thickness="3", Absolute=False)
to_bake_4 = Data(merge_14)
color_4 = Data(colour_swatch)

to_bake_5 = Data(cap_holes_6)
color_5 = Data(colour_12)
to_bake_6 = Data(cap_holes_2)
to_bake_7 = Data(cap_holes_3)
color_6 = Data(colour_14)
to_bake_8 = Data(project_10.Geometry)
color_7 = Data(colour_11)
to_bake_9 = Data(list_item_38)
color_8 = Data(colour_11)
to_bake_10 = Data(linear_dimension_3)
color_9 = Data(colour_11)
to_bake_11 = Data(point_29)
color_10 = Data(colour_10)
to_bake_12 = Data(point_28)
color_11 = Data(colour_10)
to_bake_13 = Data(linear_dimension)
color_12 = Data(colour_10)
to_bake_14 = Data(cull_pattern_14)
color_13 = Data(colour_swatch_3)
to_bake_15 = Data(cull_pattern_15)
color_14 = Data(colour_swatch_6)
cluster_25 = Cluster_9(geo=to_bake_5, colour=color_5)
cluster_26 = Cluster_9(geo=to_bake_6, colour=colour_13)
cluster_27 = Cluster_9(geo=to_bake_7, colour=color_6)
cluster_28 = Cluster_9(geo=to_bake_8, colour=color_7)
cluster_29 = Cluster_9(geo=to_bake_9, colour=color_8)
cluster_30 = Cluster_9(geo=to_bake_10, colour=color_9)
cluster_31 = Cluster_9(geo=to_bake_11, colour=color_10)
cluster_32 = Cluster_9(geo=to_bake_12, colour=color_11)
cluster_33 = Cluster_9(geo=to_bake_13, colour=color_12)
cluster_34 = Cluster_9(geo=to_bake_14, colour=color_13)
cluster_35 = Cluster_9(geo=to_bake_15, colour=color_14)
bake_objects_4 = BakeObjects(
    Geometry=flatten(to_bake_5),
    Attributes=flatten(cluster_25),
    Bake=button,
    createGroups=True,
    ValueTable_createGroups=False)  # -> Message, Ghosts
bake_objects_5 = BakeObjects(
    Geometry=flatten(to_bake_6),
    Attributes=flatten(cluster_26),
    Bake=button,
    createGroups=True,
    ValueTable_createGroups=False)  # -> Message, Ghosts
bake_objects_6 = BakeObjects(
    Geometry=flatten(to_bake_7),
    Attributes=flatten(cluster_27),
    Bake=button,
    createGroups=True,
    ValueTable_createGroups=False)  # -> Message, Ghosts
bake_objects_7 = BakeObjects(
    Geometry=flatten(to_bake_8),
    Attributes=flatten(cluster_28),
    Bake=button,
    createGroups=True,
    ValueTable_createGroups=False)  # -> Message, Ghosts
bake_objects_8 = BakeObjects(
    Geometry=flatten(to_bake_9),
    Attributes=flatten(cluster_29),
    Bake=button,
    createGroups=True,
    ValueTable_createGroups=False)  # -> Message, Ghosts
bake_objects_9 = BakeObjects(
    Geometry=flatten(to_bake_10),
    Attributes=flatten(cluster_30),
    Bake=button,
    createGroups=True,
    ValueTable_createGroups=False)  # -> Message, Ghosts
bake_objects_10 = BakeObjects(
    Geometry=flatten(to_bake_11),
    Attributes=flatten(cluster_31),
    Bake=button,
    createGroups=True,
    ValueTable_createGroups=False)  # -> Message, Ghosts
bake_objects_11 = BakeObjects(
    Geometry=flatten(to_bake_12),
    Attributes=flatten(cluster_32),
    Bake=button,
    createGroups=True,
    ValueTable_createGroups=False)  # -> Message, Ghosts
bake_objects_12 = BakeObjects(
    Geometry=flatten(to_bake_13),
    Attributes=flatten(cluster_33),
    Bake=button,
    createGroups=True,
    ValueTable_createGroups=False)  # -> Message, Ghosts
bake_objects_13 = BakeObjects(
    Geometry=flatten(to_bake_14),
    Attributes=flatten(cluster_34),
    Bake=button,
    createGroups=True,
    ValueTable_createGroups=False)  # -> Message, Ghosts
bake_objects_14 = BakeObjects(
    Geometry=flatten(to_bake_15),
    Attributes=flatten(cluster_35),
    Bake=button,
    createGroups=True,
    ValueTable_createGroups=False)  # -> Message, Ghosts

to_bake_16 = Data(merge_15)
color_15 = Data(colour_swatch_2)

to_bake_17 = Data(cap_holes_5)
color_16 = Data(colour_7)
to_bake_18 = Data(cap_holes)
color_17 = Data(colour_3)
to_bake_19 = Data(cap_holes_4)
color_18 = Data(colour_2)
to_bake_20 = Data(project_9.Geometry)
color_19 = Data(colour_9)
to_bake_21 = Data(list_item_37)
color_20 = Data(colour_9)
to_bake_22 = Data(linear_dimension_2)
color_21 = Data(colour_9)
to_bake_23 = Data(point_27)
color_22 = Data(colour_8)
to_bake_24 = Data(point_26)
color_23 = Data(colour_8)
to_bake_25 = Data(linear_dimension_4)
color_24 = Data(colour_8)
to_bake_26 = Data(cull_pattern_13)
color_25 = Data(colour_swatch_5)
to_bake_27 = Data(cull_pattern_16)
color_26 = Data(colour_swatch_5)
cluster_36 = Cluster_9(geo=to_bake_17, colour=color_16)
cluster_37 = Cluster_9(geo=to_bake_18, colour=color_17)
cluster_38 = Cluster_9(geo=to_bake_19, colour=color_18)
cluster_39 = Cluster_9(geo=to_bake_20, colour=color_19)
cluster_40 = Cluster_9(geo=to_bake_21, colour=color_20)
cluster_41 = Cluster_9(geo=to_bake_22, colour=color_21)
cluster_42 = Cluster_9(geo=to_bake_23, colour=color_22)
cluster_43 = Cluster_9(geo=to_bake_24, colour=color_23)
cluster_44 = Cluster_9(geo=to_bake_25, colour=color_24)
cluster_45 = Cluster_9(geo=to_bake_26, colour=color_25)
cluster_46 = Cluster_9(geo=to_bake_27, colour=color_26)
bake_objects_15 = BakeObjects(
    Geometry=flatten(to_bake_17),
    Attributes=flatten(cluster_36),
    Bake=button,
    createGroups=True,
    ValueTable_createGroups=False)  # -> Message, Ghosts
bake_objects_16 = BakeObjects(
    Geometry=flatten(to_bake_18),
    Attributes=flatten(cluster_37),
    Bake=button,
    createGroups=True,
    ValueTable_createGroups=False)  # -> Message, Ghosts
bake_objects_17 = BakeObjects(
    Geometry=flatten(to_bake_19),
    Attributes=flatten(cluster_38),
    Bake=button,
    createGroups=True,
    ValueTable_createGroups=False)  # -> Message, Ghosts
bake_objects_18 = BakeObjects(
    Geometry=flatten(to_bake_20),
    Attributes=flatten(cluster_39),
    Bake=button,
    createGroups=True,
    ValueTable_createGroups=False)  # -> Message, Ghosts
bake_objects_19 = BakeObjects(
    Geometry=flatten(to_bake_21),
    Attributes=flatten(cluster_40),
    Bake=button,
    createGroups=True,
    ValueTable_createGroups=False)  # -> Message, Ghosts
bake_objects_20 = BakeObjects(
    Geometry=flatten(to_bake_22),
    Attributes=flatten(cluster_41),
    Bake=button,
    createGroups=True,
    ValueTable_createGroups=False)  # -> Message, Ghosts
bake_objects_21 = BakeObjects(
    Geometry=flatten(to_bake_23),
    Attributes=flatten(cluster_42),
    Bake=button,
    createGroups=True,
    ValueTable_createGroups=False)  # -> Message, Ghosts
bake_objects_22 = BakeObjects(
    Geometry=flatten(to_bake_24),
    Attributes=flatten(cluster_43),
    Bake=button,
    createGroups=True,
    ValueTable_createGroups=False)  # -> Message, Ghosts
bake_objects_23 = BakeObjects(
    Geometry=flatten(to_bake_25),
    Attributes=flatten(cluster_44),
    Bake=button,
    createGroups=True,
    ValueTable_createGroups=False)  # -> Message, Ghosts
bake_objects_24 = BakeObjects(
    Geometry=flatten(to_bake_26),
    Attributes=flatten(cluster_45),
    Bake=button,
    createGroups=True,
    ValueTable_createGroups=False)  # -> Message, Ghosts
bake_objects_25 = BakeObjects(
    Geometry=flatten(to_bake_27),
    Attributes=flatten(cluster_46),
    Bake=button,
    createGroups=True,
    ValueTable_createGroups=False)  # -> Message, Ghosts

cluster_47 = Cluster_9(geo=to_bake_4, colour=color_4)
cluster_48 = Cluster_9(geo=to_bake_16, colour=color_15)
bake_objects_26 = BakeObjects(
    Geometry=flatten(to_bake_4),
    Attributes=flatten(cluster_47),
    Bake=button,
    createGroups=True,
    ValueTable_createGroups=False)  # -> Message, Ghosts
bake_objects_27 = BakeObjects(
    Geometry=flatten(to_bake_16),
    Attributes=flatten(cluster_48),
    Bake=button,
    createGroups=True,
    ValueTable_createGroups=False)  # -> Message, Ghosts

# ==== cluster Cluster
division = Division(A="41", B=2)
construct_domain = ConstructDomain(DomainStart=expr("-x", division), DomainEnd=division)
construct_domain_2 = ConstructDomain(DomainStart="-20.5", DomainEnd="0")
rectangle = Rectangle(Plane=PlaneXY(0, 0, 0), XSize=construct_domain, YSize=construct_domain_2, Radius=0)  # -> Rectangle, Length
rectangle_2 = ClusterOutput(rectangle.Rectangle)

# ==== cluster Cluster_2
query_annotation_styles = QueryAnnotationStyles(AutoUpdateState=True)
list_item = ListItem(List=query_annotation_styles, Index="4", Wrap=True)
annotation_style = AnnotationStyle(AnnotationStyle=list_item)  # -> AnnotationStyle, Name, ModelScale, TextSettings, DimensionSettings, ArrowSettings, UnitsSettings, LeaderSettings, ToleranceSettings
annotation_leader_settings = AnnotationLeaderSettings(LeaderSettings=annotation_style.LeaderSettings)  # -> LeaderSettings, LeaderCurveType, HasLanding, LandingLength, ViewOriented, HorizontalTextAlignment, VerticalTextAlignment, LeaderTextOrientation
annotation_dimension_settings = AnnotationDimensionSettings(DimensionSettings=annotation_style.DimensionSettings)  # -> DimensionSettings, ViewOriented, TextLocation, TextRotation, RadialViewOriented, RadialTextLocation, RadialTextRotation, DimensionLineExtension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
annotation_tolerance_settings = AnnotationToleranceSettings(ToleranceSettings=annotation_style.ToleranceSettings)  # -> ToleranceSettings, ToleranceFormat, ToleranceResolution, AltToleranceResolution, ToleranceUpperValue, ToleranceLowerValue, ToleranceHeightScale
annotation_units_settings = AnnotationUnitsSettings(UnitsSettings=annotation_style.UnitsSettings)  # -> UnitsSettings, LengthUnitsFormat, LengthFactor, LinearResolution, Roundoff, Prefix, Suffix, ZeroSuppression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
annotation_text_settings = AnnotationTextSettings(TextSettings=annotation_style.TextSettings)  # -> TextSettings, Font, TextHeight, TextGap, MaskColour, MaskMargins, MaskFrame, ViewOriented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
annotation_arrow_settings = AnnotationArrowSettings(ArrowSettings=annotation_style.ArrowSettings)  # -> ArrowSettings, Arrow1, Arrow2, ArrowSize, FitArrow, DimensionInline, LeaderArrow, LeaderArrowSize
number = ClusterInput()
number_2 = Number(number)
multiplication = Multiplication(A=number_2, B=annotation_dimension_settings.ExtensionLineOffset)
multiplication_2 = Multiplication(A=number_2, B=annotation_dimension_settings.ExtensionLineOffset)
multiplication_3 = Multiplication(A=number_2, B=annotation_dimension_settings.FixedExtensionLength)
multiplication_4 = Multiplication(A=number_2, B=annotation_dimension_settings.BaselineSpacing)
multiplication_5 = Multiplication(A=number_2, B=annotation_dimension_settings.CentermarkSize)
multiplication_6 = Multiplication(A=number_2, B=annotation_text_settings.TextHeight)
multiplication_7 = Multiplication(A=number_2, B=annotation_text_settings.TextGap)
multiplication_8 = Multiplication(A=number_2, B=annotation_leader_settings.LandingLength)
multiplication_9 = Multiplication(A=number_2, B=annotation_arrow_settings.ArrowSize)
multiplication_10 = Multiplication(A=number_2, B=annotation_arrow_settings.LeaderArrowSize)
annotation_leader_settings_2 = AnnotationLeaderSettings(
    LeaderCurveType=annotation_leader_settings.LeaderCurveType,
    HasLanding=annotation_leader_settings.HasLanding,
    LandingLength=multiplication_8,
    ViewOriented=annotation_leader_settings.ViewOriented,
    HorizontalTextAlignment=annotation_leader_settings.HorizontalTextAlignment,
    VerticalTextAlignment=annotation_leader_settings.VerticalTextAlignment,
    LeaderTextOrientation=annotation_leader_settings.LeaderTextOrientation)  # -> LeaderSettings, LeaderCurveType, HasLanding, LandingLength, ViewOriented, HorizontalTextAlignment, VerticalTextAlignment, LeaderTextOrientation
annotation_dimension_settings_2 = AnnotationDimensionSettings(
    ViewOriented=annotation_dimension_settings.ViewOriented,
    TextLocation=annotation_dimension_settings.TextLocation,
    TextRotation=annotation_dimension_settings.TextRotation,
    RadialViewOriented=annotation_dimension_settings.RadialViewOriented,
    RadialTextLocation=annotation_dimension_settings.RadialTextLocation,
    RadialTextRotation=annotation_dimension_settings.RadialTextRotation,
    DimensionLineExtension=annotation_dimension_settings.DimensionLineExtension,
    ExtensionLineExtension=multiplication,
    ExtensionLineOffset=multiplication_2,
    FixedExtension=annotation_dimension_settings.FixedExtension,
    FixedExtensionLength=multiplication_3,
    SuppressExtension1=annotation_dimension_settings.SuppressExtension1,
    SuppressExtension2=annotation_dimension_settings.SuppressExtension2,
    BaselineSpacing=multiplication_4,
    CentermarkSize=multiplication_5,
    CentermarkType=annotation_dimension_settings.CentermarkType,
    DecimalSeparator=annotation_dimension_settings.DecimalSeparator)  # -> DimensionSettings, ViewOriented, TextLocation, TextRotation, RadialViewOriented, RadialTextLocation, RadialTextRotation, DimensionLineExtension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
annotation_text_settings_2 = AnnotationTextSettings(
    Font=annotation_text_settings.Font,
    TextHeight=multiplication_6,
    TextGap=multiplication_7,
    MaskColour=annotation_text_settings.MaskColour,
    MaskMargins=annotation_text_settings.MaskMargins,
    MaskFrame=annotation_text_settings.MaskFrame,
    ViewOriented=annotation_text_settings.ViewOriented,
    DrawForward=annotation_text_settings.DrawForward,
    HorizontalAlignment=annotation_text_settings.HorizontalAlignment,
    VerticalAlignment=annotation_text_settings.VerticalAlignment,
    FitText="0")  # -> TextSettings, Font, TextHeight, TextGap, MaskColour, MaskMargins, MaskFrame, ViewOriented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
annotation_arrow_settings_2 = AnnotationArrowSettings(
    Arrow1=annotation_arrow_settings.Arrow1,
    Arrow2=annotation_arrow_settings.Arrow2,
    ArrowSize=multiplication_9,
    FitArrow=annotation_arrow_settings.FitArrow,
    DimensionInline=annotation_arrow_settings.DimensionInline,
    LeaderArrow=annotation_arrow_settings.LeaderArrow,
    LeaderArrowSize=multiplication_10)  # -> ArrowSettings, Arrow1, Arrow2, ArrowSize, FitArrow, DimensionInline, LeaderArrow, LeaderArrowSize
panel = Panel(annotation_dimension_settings_2.ExtensionLineExtension)
dimension_settings = ClusterOutput(annotation_dimension_settings_2.DimensionSettings)
tolerance_settings = ClusterOutput(annotation_tolerance_settings.ToleranceSettings)
leader_settings = ClusterOutput(annotation_leader_settings_2.LeaderSettings)
arrow_settings = ClusterOutput(annotation_arrow_settings_2.ArrowSettings)
units_settings = ClusterOutput(annotation_units_settings.UnitsSettings)
text_settings = ClusterOutput(annotation_text_settings_2.TextSettings)

# ==== cluster Cluster_3
construct_domain = ConstructDomain(DomainStart="-20.5", DomainEnd="20.5")
construct_domain_2 = ConstructDomain(DomainStart="-20.5", DomainEnd="0")
rectangle = Rectangle(Plane=PlaneXY(0, 0, 0), XSize=construct_domain_2, YSize=construct_domain, Radius=0)  # -> Rectangle, Length
rectangle_2 = ClusterOutput(rectangle.Rectangle)

# ==== cluster Cluster_4
line = ClusterInput()
line_2 = Line(line)
length = Length(Curve=line_2)
subtraction = Subtraction(A=length, B="2.5")
evaluate_length = EvaluateLength(Curve=line_2, Length=subtraction, Normalized=False)  # -> Point, Tangent, Parameter
evaluate_length_2 = EvaluateLength(Curve=line_2, Length="2.5", Normalized=False)  # -> Point, Tangent, Parameter
merge = Merge(Data1=evaluate_length_2.Point, Data2=evaluate_length.Point)
list_item = ListItem(List=merge, Index=0, Wrap=True)  # -> Item, Item1
tolerance = Panel("0.2")
distance = Distance(PointA=list_item.Item, PointB=list_item.Item1)
larger_than = LargerThan(FirstNumber=distance, SecondNumber=tolerance)  # -> LargerThan, OrEqualTo
repeat_data = RepeatData(Data=larger_than.LargerThan, Length="2")  # -> simplify(Data)
cull_pattern = CullPattern(List=merge, CullPattern=repeat_data)
cull_pattern_2 = CullPattern(List=merge, CullPattern=invert(repeat_data))
clean_tree = CleanTree(RemoveNulls=True, RemoveInvalid=True, RemoveEmpty=True, Tree=cull_pattern)
average = Average(Input=cull_pattern_2)
clean_tree_2 = CleanTree(RemoveNulls=True, RemoveInvalid=True, RemoveEmpty=True, Tree=average)
merge_2 = Merge(Data1=clean_tree, Data2=clean_tree_2)
center_of_runs = Point(merge_2)
center_of_runs_2 = ClusterOutput(center_of_runs)

# ==== cluster Cluster_5
geometry = ClusterInput()
motion = ClusterInput()
move = Move(Geometry=geometry, Motion=motion)  # -> Geometry, Transform
clean_tree = CleanTree(RemoveNulls=True, RemoveInvalid=True, RemoveEmpty=True, Tree=move.Geometry)
end_of_runs = Point(clean_tree)
end_of_runs_2 = ClusterOutput(end_of_runs)

# ==== cluster Cluster_6
curve = ClusterInput()
curve_2 = Curve(curve)
curve_middle = CurveMiddle(Curve=curve_2)
deconstruct = Deconstruct(Point=curve_middle)  # -> XComponent, YComponent, ZComponent
sort_list = SortList(Keys=deconstruct.ZComponent, ValuesValuesA=curve_2)  # -> Keys, reverse(ValuesValuesA)
list_item = ListItem(List=sort_list.ValuesValuesA, Index=0, Wrap=True)
evaluate_curve = EvaluateCurve(Curve=reparameterize(list_item), Parameter=0.5)  # -> Point, Tangent, Angle
point = ClusterOutput(evaluate_curve.Point)
unit_z = UnitZ(Factor=1)
rotate = Rotate(Vector=evaluate_curve.Tangent, Axis=unit_z, Angle=1.570796327)
amplitude = Amplitude(Vector=rotate, Amplitude=-55)
vector = Vector(amplitude)
vector_2 = ClusterOutput(vector)

# ==== cluster Cluster_7
edges = ClusterInput()
curve = ClusterInput()
curve_middle = CurveMiddle(Curve=curve)
deconstruct = Deconstruct(Point=curve_middle)  # -> XComponent, YComponent, ZComponent
sort_list = SortList(Keys=deconstruct.ZComponent, ValuesPts=curve_middle, ValuesEdges=edges)  # -> Keys, ValuesPts, ValuesEdges
trim_data_ends = TrimDataEnds(Data=sort_list.ValuesPts, ListStart=1, ListEnd=1, PathStart=0, PathEnd=0, RenumberPaths=True)
trim_data_ends_2 = TrimDataEnds(Data=sort_list.ValuesEdges, ListStart=1, ListEnd=1, PathStart=0, PathEnd=0, RenumberPaths=True)
point_right = ClusterInput()
point_left = ClusterInput()
point_right_2 = Point(point_right)
point_left_2 = Point(point_left)
closest_point = ClosestPoint(Point=graft(point_left_2), Cloud=trim_data_ends)  # -> ClosestPoint, simplify(CPIndex), Distance
closest_point_2 = ClosestPoint(Point=graft(point_right_2), Cloud=trim_data_ends)  # -> ClosestPoint, simplify(CPIndex), Distance
list_item = ListItem(List=trim_data_ends_2, Index=closest_point.CPIndex, Wrap=True)
list_item_2 = ListItem(List=trim_data_ends_2, Index=closest_point_2.CPIndex, Wrap=True)
edges_left = Curve(list_item)
edges_left_2 = ClusterOutput(edges_left)
edges_right = Curve(list_item_2)
edges_right_2 = ClusterOutput(edges_right)

# ==== cluster Cluster_8
construct_domain = ConstructDomain(DomainStart="-20.5", DomainEnd="0")
construct_domain_2 = ConstructDomain(DomainStart="-20.5", DomainEnd="20.5")
rectangle = Rectangle(Plane=PlaneXY(0, 0, 0), XSize=construct_domain_2, YSize=construct_domain, Radius=0)  # -> Rectangle, Length
rectangle_2 = ClusterOutput(rectangle.Rectangle)

# ==== cluster Cluster_9
geo = ClusterInput()
geo_2 = Data(geo)
colour = ClusterInput()
list_length = ListLength(List=geo_2)
value_list = ValueList({"Layer", "Material", "Object", "Parent"}, selected="Object")
colour_2 = Colour(colour)
repeat_data = RepeatData(Data=colour_2, Length=list_length)
elefront_attributes = EleFrontAttributes(ColourSource=value_list, ObjectColour=repeat_data)  # -> Attributes, Keys, Values, Name, Layer, ColourSource, DisplayColour, MaterialSource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
attributes = ClusterOutput(elefront_attributes.Attributes)

# ==== cluster Cluster_10
surface = ClusterInput()
surface_2 = Surface(surface)
discontinuity = Discontinuity(Curve=surface_2, Level=1)  # -> Points, Parameters
shatter = Shatter(Curve=surface_2, Parameters=discontinuity.Parameters)  # -> simplify(Segments)
curve_middle = CurveMiddle(Curve=shatter)
deconstruct = Deconstruct(Point=curve_middle)  # -> XComponent, YComponent, ZComponent
sort_list = SortList(Keys=deconstruct.ZComponent, ValuesValuesA=shatter)  # -> Keys, ValuesValuesA
list_item = ListItem(List=sort_list.ValuesValuesA, Index=0, Wrap=True)
i = ClusterOutput(list_item)
