# Grasshopper definition 250613_VTM_B04_Walls&Concave_DataExtraction_v2_ERSK.gh (Grasshopper 1.0.8)
# plug-ins: treesloth01, Human

# ---- group: Concave target
# Inner
surface = Surface([<surface referenced from the Rhino model> x40])

# Outer
surface_2 = Surface([<surface referenced from the Rhino model> x40])

# ----
discontinuity = Discontinuity(Curve=surface, Level=1)  # -> simplify(Points), Parameters
surface_3 = Surface([<surface referenced from the Rhino model> x139])
brep_wireframe = BrepWireframe(Brep=[surface, surface_3], Density=-1)
shatter = Shatter(Curve=simplify(graft(surface)), Parameters=discontinuity.Parameters)  # -> simplify(Segments)
discontinuity_2 = Discontinuity(Curve=surface_2, Level=1)  # -> simplify(Points), Parameters
guidecrv = Curve(<curve referenced from the Rhino model>)
average = Average(Input=discontinuity.Points)
flip_curve = FlipCurve(Curve=guidecrv)  # -> Curve, Flag
custom_preview_lineweights = CustomPreviewLineweights(Geometry=brep_wireframe, Shader=ColourSwatch(SwatchColor=RGB(0, 0, 0)), Absolute=False)
curve_middle = CurveMiddle(Curve=shatter)
deconstruct = Deconstruct(Point=curve_middle)  # -> XComponent, YComponent, ZComponent
average_2 = Average(Input=discontinuity_2.Points)
sort_list = SortList(Keys=deconstruct.ZComponent, ValuesValuesA=shatter)  # -> Keys, ValuesValuesA
guidecrv_2 = Curve(<curve referenced from the Rhino model>)
sort_along_curve = SortAlongCurve(Points=flatten(average), Curve=guidecrv_2)  # -> Points, Indices
list_item = ListItem(List=surface, Index=flatten(sort_along_curve.Indices), Wrap=True)  # -> simplify(graft(Item))
sort_along_curve_2 = SortAlongCurve(Points=flatten(average_2), Curve=flip_curve.Curve)  # -> Points, Indices
list_item_2 = ListItem(List=surface_2, Index=flatten(sort_along_curve_2.Indices), Wrap=True)  # -> simplify(graft(Item))
list_item_3 = ListItem(List=sort_list.ValuesValuesA, Index=0, Wrap=True)

# ---- group: sorted concave
surface_4 = Surface(list_item_2)

# ----
list_item_4 = ListItem(List=sort_list.ValuesValuesA, Index=0, Wrap=True)

# ---- group: sorted concave
surface_5 = Surface(list_item)

# ----
end_points = EndPoints(Curve=list_item_3)  # -> Start, End
merge = Merge(Data1=list_item_3, Data2=list_item_4)  # -> flatten(Result)

# ---- group: Finds bottom edge
cluster = Cluster(surface=surface_4)

# ----
merge_2 = Merge(Data1=end_points.Start, Data2=end_points.End)  # -> flatten(Result)
sort_along_curve_3 = SortAlongCurve(Points=merge_2, Curve=guidecrv_2)  # -> Points, Indices
extend_curve = ExtendCurve(Curve=cluster, Type=0, Start="2.5", End="2.5")
list_item_5 = ListItem(List=merge, Index=sort_along_curve_3.Indices, Wrap=True)
partition_list = PartitionList(List=sort_along_curve_3.Points, Size=2)  # -> simplify(Chunks)
partition_list_2 = PartitionList(List=list_item_5, Size=2)  # -> simplify(Chunks)
end_points_2 = EndPoints(Curve=extend_curve)  # -> Start, End
list_item_6 = ListItem(List=partition_list, Index=0, Wrap=True)  # -> Item, Item1
evaluate_curve = EvaluateCurve(Curve=reparameterize(partition_list_2), Parameter=0.5)  # -> Point, Tangent, Angle
merge_3 = Merge(Data1=end_points_2.Start, Data2=end_points_2.End)  # -> flatten(Result)
merge_4 = Merge(Data1=extend_curve, Data2=extend_curve)  # -> flatten(Result)
amplitude = Amplitude(Vector=evaluate_curve.Tangent, Amplitude=2.5)

# ----
# Clusters points based on proximity
panel = Panel("10")
python_3_script = Python3Script(points=merge_3, threshold=panel)  # -> out, clusters, indices; inputs points: list of Point3d, threshold: Double
# ---------- python_3_script: Python ----------
import Rhino.Geometry as rg
from Grasshopper import DataTree
from Grasshopper.Kernel.Data import GH_Path

def cluster_points(points, threshold):
    clusters = DataTree[rg.Point3d]()
    indices = DataTree[int]()
    
    for i, point in enumerate(points):
        added_to_cluster = False
        
        # Check if the point can be added to an existing cluster
        for cluster_idx in range(clusters.BranchCount):
            cluster_path = GH_Path(cluster_idx)
            cluster = clusters.Branch(cluster_path)
            for cluster_point in cluster:
                if point.DistanceTo(cluster_point) <= threshold:
                    clusters.Add(point, cluster_path)
                    indices.Add(i, cluster_path)
                    added_to_cluster = True
                    break
            if added_to_cluster:
                break
        
        # If not added, create a new cluster
        if not added_to_cluster:
            new_path = GH_Path(clusters.BranchCount)
            clusters.Add(point, new_path)
            indices.Add(i, new_path)
    
    return clusters, indices

# Call the function and get clusters and indices
clusters, indices = cluster_points(points, threshold)

# Output clusters and indices
for idx in range(clusters.BranchCount):
    cluster = clusters.Branch(GH_Path(idx))
    cluster_indices = indices.Branch(GH_Path(idx))
    print(f"Cluster {idx + 1}: {[str(pt) for pt in cluster]}")
    print(f"Indices: {cluster_indices}")
# ---------- end python_3_script ----------
point = Point(python_3_script.clusters)

list_item_7 = ListItem(List=amplitude, Index=0, Wrap=True)
move = Move(Geometry=list_item_6.Item1, Motion=list_item_7)  # -> Geometry, Transform
reverse = Reverse(Vector=list_item_7)
move_2 = Move(Geometry=list_item_6.Item, Motion=reverse)  # -> Geometry, Transform
merge_5 = Merge(Data1=move_2.Geometry, Data2=move.Geometry)  # -> flatten(Result)

# ----
# Clusters points based on proximity
panel_2 = Panel("10")
python_3_script_2 = Python3Script(points=merge_5, threshold=panel_2)  # -> out, clusters, indices; inputs points: list of Point3d, threshold: Double; same code as python_3_script
point_2 = Point(python_3_script_2.clusters)

# ---- group: Finds bottom edge
cluster_2 = Cluster(surface=surface_5)  # -> flatten(i)

# ----
list_item_8 = ListItem(List=merge_4, Index=python_3_script.indices, Wrap=True)
number_slider = Slider(4, range=0..49)
evaluate_curve_2 = EvaluateCurve(Curve=reparameterize(list_item_8), Parameter=0.5)  # -> Point, Tangent, Angle
point_3 = Point(point_2)
point_4 = Point(point_3)
python_3_script_3 = Python3Script(pts=point_4, crvs=cluster_2)  # -> out, crvPairs; inputs pts: tree of Point3d, crvs: list of Curve
# ---------- python_3_script_3: Python ----------
""" Name: ClosestCurvePairs
    Written by: Erik Lima Müller
    Date: 2025/06/25

Description ────────────────────────────────────────────────────────────
For every Point3d in a DataTree, find the two closest curves (within 6 mm)
from a supplied list and output them to a mirrored DataTree structure.

Inputs ────────────────────────────────────────────────────────────────
    pts  : DataTree[Point3d]  – nested point collection  
    crvs : List[Curve]        – candidate curves

Outputs ───────────────────────────────────────────────────────────────
    crvPairs : DataTree[Curve] – per-point branch containing 0–2 curves
"""

import Rhino.Geometry as rg
from Grasshopper import DataTree
from Grasshopper.Kernel.Data import GH_Path

# --- parameters ---
tolerance = 6.0   # mm

# --- initialise output ---
crvPairs = DataTree[rg.Curve]()

# --- iterate through every point in the incoming DataTree ---
for i_branch in range(pts.BranchCount):
    branch = pts.Branch(i_branch)

    for j_item, pt in enumerate(branch):
        # gather (distance, curve) tuples for all curves
        dists = []
        for crv in crvs:
            ok, t = crv.ClosestPoint(pt)
            if not ok:
                continue
            closest = crv.PointAt(t)
            d = pt.DistanceTo(closest)
            if d <= tolerance:
                dists.append((d, crv))

        # sort by distance and take the two nearest
        dists.sort(key=lambda x: x[0])
        closest_two = [c for _, c in dists[:2]]

        # write results to a branch that mirrors the point’s path
        # (e.g. {i;j}) so the tree shape stays aligned
        path = GH_Path(i_branch, j_item)
        for crv in closest_two:
            crvPairs.Add(crv, path)

# --- If you need the output tree named exactly ‘crvPairs’, simply pass it
#      out of the GhPython component (or set it in the ‘Outputs’ pane).
# ---------- end python_3_script_3 ----------
point_5 = Point(point)
unit_z = UnitZ(Factor=1)
curve_middle_2 = CurveMiddle(Curve=flip_curve.Curve)
average_3 = Average(Input=point_5)
unit_z_2 = UnitZ(Factor="85")
list_item_9 = ListItem(List=flatten(python_3_script_3.crvPairs), Index=0, Wrap=True)
deconstruct_2 = Deconstruct(Point=evaluate_curve_2.Point)  # -> XComponent, YComponent, ZComponent
deconstruct_3 = Deconstruct(Point=curve_middle_2)  # -> XComponent, YComponent, ZComponent
list_item_10 = ListItem(List=list_item_8, Index=0, Wrap=True)  # -> Item, Item1
flip_curve_2 = FlipCurve(Curve=python_3_script_3.crvPairs, Guide=list_item_9)  # -> Curve, Flag
move_3 = Move(Geometry=average_3, Motion=unit_z_2)  # -> Geometry, Transform
tree_branch = TreeBranch(Tree=list_item_8, Path=number_slider, MaintainPaths=True)
tree_branch_2 = TreeBranch(Tree=average_3, Path=number_slider, MaintainPaths=True)
list_length = ListLength(List=flip_curve_2.Curve)
rotate = Rotate(Vector=evaluate_curve_2.Tangent, Axis=unit_z, Angle=".5*pi")
construct_point = ConstructPoint(XCoordinate=deconstruct_2.XComponent, YCoordinate=deconstruct_2.YComponent, ZCoordinate=deconstruct_3.ZComponent)
larger_than = LargerThan(FirstNumber=list_length, SecondNumber=2)  # -> LargerThan, OrEqualTo
cull_pattern = CullPattern(List=flip_curve_2.Curve, CullPattern=invert(larger_than.OrEqualTo))
amplitude_2 = Amplitude(Vector=rotate, Amplitude=1000)
curve_closest_point = CurveClosestPoint(Point=construct_point, Curve=flip_curve.Curve)  # -> Point, Parameter, Distance
clean_tree = CleanTree(RemoveNulls=True, RemoveInvalid=True, RemoveEmpty=True, Tree=cull_pattern)
cull_pattern_2 = CullPattern(List=flip_curve_2.Curve, CullPattern=larger_than.OrEqualTo)
vector_2pt = Vector2Pt(PointA=construct_point, PointB=curve_closest_point.Point, Unitize=False)  # -> Vector, Length
vector_display_ex = VectorDisplayEx(Point=evaluate_curve_2.Point, Vector=amplitude_2, Colour=RGB(0, 0, 0), Width=2)
dot_product = DotProduct(VectorA=rotate, VectorB=vector_2pt.Vector, Unitize=False)
end_points_3 = EndPoints(Curve=clean_tree)  # -> Start, End
clean_tree_2 = CleanTree(RemoveNulls=True, RemoveInvalid=True, RemoveEmpty=True, Tree=cull_pattern_2)
amplitude_3 = Amplitude(Vector=vector_2pt.Vector, Amplitude=1000)
smaller_than = SmallerThan(FirstNumber=dot_product, SecondNumber=0)  # -> SmallerThan, OrEqualTo
vector_display_ex_2 = VectorDisplayEx(Point=curve_closest_point.Point, Vector=amplitude_3, Colour=RGB(0, 0, 0), Width=2)
vector_2pt_2 = Vector2Pt(PointA=end_points_3.Start, PointB=end_points_3.End, Unitize=False)  # -> Vector, Length
tree_statistics = TreeStatistics(Tree=point_3)  # -> Paths, Length, Count
list_item_11 = ListItem(List=clean_tree_2, Index=0, Wrap=True)  # -> Item, Item1
cull_pattern_3 = CullPattern(List=rotate, CullPattern=invert(smaller_than.SmallerThan))
cull_pattern_4 = CullPattern(List=rotate, CullPattern=smaller_than.SmallerThan)
end_points_4 = EndPoints(Curve=list_item_11.Item)  # -> Start, End
end_points_5 = EndPoints(Curve=list_item_11.Item1)  # -> Start, End
trim_data_ends = TrimDataEnds(Data=tree_statistics.Paths, ListStart=1, ListEnd=1, PathStart=0, PathEnd=0, RenumberPaths=True)
clean_tree_3 = CleanTree(RemoveNulls=True, RemoveInvalid=True, RemoveEmpty=True, Tree=vector_2pt_2.Vector)
point_6 = Point(end_points_4.Start)
point_7 = Point(end_points_5.End)
reverse_2 = Reverse(Vector=cull_pattern_4)
deconstruct_path = DeconstructPath(Branch=tree_statistics.Paths)  # -> flatten(Indices)
deconstruct_path_2 = DeconstructPath(Branch=trim_data_ends)  # -> flatten(Indices)
vector_2pt_3 = Vector2Pt(PointA=point_6, PointB=point_7, Unitize=False)  # -> Vector, Length
unit_z_3 = UnitZ(Factor=1)
merge_6 = Merge(Data1=cull_pattern_3, Data2=reverse_2)
amplitude_4 = Amplitude(Vector=merge_6, Amplitude=1000)
vector_display_ex_3 = VectorDisplayEx(Point=evaluate_curve_2.Point, Vector=amplitude_4, Colour=RGB(0, 0, 0), Width=2)
amplitude_5 = Amplitude(Vector=vector_2pt_3.Vector, Amplitude=55)
set_difference = SetDifference(SetA=deconstruct_path, SetB=deconstruct_path_2)
list_item_12 = ListItem(List=merge_6, Index=0, Wrap=True)  # -> Item, Item1
data_path = DataPath(set_difference)
rotate_2 = Rotate(Vector=clean_tree_3, Axis=unit_z_3, Angle=".5*pi")
tree_branch_3 = TreeBranch(Tree=point_3, Path=data_path, MaintainPaths=True)
addition = Addition(A=list_item_12.Item, B=list_item_12.Item1)
tree_statistics_2 = TreeStatistics(Tree=point_3)  # -> Paths, Length, Count
partition_list_3 = PartitionList(List=flatten(amplitude_5), Size=2)  # -> simplify(Chunks)
vector_display_ex_4 = VectorDisplayEx(Point=tree_branch_3, Vector=rotate_2, Colour=RGB(0, 0, 0), Width=2)
amplitude_6 = Amplitude(Vector=addition, Amplitude=55)
trim_data_ends_2 = TrimDataEnds(Data=tree_statistics_2.Paths, ListStart=1, ListEnd=1, PathStart=0, PathEnd=0, RenumberPaths=True)
tree_statistics_3 = TreeStatistics(Tree=partition_list_3)  # -> Paths, Length, Count
deconstruct_vector = DeconstructVector(Vector=amplitude_6)  # -> XComponent, YComponent, ZComponent
tree_branch_4 = TreeBranch(Tree=point_3, Path=trim_data_ends_2, MaintainPaths=True)
unit_z_4 = UnitZ(Factor=1)
replace_paths = ReplacePaths(Data=partition_list_3, Search=tree_statistics_3.Paths, Replace=trim_data_ends_2)
vector_xyz = VectorXYZ(XComponent=deconstruct_vector.XComponent, YComponent=deconstruct_vector.YComponent, ZComponent=0)  # -> Vector, Length
move_4 = Move(Geometry=move_3.Geometry, Motion=vector_xyz.Vector)  # -> Geometry, Transform
average_4 = Average(Input=point_3)
dispatch = Dispatch(List=replace_paths, DispatchPattern=[True, False])  # -> ListA, ListB
reverse_3 = Reverse(Vector=dispatch.ListB)
unit_z_5 = UnitZ(Factor=1)
merge_7 = Merge(Data1=dispatch.ListA, Data2=reverse_3)
rotate_3 = Rotate(Vector=merge_7, Axis=unit_z_4, Angle=".5*pi")
merge_8 = Merge(Data1=simplify(rotate_2), Data2=simplify(rotate_3))
list_item_13 = ListItem(List=merge_8, Index=0, Wrap=True)  # -> Item, Item1
addition_2 = Addition(A=list_item_13.Item, B=list_item_13.Item1)
match_tree = MatchTree(Tree=addition_2, Guide=average_4)
amplitude_7 = Amplitude(Vector=match_tree, Amplitude="55")
vector_display_ex_5 = VectorDisplayEx(Point=tree_branch_4, Vector=rotate_3, Colour=RGB(0, 0, 0), Width=2)
line_sdl = LineSDL(Start=average_4, Direction=amplitude_7, Length="55")
vector_display_ex_6 = VectorDisplayEx(Point=average_4, Vector=amplitude_7, Colour=RGB(0, 0, 0), Width=2)
line_sdl_2 = LineSDL(Start=average_4, Direction=unit_z_5, Length="55")
unit_z_6 = UnitZ(Factor="85")
deconstruct_vector_2 = DeconstructVector(Vector=amplitude_7)  # -> XComponent, YComponent, ZComponent
vector_xyz_2 = VectorXYZ(XComponent=deconstruct_vector_2.XComponent, YComponent=deconstruct_vector_2.YComponent, ZComponent=0)  # -> Vector, Length
move_5 = Move(Geometry=average_4, Motion=vector_xyz_2.Vector)  # -> Geometry, Transform
move_6 = Move(Geometry=move_5.Geometry, Motion=unit_z_6)  # -> Geometry, Transform

# ----
# compare against valdemars data
merge_9 = Merge(Data1=move_6.Geometry, Data2=move_4.Geometry)  # -> flatten(Result)

# ---- group: valdemars
point_8 = Point([<point referenced from the Rhino model> x91])

# ----
closest_point = ClosestPoint(Point=merge_9, Cloud=point_8)  # -> ClosestPoint, CPIndex, Distance
number_slider_2 = Slider(1, range=0..10)
sort_list_2 = SortList(Keys=closest_point.Distance, ValuesValuesA=closest_point.ClosestPoint, ValuesA=merge_9)  # -> reverse(Keys), reverse(ValuesValuesA), reverse(ValuesA)
list_item_14 = ListItem(List=sort_list_2.ValuesValuesA, Index=number_slider_2, Wrap=True)
list_item_15 = ListItem(List=sort_list_2.ValuesA, Index=number_slider_2, Wrap=True)
panel_3 = Panel(sort_list_2.Keys)
deconstruct_4 = Deconstruct(Point=sort_list_2.ValuesValuesA)  # -> XComponent, YComponent, ZComponent
deconstruct_5 = Deconstruct(Point=sort_list_2.ValuesA)  # -> XComponent, YComponent, ZComponent
subtraction = Subtraction(A=deconstruct_4.XComponent, B=deconstruct_5.XComponent)
subtraction_2 = Subtraction(A=deconstruct_4.YComponent, B=deconstruct_5.YComponent)
subtraction_3 = Subtraction(A=deconstruct_4.ZComponent, B=deconstruct_5.ZComponent)
panel_4 = Panel(subtraction)
panel_5 = Panel(subtraction_2)

# ==== cluster Cluster
surface = ClusterInput()
surface_2 = Surface(surface)
discontinuity = Discontinuity(Curve=surface_2, Level=1)  # -> Points, Parameters
shatter = Shatter(Curve=surface_2, Parameters=discontinuity.Parameters)  # -> simplify(Segments)
curve_middle = CurveMiddle(Curve=shatter)
deconstruct = Deconstruct(Point=curve_middle)  # -> XComponent, YComponent, ZComponent
sort_list = SortList(Keys=deconstruct.ZComponent, ValuesValuesA=shatter)  # -> Keys, ValuesValuesA
list_item = ListItem(List=sort_list.ValuesValuesA, Index=0, Wrap=True)
i = ClusterOutput(list_item)
