# Grasshopper definition 250822_concaveHull_v1_ERSK.gh (Grasshopper 1.0.8)

curve = Curve(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)
populate_2d = Populate2D(Region=curve, Count=Slider(11, range=0..100), Seed=Slider(8060, range=0..10000))
# Concave Hull - alpha shape
python_3_script = Python3Script(run=Toggle(True), pts=populate_2d, factor=Slider(0.2, range=0..5))  # -> out, stats, mesh_out, boundary; inputs run: Boolean, pts: list of Point3d
# ---------- python_3_script: Python ----------
""" Name: ConcaveHull_AlphaShape_Brep
Author: ChatGPT → for Erik Lima Müller
Desc:
  Concave hull via alpha-shape:
    1) Delaunay triangulation (projected to WorldXY)
    2) Remove faces with any edge > median*(1+factor)
    3) Convert mesh -> Brep and duplicate naked edges (outer), join into loops

Inputs:
  pts     : List[Point3d]
  factor  : float (e.g. 0.2 -> threshold = 1.2 * median edge)
  run     : bool

Outputs:
  boundary : List[Curve]
  mesh_out : Mesh
  stats    : str
"""

import Rhino.Geometry as rg

boundary = []
mesh_out = None
stats = ""

def build_delaunay_mesh(points):
    """Delaunay triangulation in 2D (WorldXY) -> Mesh with original Z."""
    if len(points) < 3:
        return None
    # Project to WorldXY for robust 2D triangulation
    proj = []
    for p in points:
        proj.append(rg.Point2d(p.X, p.Y))  # WorldXY projection
    tri = None
    try:
        tri = rg.Triangulation.CreateDelaunay(proj, 0.0)
    except:
        tri = None
    if not tri or tri.Faces.Count == 0:
        # Fallback to ghpythonlib if available
        try:
            import ghpythonlib.components as ghc
            m = ghc.DelaunayMesh(points)
            return m
        except:
            return None
    m = rg.Mesh()
    for p in points:
        m.Vertices.Add(p)
    for f in tri.Faces:
        a, b, c = int(f.A), int(f.B), int(f.C)
        m.Faces.AddFace(a, b, c)
    m.Normals.ComputeNormals()
    m.Compact()
    return m

def median_edge_length(mesh):
    """Median of topology edge lengths."""
    topo = mesh.TopologyEdges
    n = topo.Count
    if n == 0:
        return None
    lengths = []
    for ei in range(n):
        ln = topo.EdgeLine(ei)
        lengths.append(ln.Length)
    lengths.sort()
    return lengths[len(lengths)//2]

def face_exceeds_threshold(mesh, fi, thr):
    """Return True if any face edge exceeds threshold."""
    mf = mesh.Faces[fi]
    V = mesh.Vertices
    if mf.IsTriangle:
        a, b, c = mf.A, mf.B, mf.C
        pa, pb, pc = V[a], V[b], V[c]
        if pa.DistanceTo(pb) > thr: return True
        if pb.DistanceTo(pc) > thr: return True
        if pc.DistanceTo(pa) > thr: return True
        return False
    else:
        a, b, c, d = mf.A, mf.B, mf.C, mf.D
        p = V
        pairs = [(a,b),(b,c),(c,d),(d,a),(a,c)]
        for u, v in pairs:
            if p[u].DistanceTo(p[v]) > thr:
                return True
        return False

if pts and (run is None or run):
    if len(pts) < 3:
        stats = "Need ≥ 3 points."
    else:
        # 1) Delaunay
        mesh = build_delaunay_mesh(pts)
        if mesh is None or mesh.Faces.Count == 0:
            stats = "Delaunay produced no faces."
        else:
            # 2) Threshold from median topology edge length
            med = median_edge_length(mesh)
            if med is None or med <= 0.0:
                stats = "Failed to compute median edge length."
            else:
                thr = med * (1.0 + (factor if factor is not None else 0.0))

                # Delete faces exceeding threshold
                del_mask = [False] * mesh.Faces.Count
                for fi in range(mesh.Faces.Count):
                    if face_exceeds_threshold(mesh, fi, thr):
                        del_mask[fi] = True

                mesh.Faces.DeleteFaces(del_mask)
                mesh.Normals.ComputeNormals()
                mesh.Compact()
                mesh_out = mesh

                # 3) Mesh -> Brep, duplicate naked outer edges, join
                boundary = []
                brep = rg.Brep.CreateFromMesh(mesh_out, False)
                if brep:
                    crvs = brep.DuplicateNakedEdgeCurves(True, False)  # (outer=True, inner=False)
                    crvs = list(crvs) if crvs else []
                    if crvs:
                        boundary = rg.Curve.JoinCurves(crvs, 0.001) or crvs
                else:
                    # Fallback: use mesh naked edges (then convert to curves and join)
                    polys = mesh_out.GetNakedEdges()
                    crvs = [rg.PolylineCurve(pl) for pl in polys if pl and pl.Count > 1]
                    boundary = rg.Curve.JoinCurves(crvs, 0.001) or crvs

                kept = mesh_out.Faces.Count
                removed = sum(1 for d in del_mask if d)
                stats = "Faces kept: {}, removed: {}, median edge: {:.4f}, threshold: {:.4f}".format(
                    kept, removed, med, thr
                )
# ---------- end python_3_script ----------
curve_2 = Curve(python_3_script.boundary)
