# Grasshopper definition 260217_Rendering_mcp_v1.gh (Grasshopper 1.0.8)
# plug-ins: Cordyceps

trigger = BooleanToggle(True)
rootpath = Panel("C:\Users\ersk\OneDrive - Kvadrat\Cursor\Rhino MCP\exports")
resolution = Panel("512")
ai_exporter = Python3Script(trigger=trigger, rootPath=rootpath, resolution=resolution)  # -> out, status, folderPath, files; inputs trigger: Boolean, rootPath: String, resolution: Int32
# ---------- ai_exporter: Python ----------
"""Name: Rhino Multi-Layer AI Exporter
    Written by: Erik Lima Müller
    Date: 2026/02/17
Description
    Eksporterer viewport-lag (Base, Depth, LineArt) og metadata til en
    tidsstemplet mappe for AI-prosessering.
Inputs
    trigger: Item[Boolean]
    rootPath: Item[String]
    resolution: Item[Integer]
Outputs
    status : Item[String]
    folderPath : Item[String]
    files : DataTree[String]
"""

# ============================================================================
# IMPORTS
# ============================================================================
import System
import System.Drawing as SD
import System.Drawing.Imaging as SDI
import System.Drawing.Drawing2D as SD2D

import Rhino
import Rhino.Geometry as rg
import Rhino.Display as rd
import os
import json
import math
import time
from datetime import datetime

from Grasshopper import DataTree
from Grasshopper.Kernel.Data import GH_Path

# ============================================================================
# CONSTANTS
# ============================================================================
DEPTH_COMPUTE_CAP = 512
AUTHOR = "Erik Lima Müller"


# ============================================================================
# UTILITY HELPERS
# ============================================================================
def pt3(pt):
    try:
        return [round(float(pt.X), 6), round(float(pt.Y), 6), round(float(pt.Z), 6)]
    except AttributeError:
        return [round(float(pt[0]), 6), round(float(pt[1]), 6), round(float(pt[2]), 6)]

def vec3(v):
    return [round(float(v.X), 6), round(float(v.Y), 6), round(float(v.Z), 6)]

def dot(a, b):
    return a.X * b.X + a.Y * b.Y + a.Z * b.Z

def clamp01(v):
    return max(0.0, min(1.0, v))


# ============================================================================
# VALIDATION
# ============================================================================
def validate_inputs(root_path, res):
    if not root_path or not root_path.strip():
        return "rootPath er tom eller ugyldig"
    parent = os.path.dirname(root_path.rstrip(os.sep))
    if parent and not os.path.exists(parent):
        return f"Overordnet mappe finnes ikke: {parent}"
    if not isinstance(res, int) or res < 64:
        return "Opplosning maa vaere et heltall >= 64"
    if res > 4096:
        return "Opplosning bor ikke overstige 4096"
    return None


# ============================================================================
# FOLDER CREATION
# ============================================================================
def create_output_folder(root_path):
    if not os.path.exists(root_path):
        os.makedirs(root_path)
    stamp = datetime.now().strftime("%Y%m%d_%H%M%S")
    folder = os.path.join(root_path, stamp)
    os.makedirs(folder)
    return folder, stamp


# ============================================================================
# SCENE HELPERS
# ============================================================================
def _enum_settings():
    s = Rhino.DocObjects.ObjectEnumeratorSettings()
    s.VisibleFilter = True
    s.HiddenObjects = False
    s.IncludeGrips = False
    return s

def get_scene_bbox(doc):
    pts = []
    for obj in doc.Objects.GetObjectList(_enum_settings()):
        geom = obj.Geometry
        if geom is not None:
            bb = geom.GetBoundingBox(True)
            if bb.IsValid:
                pts.append(bb.Min)
                pts.append(bb.Max)
    return rg.BoundingBox(pts) if pts else rg.BoundingBox.Empty

def build_scene_mesh(doc):
    joined = rg.Mesh()
    for obj in doc.Objects.GetObjectList(_enum_settings()):
        meshes = obj.GetMeshes(rg.MeshType.Render)
        if meshes:
            for m in meshes:
                joined.Append(m)
    if joined.Faces.Count > 0:
        joined.FaceNormals.ComputeFaceNormals()
        joined.Normals.ComputeNormals()
    return joined


# ============================================================================
# DEPTH RANGE FROM BOUNDING BOX
# ============================================================================
def compute_depth_range(cam_loc, cam_dir, bbox):
    corners = bbox.GetCorners()
    distances = [dot(rg.Vector3d(c - cam_loc), cam_dir) for c in corners]
    positives = [d for d in distances if d > 0]
    near = min(positives) if positives else 0.1
    far = max(distances) if distances else near + 100.0
    if far <= near:
        far = near + 1.0
    return near, far


# ============================================================================
# DISPLAY-MODE FINDER
# ============================================================================
def find_display_mode(preferred_names):
    all_modes = rd.DisplayModeDescription.GetDisplayModes()
    for name in preferred_names:
        for mode in all_modes:
            if mode.EnglishName == name or mode.LocalName == name:
                return mode
    return None


# ============================================================================
# CAPTURE - BASE
# ============================================================================
def capture_base(view, size):
    return view.CaptureToBitmap(size)


# ============================================================================
# CAPTURE - LINE ART
# ============================================================================
def capture_lineart(view, size):
    target = find_display_mode(["Pen", "Technical", "Artistic", "Wireframe"])
    mode_name = "Current"
    try:
        settings = rd.ViewCaptureSettings(view, size)
        if target:
            settings.DisplayModeId = target.Id
            mode_name = target.EnglishName
        bmp = rd.ViewCapture.Capture(settings)
        if bmp:
            return bmp, mode_name
    except Exception:
        pass
    vp = view.ActiveViewport
    original = vp.DisplayMode
    try:
        if target:
            vp.DisplayMode = target
            Rhino.RhinoDoc.ActiveDoc.Views.Redraw()
            Rhino.RhinoApp.Wait()
            time.sleep(0.3)
            Rhino.RhinoDoc.ActiveDoc.Views.Redraw()
            mode_name = target.EnglishName
        bmp = view.CaptureToBitmap(size)
    finally:
        vp.DisplayMode = original
        view.Redraw()
    return bmp, mode_name


# ============================================================================
# UPSCALE BITMAP
# ============================================================================
def upscale_bitmap(source, target_res):
    result = SD.Bitmap(target_res, target_res)
    g = SD.Graphics.FromImage(result)
    g.InterpolationMode = SD2D.InterpolationMode.HighQualityBicubic
    g.DrawImage(source, 0, 0, target_res, target_res)
    g.Dispose()
    source.Dispose()
    return result


# ============================================================================
# CAPTURE - DEPTH + NORMAL  (manual ray computation for square output)
# ============================================================================
def capture_depth_and_normal(view, resolution, scene_mesh, bbox,
                              do_normal=True):
    """Ray-cast depth and normal maps that match a square CaptureToBitmap.

    Rays are computed manually from the camera parameters so the
    frustum matches the square bitmap capture exactly (CaptureToBitmap
    preserves the vertical FOV and sets hFOV = vFOV for 1:1 output).
    """
    vp = view.ActiveViewport
    cam_loc = vp.CameraLocation
    cam_dir = rg.Vector3d(vp.CameraDirection)
    cam_dir.Unitize()

    # Build orthonormal camera basis
    cam_up_raw = rg.Vector3d(vp.CameraUp)
    cam_right = rg.Vector3d.CrossProduct(cam_dir, cam_up_raw)
    cam_right.Unitize()
    cam_up = rg.Vector3d.CrossProduct(cam_right, cam_dir)
    cam_up.Unitize()

    near, far = compute_depth_range(cam_loc, cam_dir, bbox)
    depth_range = far - near
    if depth_range <= 0:
        depth_range = 1.0

    # Camera-space basis for normal encoding (ControlNet convention)
    cam_nx = cam_right
    cam_ny = cam_up
    cam_nz = rg.Vector3d(-cam_dir.X, -cam_dir.Y, -cam_dir.Z)

    is_perspective = vp.IsPerspectiveProjection

    # Determine FOV / frustum extents for a SQUARE output
    if is_perspective:
        angle_ok = False
        try:
            result = vp.GetCameraAngle()
            if result[0]:
                half_vert = float(result[2])
                angle_ok = True
        except Exception:
            pass
        if not angle_ok:
            try:
                lens = float(vp.Camera35mmLensLength)
            except Exception:
                lens = 50.0
            half_vert = math.atan(12.0 / lens)
        tan_half = math.tan(half_vert)
    else:
        # Parallel projection: get frustum extents
        half_ext = 100.0
        try:
            result = vp.GetFrustum()
            if result[0]:
                left   = float(result[1])
                right  = float(result[2])
                bottom = float(result[3])
                top    = float(result[4])
                half_w = (right - left) / 2.0
                half_h = (top - bottom) / 2.0
                half_ext = min(half_w, half_h)
        except Exception:
            pass

    compute_res = min(resolution, DEPTH_COMPUTE_CAP)
    depth_bmp = SD.Bitmap(compute_res, compute_res)
    normal_bmp = SD.Bitmap(compute_res, compute_res) if do_normal else None

    bg_normal = SD.Color.FromArgb(255, 128, 128, 255)
    search_tol = max(depth_range * 0.001, 0.01)

    for py in range(compute_res):
        # Normalised device coords: v from +1 (top) to -1 (bottom)
        v = 1.0 - (2.0 * (py + 0.5) / compute_res)
        for px in range(compute_res):
            u = (2.0 * (px + 0.5) / compute_res) - 1.0

            if is_perspective:
                rd_x = cam_dir.X + u * tan_half * cam_right.X + v * tan_half * cam_up.X
                rd_y = cam_dir.Y + u * tan_half * cam_right.Y + v * tan_half * cam_up.Y
                rd_z = cam_dir.Z + u * tan_half * cam_right.Z + v * tan_half * cam_up.Z
                ray = rg.Ray3d(cam_loc, rg.Vector3d(rd_x, rd_y, rd_z))
            else:
                ox = cam_loc.X + u * half_ext * cam_right.X + v * half_ext * cam_up.X
                oy = cam_loc.Y + u * half_ext * cam_right.Y + v * half_ext * cam_up.Y
                oz = cam_loc.Z + u * half_ext * cam_right.Z + v * half_ext * cam_up.Z
                ray = rg.Ray3d(rg.Point3d(ox, oy, oz), cam_dir)

            t = rg.Intersect.Intersection.MeshRay(scene_mesh, ray)

            if t < 0:
                depth_bmp.SetPixel(px, py, SD.Color.Black)
                if normal_bmp:
                    normal_bmp.SetPixel(px, py, bg_normal)
                continue

            hit = ray.PointAt(t)

            # ---- Depth ----
            vec_to_hit = rg.Vector3d(hit - cam_loc)
            depth_val = dot(vec_to_hit, cam_dir)
            norm_d = clamp01((depth_val - near) / depth_range)
            gray = int(255 * (1.0 - norm_d))
            depth_bmp.SetPixel(px, py, SD.Color.FromArgb(255, gray, gray, gray))

            # ---- Normal ----
            if normal_bmp:
                mp = scene_mesh.ClosestMeshPoint(hit, search_tol)
                if mp:
                    n = scene_mesh.NormalAt(mp)
                    nx = dot(n, cam_nx)
                    ny = dot(n, cam_ny)
                    nz = dot(n, cam_nz)
                    r = int(max(0, min(255, (nx + 1.0) * 127.5)))
                    g = int(max(0, min(255, (ny + 1.0) * 127.5)))
                    b = int(max(0, min(255, (nz + 1.0) * 127.5)))
                    normal_bmp.SetPixel(px, py, SD.Color.FromArgb(255, r, g, b))
                else:
                    normal_bmp.SetPixel(px, py, bg_normal)

    if compute_res < resolution:
        depth_bmp = upscale_bitmap(depth_bmp, resolution)
        if normal_bmp:
            normal_bmp = upscale_bitmap(normal_bmp, resolution)

    return depth_bmp, normal_bmp, near, far


# ============================================================================
# METADATA BUILDER
# ============================================================================
def build_metadata(doc, bbox, near, far, resolution, compute_res,
                   timestamp, lineart_mode, file_list):
    view = doc.Views.ActiveView
    vp = view.ActiveViewport

    cam_loc = vp.CameraLocation
    cam_target = vp.CameraTarget
    cam_dir = rg.Vector3d(vp.CameraDirection)
    cam_dir.Unitize()
    cam_up = vp.CameraUp

    projection = "parallel"
    if vp.IsPerspectiveProjection:
        projection = "perspective"
    elif vp.IsTwoPointPerspectiveProjection:
        projection = "two_point_perspective"

    lens = None
    if projection == "perspective":
        try:
            lens = vp.Camera35mmLensLength
        except Exception:
            lens = 50.0

    fov_h = 0.0
    fov_v = 0.0
    try:
        result = vp.GetCameraAngle()
        if result[0]:
            fov_h = math.degrees(result[3] * 2)
            fov_v = math.degrees(result[2] * 2)
    except Exception:
        pass

    unit_name = str(doc.ModelUnitSystem)
    obj_count = sum(1 for _ in doc.Objects.GetObjectList(_enum_settings()))

    meta = {
        "camera": {
            "location": pt3(cam_loc),
            "target": pt3(cam_target),
            "direction": vec3(cam_dir),
            "up_vector": vec3(cam_up),
            "focal_length_mm": round(lens, 2) if lens else None,
            "field_of_view": {
                "horizontal_deg": round(fov_h, 2),
                "vertical_deg": round(fov_v, 2)
            },
            "projection": projection
        },
        "scene": {
            "unit_system": unit_name,
            "bounding_box": {
                "min": pt3(bbox.Min),
                "max": pt3(bbox.Max)
            } if bbox.IsValid else None,
            "active_view": vp.Name,
            "visible_object_count": obj_count
        },
        "depth": {
            "near": round(near, 6),
            "far": round(far, 6),
            "range": round(far - near, 6),
            "compute_resolution": compute_res,
            "mapping": "linear, near=white(255), far=black(0)"
        },
        "export": {
            "resolution": resolution,
            "lineart_display_mode": lineart_mode,
            "files": file_list
        },
        "system": {
            "timestamp": timestamp,
            "rhino_version": str(Rhino.RhinoApp.Version),
            "user": AUTHOR
        }
    }
    return meta


# ============================================================================
# MAIN SCRIPT LOGIC
# ============================================================================
files = DataTree[str]()
folderPath = ""

if not trigger:
    status = "Venter paa trigger..."
else:
    err = validate_inputs(rootPath, resolution)
    if err:
        status = f"FEIL: {err}"
    else:
        doc = Rhino.RhinoDoc.ActiveDoc
        view = doc.Views.ActiveView
        if not view:
            status = "FEIL: Ingen aktiv viewport funnet"
        else:
            try:
                t_start = datetime.now()
                folder, ts = create_output_folder(rootPath)
                folderPath = folder
                size = SD.Size(resolution, resolution)
                export_log: list[str] = []
                lineart_mode_name = "N/A"
                depth_near = 0.0
                depth_far = 1.0
                compute_res = min(resolution, DEPTH_COMPUTE_CAP)

                base_bmp = capture_base(view, size)
                if base_bmp:
                    bp = os.path.join(folder, "base.png")
                    base_bmp.Save(bp, SDI.ImageFormat.Png)
                    base_bmp.Dispose()
                    files.Add(bp, GH_Path(0))
                    export_log.append("base.png")

                la_bmp, lineart_mode_name = capture_lineart(view, size)
                if la_bmp:
                    lp = os.path.join(folder, "lineart.png")
                    la_bmp.Save(lp, SDI.ImageFormat.Png)
                    la_bmp.Dispose()
                    files.Add(lp, GH_Path(1))
                    export_log.append("lineart.png")

                bbox = get_scene_bbox(doc)
                if bbox.IsValid:
                    scene_mesh = build_scene_mesh(doc)
                    if scene_mesh and scene_mesh.Faces.Count > 0:
                        d_bmp, n_bmp, depth_near, depth_far = (
                            capture_depth_and_normal(
                                view, resolution, scene_mesh, bbox,
                                do_normal=True))
                        if d_bmp:
                            dp = os.path.join(folder, "depth.png")
                            d_bmp.Save(dp, SDI.ImageFormat.Png)
                            d_bmp.Dispose()
                            files.Add(dp, GH_Path(2))
                            export_log.append("depth.png")
                        if n_bmp:
                            np_path = os.path.join(folder, "normal.png")
                            n_bmp.Save(np_path, SDI.ImageFormat.Png)
                            n_bmp.Dispose()
                            files.Add(np_path, GH_Path(3))
                            export_log.append("normal.png")
                        scene_mesh.Dispose()
                    else:
                        export_log.append("SKIP depth/normal: ingen renderbare mesh")
                else:
                    export_log.append("SKIP depth/normal: tom scene")

                iso_ts = datetime.now().isoformat()
                meta = build_metadata(
                    doc, bbox, depth_near, depth_far,
                    resolution, compute_res,
                    iso_ts, lineart_mode_name, export_log)
                mp = os.path.join(folder, "metadata.json")
                with open(mp, "w", encoding="utf-8") as f:
                    json.dump(meta, f, indent=2, ensure_ascii=False)
                files.Add(mp, GH_Path(4))

                elapsed = (datetime.now() - t_start).total_seconds()
                n_files = len(export_log) + 1
                status = (f"OK  {n_files} filer eksportert "
                          f"({elapsed:.1f}s) -> {folder}")

            except Exception as ex:
                import traceback
                status = f"FEIL: {ex}\n{traceback.format_exc()}"
# ---------- end ai_exporter ----------
cordyceps = Cordyceps(HttpPort="8000", DebugLevel=Slider(1, range=0..1))  # -> About, Status, LastCommand
panel = Panel(cordyceps.LastCommand)
panel_2 = Panel(cordyceps.Status)
folderout = Panel(ai_exporter.folderPath)
filesout = Panel(ai_exporter.files)
statusout = Panel(ai_exporter.status)
