# Grasshopper definition ML_Normalization_v1.gh (Grasshopper 1.0.7)

construct_domain = ConstructDomain(DomainStart="-5", DomainEnd="5")
construct_domain_2 = ConstructDomain(DomainStart="-10", DomainEnd="10")
number_slider = Slider(16, range=0..100)
rectangle = Rectangle(Plane=PlaneXY(0, 0, 0), XSize=construct_domain_2, YSize=construct_domain, Radius=0)  # -> Rectangle, Length
populate_2d = Populate2D(Region=rectangle.Rectangle, Count=number_slider, Seed=1)
custom_preview = CustomPreview(Geometry=populate_2d, Material=ColourSwatch(SwatchColor=RGB(59, 40, 255)))
deconstruct = Deconstruct(Point=populate_2d)  # -> XComponent, YComponent, ZComponent

# ---- group: Step 1 — Compute the mean (μ)
average = Average(Input=deconstruct.XComponent)
# Take the average of each feature
average_2 = Average(Input=deconstruct.YComponent)

# ---- group: Step 2 — Subtract the mean (centre)
subtraction = Subtraction(A=deconstruct.XComponent, Μx=average)
# We move all points so that their average is now at 0.
subtraction_2 = Subtraction(A=deconstruct.YComponent, Μy=average_2)

# ----
power = Power(YΜy=subtraction_2, B="2")
power_2 = Power(XΜx=subtraction, B="2")
mass_addition = MassAddition(Input=power_2)  # -> Result, PartialResults
mass_addition_2 = MassAddition(Input=power)  # -> Result, PartialResults
point_count = Number(number_slider)
division = Division(A=mass_addition.Result, B=point_count)
division_2 = Division(A=mass_addition_2.Result, B=point_count)

# ---- group: Step 3 — Compute the spread (σ)
square_root = SquareRoot(VarianceAvg=division)
# We measure how spread out the data is —
# the standard deviation.
square_root_2 = SquareRoot(VarianceAvg=division_2)

# ---- group: Step 4 — Divide by σ (scale)
division_3 = Division(XΜx=subtraction, ΣX=square_root)
# Now, both x and y are centred around 0
# and scaled so that their spread ≈ 1.
# 
# That’s normalisation.
division_4 = Division(YΜy=subtraction_2, Σy=square_root_2)

# ----
construct_point = ConstructPoint(XCoordinate=division_3, YCoordinate=division_4, ZCoordinate=0)
custom_preview_2 = CustomPreview(Geometry=construct_point, Material=ColourSwatch(SwatchColor=RGB(59, 255, 0)))
